# Grasshopper definition Ass_from_srf_demo.gh (Grasshopper 1.0.7)
# plug-ins: Human

customdimensions = CTCustomBeamDimensions(width=Slider(25, range=0..100))  # -> plate
#   port width: Width dimension of beams of the selected type.
# ---------- customdimensions: Python ----------
import clr
from ghpythonlib.componentbase import executingcomponent as component
import System
from compas_timber.assembly import SurfaceAssembly

beam_category_names = SurfaceAssembly.beam_category_names()

def on_item_click(sender, event_info):
    item = clr.Convert(sender, System.Windows.Forms.ToolStripItem)
    ghenv.Component.Params.Output[0].NickName = str(sender)
    ghenv.Component.Params.OnParametersChanged()
    ghenv.Component.ExpireSolution(True)


class CustomBeamDimensions(component):
    def RunScript(self, width, height):
        dims = {}
        if ghenv.Component.Params.Output[0].NickName != 'Dimensions':
            dims[ghenv.Component.Params.Output[0].NickName] = (width or 0, height or 0)
        return (dims,)  # return a tuple to allow passing dict between components

    def AppendAdditionalMenuItems(self, menu):
        for name in beam_category_names:
            item = menu.Items.Add(name, None, on_item_click)
            if name == ghenv.Component.Params.Output[0].NickName:
                item.Checked = True
# ---------- end customdimensions ----------
surfaceassemblyoptions = CTSurfaceAssemblyOptions(lintel_posts=Toggle(False), edge_stud_offset=Slider(1, range=0..1), custom_dimensions=customdimensions)  # -> Options; inputs lintel_posts: Boolean, custom_dimensions: list
#   port sheeting_outside: (optional) Thickness of sheeting on the side of assembly closest to input surface. If zero, no sheeting will be added.
# ---------- surfaceassemblyoptions: Python ----------
from ghpythonlib.componentbase import executingcomponent as component


class SurfaceAssemblyOptions(component):

    def RunScript(
        self,
        sheeting_outside,
        sheeting_inside,
        lintel_posts,
        edge_stud_offset,
        custom_dimensions
    ):

        if sheeting_outside is not None and not isinstance(sheeting_outside, float):
            raise TypeError("sheeting_outside expected a float, got: {}".format(type(sheeting_outside)))
        if sheeting_inside is not None and not isinstance(sheeting_inside, float):
            raise TypeError("sheeting_inside expected a float, got: {}".format(type(sheeting_inside)))
        if lintel_posts is not None and not isinstance(lintel_posts, bool):
            raise TypeError("lintel_posts expected a bool, got: {}".format(type(lintel_posts)))

        dims = {}
        for item in custom_dimensions:
            for key, val in item.items():
                dims[key] = val

        dict = {
        "sheeting_outside":sheeting_outside,
        "sheeting_inside":sheeting_inside,
        "lintel_posts":lintel_posts,
        "edge_stud_offset":edge_stud_offset,
        "custom_dimensions":dims
        }

        return(dict,)
# ---------- end surfaceassemblyoptions ----------
geo = Geometry([<brep referenced from the Rhino model> x2])
reset = Button()
surfaceassembly = CTSurfaceAssembly(
    surface=geo,
    stud_spacing=Slider(62, range=25..100),
    beam_width=Slider(6, range=0..10),
    frame_depth=Slider(20, range=0..20),
    options=surfaceassemblyoptions,
    CreateGeometry=Toggle(True))  # -> Assembly, Geometry, debug; inputs surface: Brep, stud_direction: Vector3d, CreateGeometry: Boolean
#   port surface: Referenced planar surface from which to generate beams and joint rules.
#   port stud_spacing: spacing between studs.
#   port beam_width: Width of the cross-section.
#   port frame_depth: thickness of the frame section of the resulting assembly. used to set Beam.height
#   port stud_direction: (optional) Vector defining the direction of stud in the assembly. Default is world-Z
#   port options: (optional) SurfaceAssembly options.
#   port CreateGeometry: generate joint and feature geometry
#   port Assembly: compas_timber TimberAssembly object.
#   port Geometry: Assembly geometry.
# ---------- surfaceassembly: Python ----------
"""Creates a Beam from a LineCurve."""

from ghpythonlib.componentbase import executingcomponent as component
from Grasshopper.Kernel.GH_RuntimeMessageLevel import Warning

from Rhino.Geometry import Brep as RhinoBrep
from Rhino.Geometry import Vector3d as RhinoVector
from compas.scene import Scene
from compas.geometry import Brep
from compas_timber.assembly import SurfaceAssembly
from compas_timber.ghpython import DebugInfomation
from compas_timber.consumers import BrepGeometryConsumer


class SurfaceAssemblyComponent(component):
    def RunScript(
        self,
        surface,
        stud_spacing,
        beam_width,
        frame_depth,
        z_axis,
        options,
        CreateGeometry = False
    ):
        # minimum inputs required
        if not surface:
            return
        if not isinstance(surface, RhinoBrep):
            raise TypeError("Expected a compas.geometry.Surface, got: {}".format(type(surface)))
        if not stud_spacing:
            self.AddRuntimeMessage(Warning, "Input parameter 'spacing' failed to collect data")
        if not isinstance(stud_spacing, float):
            raise TypeError("stud_spacing expected a float, got: {}".format(type(stud_spacing)))
        if z_axis is not None and not isinstance(z_axis, RhinoVector):
            raise TypeError("Expected a compas.geometry.Vector, got: {}".format(type(z_axis)))



        # reformat unset parameters for consistency
        if not z_axis:
            z_axis = None
        if not options:
            options = {}

        assembly = SurfaceAssembly(
            Brep.from_native(surface),
            stud_spacing,
            beam_width,
            frame_depth,
            z_axis,
            **options
        )

        debug_info = DebugInfomation()
        Geometry = None
        scene = Scene()
        if CreateGeometry:
            vis_consumer = BrepGeometryConsumer(assembly.assembly)
            for result in vis_consumer.result:
                scene.add(result.geometry)
                if result.debug_info:
                    debug_info.add_feature_error(result.debug_info)
        else:
            for beam in assembly.beams:
                scene.add(beam.blank)

        if debug_info.has_errors:
            self.AddRuntimeMessage(Warning, "Error found during joint creation. See DebugInfo output for details.")

        Geometry = scene.draw()

        return assembly.assembly, Geometry, debug_info
# ---------- end surfaceassembly ----------
python = GhPythonScript(reset=reset)  # -> out, a; inputs reset: Boolean
# ---------- python: Python ----------
__author__ = "obucklin"
__version__ = "2023.09.14"

import rhinoscriptsyntax as rs
from compas_ghpython import unload_modules

if reset:
    unload_modules("compas_timber")
# ---------- end python ----------
debrep = DeconstructBrep(Brep=surfaceassembly.Geometry)  # -> Faces, Edges, Vertices
dc = DiffuseColor(RGB(0, 0, 0))
previewmat = CustomPreviewMaterials(Geometry=surfaceassembly.Geometry, DiffuseColor=RGB(255, 255, 255))
previewlw = CustomPreviewLineweights(Geometry=debrep.Edges, Shader=dc, Absolute=False)
