# Grasshopper definition CT_NEW_UI_Example.gh (Grasshopper 1.0.7)

number_slider = Slider(0.4, range=0..1)
# Cross
crv = Curve(<curve referenced from the Rhino model>)
crv_2 = Curve(<curve referenced from the Rhino model>)
geo = Geometry([<curve referenced from the Rhino model> x8])
crv_3 = Curve(<curve referenced from the Rhino model>)
# Main
crv_4 = Curve(<curve referenced from the Rhino model>)
geo_2 = Geometry([<curve referenced from the Rhino model> x8])
geo_3 = Geometry(<curve referenced from the Rhino model>)
Z = UnitZ(Factor=1)
geo_4 = Geometry([<curve referenced from the Rhino model> x3])
geo_5 = Geometry(<curve referenced from the Rhino model>)
crv_5 = Curve([<curve referenced from the Rhino model> x2])
beam = CTBeam(Centerline=geo_4, ZVector=Point(0, 0, 1), Width=0.2, Height=0.2)  # -> Beam, Blank; inputs Centerline: list of Guid, ZVector: list of Vector3d, Width: list, Height: list, Category: list, updateRefObj: Boolean
#   port Centerline: Referenced curve or line, Guid of curve or line in the active Rhino document.
#   port ZVector: Vector defining the orientation of the cross-section (corresponds to the height dimension). If None, a default will be taken.
#   port Width: Width of the cross-section (usually the smaller dimension).
#   port Height: Height of the cross-section (usually the larger dimension).
#   port Category: Category of a beam.
#   port updateRefObj: (optional) If True, the attributes in the referenced object will be updated/overwritten with the new values given here.
#   port Beam: Beam object(s).
#   port Blank: Shape of the beam's blank.
# ---------- beam: Python ----------
"""Creates a Beam from a LineCurve."""

from compas.geometry import Line
from compas.scene import Scene
from compas_rhino.conversions import curve_to_compas
from compas_rhino.conversions import vector_to_compas
from ghpythonlib.componentbase import executingcomponent as component
from Grasshopper.Kernel.GH_RuntimeMessageLevel import Error
from Grasshopper.Kernel.GH_RuntimeMessageLevel import Warning
from Rhino.RhinoDoc import ActiveDoc

from compas_timber.ghpython.rhino_object_name_attributes import update_rhobj_attributes_name
from compas_timber.parts import Beam as CTBeam


class Beam_fromCurve(component):
    def RunScript(self, Centerline, ZVector, Width, Height, Category, updateRefObj):
        # minimum inputs required
        if not Centerline:
            self.AddRuntimeMessage(Warning, "Input parameter 'Centerline' failed to collect data")
        if not Width:
            self.AddRuntimeMessage(Warning, "Input parameter 'Width' failed to collect data")
        if not Height:
            self.AddRuntimeMessage(Warning, "Input parameter 'Height' failed to collect data")

        # reformat unset parameters for consistency
        if not ZVector:
            ZVector = [None]
        if not Category:
            Category = [None]

        Beam = []
        Blank = []
        scene = Scene()

        if Centerline and Height and Width:
            # check list lengths for consistency
            N = len(Centerline)
            if len(ZVector) not in (0, 1, N):
                self.AddRuntimeMessage(
                    Error, " In 'ZVector' I need either none, one or the same number of inputs as the Crv parameter."
                )
            if len(Width) not in (1, N):
                self.AddRuntimeMessage(
                    Error, " In 'W' I need either one or the same number of inputs as the Crv parameter."
                )
            if len(Height) not in (1, N):
                self.AddRuntimeMessage(
                    Error, " In 'H' I need either one or the same number of inputs as the Crv parameter."
                )
            if len(Category) not in (0, 1, N):
                self.AddRuntimeMessage(
                    Error, " In 'Category' I need either none, one or the same number of inputs as the Crv parameter."
                )

            # duplicate data if None or single value
            if len(ZVector) != N:
                ZVector = [ZVector[0] for _ in range(N)]
            if len(Width) != N:
                Width = [Width[0] for _ in range(N)]
            if len(Height) != N:
                Height = [Height[0] for _ in range(N)]
            if len(Category) != N:
                Category = [Category[0] for _ in range(N)]

            for guid, z, w, h, c in zip(Centerline, ZVector, Width, Height, Category):
                curve = curve_to_compas(ActiveDoc.Objects.FindId(guid))
                line = Line(curve.start, curve.end)
                z = vector_to_compas(z) if z else None
                beam = CTBeam.from_centerline(centerline=line, width=w, height=h, z_vector=z)
                beam.attributes["rhino_guid"] = str(guid)
                beam.attributes["category"] = c

                if updateRefObj:
                    update_rhobj_attributes_name(guid, "width", str(w))
                    update_rhobj_attributes_name(guid, "height", str(h))
                    update_rhobj_attributes_name(guid, "zvector", str(list(beam.frame.zaxis)))
                    update_rhobj_attributes_name(guid, "category", c)

                Beam.append(beam)
                scene.add(beam.blank)

        Blank = scene.draw()

        return Beam, Blank
# ---------- end beam ----------
beam_2 = CTBeam(Centerline=geo_3, ZVector=Point(0, 0, 1), Width=0.2, Height=0.2, Category="top")  # -> Beam, Blank; inputs Centerline: list of Guid, ZVector: list of Vector3d, Width: list, Height: list, Category: list, updateRefObj: Boolean; same code as beam
beam_3 = CTBeam(Centerline=geo_2, ZVector=Point(0, 1, 0), Width=0.1, Height=0.1, Category="end")  # -> Beam, Blank; inputs Centerline: list of Guid, ZVector: list of Vector3d, Width: list, Height: list, Category: list, updateRefObj: Boolean; same code as beam
beam_4 = CTBeam(Centerline=geo_5, ZVector=Point(0, 1, 0), Width=0.1, Height=0.1, Category="end")  # -> Beam, Blank; inputs Centerline: list of Guid, ZVector: list of Vector3d, Width: list, Height: list, Category: list, updateRefObj: Boolean; same code as beam
pframes = PerpFrames(Curve=crv_5, Count=1, Align=True)  # -> Frames, Parameters
crv_6 = Curve([<curve referenced from the Rhino model> x5])
id = Guid([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])
beam_5 = CTBeam(Centerline=[crv, crv_2], ZVector=Point(0, 1, 0), Width=0.1, Height=0.2)  # -> Beam, Blank; inputs Centerline: list, ZVector: list of Vector3d, Width: list, Height: list, Category: list, updateRefObj: Boolean
#   port Centerline: Referenced curve or line, Guid of curve or line in the active Rhino document.
#   port ZVector: Vector defining the orientation of the cross-section (corresponds to the height dimension). If None, a default will be taken.
#   port Width: Width of the cross-section (usually the smaller dimension).
#   port Height: Height of the cross-section (usually the larger dimension).
#   port Category: Category of a beam.
#   port updateRefObj: (optional) If True, the attributes in the referenced object will be updated/overwritten with the new values given here.
#   port Beam: Beam object(s).
#   port Blank: Shape of the beam's blank.
# ---------- beam_5: Python ----------
"""Creates a Beam from a LineCurve."""

from ghpythonlib.componentbase import executingcomponent as component
from Grasshopper.Kernel.GH_RuntimeMessageLevel import Error
from Grasshopper.Kernel.GH_RuntimeMessageLevel import Warning
from Rhino.RhinoDoc import ActiveDoc
import rhinoscriptsyntax as rs

from compas.scene import Scene
from compas_rhino.conversions import line_to_compas
from compas_rhino.conversions import vector_to_compas

from compas_timber.ghpython.rhino_object_name_attributes import update_rhobj_attributes_name
from compas_timber.parts import Beam as CTBeam


class Beam_fromCurve(component):
    def RunScript(self, Centerline, ZVector, Width, Height, Category, updateRefObj):
        # minimum inputs required
        if not Centerline:
            self.AddRuntimeMessage(Warning, "Input parameter 'Centerline' failed to collect data")
        if not Width:
            self.AddRuntimeMessage(Warning, "Input parameter 'Width' failed to collect data")
        if not Height:
            self.AddRuntimeMessage(Warning, "Input parameter 'Height' failed to collect data")

        # reformat unset parameters for consistency
        if not ZVector:
            ZVector = [None]
        if not Category:
            Category = [None]

        Beam = []
        Blank = []
        scene = Scene()

        if Centerline and Height and Width:
            # check list lengths for consistency
            N = len(Centerline)
            if len(ZVector) not in (0, 1, N):
                self.AddRuntimeMessage(
                    Error, " In 'ZVector' I need either none, one or the same number of inputs as the Crv parameter."
                )
            if len(Width) not in (1, N):
                self.AddRuntimeMessage(
                    Error, " In 'W' I need either one or the same number of inputs as the Crv parameter."
                )
            if len(Height) not in (1, N):
                self.AddRuntimeMessage(
                    Error, " In 'H' I need either one or the same number of inputs as the Crv parameter."
                )
            if len(Category) not in (0, 1, N):
                self.AddRuntimeMessage(
                    Error, " In 'Category' I need either none, one or the same number of inputs as the Crv parameter."
                )

            # duplicate data if None or single value
            if len(ZVector) != N:
                ZVector = [ZVector[0] for _ in range(N)]
            if len(Width) != N:
                Width = [Width[0] for _ in range(N)]
            if len(Height) != N:
                Height = [Height[0] for _ in range(N)]
            if len(Category) != N:
                Category = [Category[0] for _ in range(N)]

            for line, z, w, h, c in zip(Centerline, ZVector, Width, Height, Category):
                guid, geometry = self._get_guid_and_geometry(line)
                rhino_line = rs.coerceline(geometry)
                line = line_to_compas(rhino_line)

                z = vector_to_compas(z) if z else None
                beam = CTBeam.from_centerline(centerline=line, width=w, height=h, z_vector=z)
                beam.attributes["rhino_guid"] = str(guid) if guid else None
                beam.attributes["category"] = c
                print(guid)
                if updateRefObj and guid:
                    update_rhobj_attributes_name(guid, "width", str(w))
                    update_rhobj_attributes_name(guid, "height", str(h))
                    update_rhobj_attributes_name(guid, "zvector", str(list(beam.frame.zaxis)))
                    update_rhobj_attributes_name(guid, "category", c)

                Beam.append(beam)
                scene.add(beam.blank)

        Blank = scene.draw()

        return Beam, Blank

    def _get_guid_and_geometry(self, line):
        # internalized curves and GH geometry will not have persistent GUIDs, referenced Rhino objects will
        # type hint on the input has to be 'ghdoc' for this to work
        guid = None
        geometry = line
        rhino_obj = ActiveDoc.Objects.FindId(line)
        if rhino_obj:
            guid = line
            geometry = rhino_obj.Geometry
        return guid, geometry
# ---------- end beam_5 ----------
Z_2 = UnitZ(Factor=1)
beam_6 = CTBeam(Centerline=[crv_3, crv_4], ZVector=Point(0, 1, 0), Width=0.1, Height=0.2)  # -> Beam, Blank; inputs Centerline: list, ZVector: list of Vector3d, Width: list, Height: list, Category: list, updateRefObj: Boolean; same code as beam_5
crv_7 = Curve([<curve referenced from the Rhino model> x2])
toggle = BooleanToggle(True)
item = ListItem(List=pframes.Frames, Index=0, Wrap=True)
beam_7 = CTBeam(Centerline=geo, ZVector=Z, Width=number_slider, Height=number_slider)  # -> Beam, Blank; inputs Centerline: list of Guid, ZVector: list of Vector3d, Width: list, Height: list, Category: list, updateRefObj: Boolean; same code as beam
python = GhPythonScript(reload=Button())
# ---------- python: Python ----------
from compas_ghpython import unload_modules
if reload:
    unload_modules("compas")
# ---------- end python ----------
rotate = Rotate(Geometry=Z_2, Angle=Slider(0, range=-3.141..1.57), Plane=flatten(item))  # -> Geometry, Transform
l_butt = CTLButtOptions(ModifyCross=toggle, RejectI=toggle)  # -> L_Butt; inputs SmallBeamButts: Boolean, ModifyCross: Boolean, RejectI: Boolean
#   port SmallBeamButts: If true, the beam with a larger cross-section is considered as the cross beam.
# ---------- l_butt: Python ----------
from ghpythonlib.componentbase import executingcomponent as component


from compas_timber.connections import LButtJoint
from compas_timber.ghpython import JointOptions


class LButtJointOptions(component):
    def RunScript(self, small_beam_butts, modify_cross, reject_i):
        args = {}
        if small_beam_butts is not None:
            args["small_beam_butts"] = small_beam_butts
        if modify_cross is not None:
            args["modify_cross"] = modify_cross
        if reject_i is not None:
            args["reject_i"] = reject_i

        options = JointOptions(LButtJoint, **args)

        return options
# ---------- end l_butt ----------
beam_8 = CTBeam(Centerline=crv_6, Width=0.1, Height=0.2)  # -> Beam, Blank; inputs Centerline: list, ZVector: list of Vector3d, Width: list, Height: list, Category: list, updateRefObj: Boolean
#   port Centerline: Referenced curve or line, Guid of curve or line in the active Rhino document.
#   port ZVector: Vector defining the orientation of the cross-section (corresponds to the height dimension). If None, a default will be taken.
#   port Width: Width of the cross-section (usually the smaller dimension).
#   port Height: Height of the cross-section (usually the larger dimension).
#   port Category: Category of a beam.
#   port updateRefObj: (optional) If True, the attributes in the referenced object will be updated/overwritten with the new values given here.
#   port Beam: Beam object(s).
#   port Blank: Shape of the beam's blank.
# ---------- beam_8: Python ----------
"""Creates a Beam from a LineCurve."""
from ghpythonlib.componentbase import executingcomponent as component
from Grasshopper.Kernel.GH_RuntimeMessageLevel import Error
from Grasshopper.Kernel.GH_RuntimeMessageLevel import Warning
from Rhino.RhinoDoc import ActiveDoc
import rhinoscriptsyntax as rs

from compas.scene import Scene
from compas_rhino.conversions import line_to_compas
from compas_rhino.conversions import vector_to_compas

from compas_timber.ghpython.rhino_object_name_attributes import update_rhobj_attributes_name
from compas_timber.parts import Beam as CTBeam


class Beam_fromCurve(component):
    def RunScript(self, Centerline, ZVector, Width, Height, Category, updateRefObj):
        # minimum inputs required
        if not Centerline:
            self.AddRuntimeMessage(Warning, "Input parameter 'Centerline' failed to collect data")
        if not Width:
            self.AddRuntimeMessage(Warning, "Input parameter 'Width' failed to collect data")
        if not Height:
            self.AddRuntimeMessage(Warning, "Input parameter 'Height' failed to collect data")

        # reformat unset parameters for consistency
        if not ZVector:
            ZVector = [None]
        if not Category:
            Category = [None]

        Beam = []
        Blank = []
        scene = Scene()

        if Centerline and Height and Width:
            # check list lengths for consistency
            N = len(Centerline)
            if len(ZVector) not in (0, 1, N):
                self.AddRuntimeMessage(
                    Error, " In 'ZVector' I need either none, one or the same number of inputs as the Crv parameter."
                )
            if len(Width) not in (1, N):
                self.AddRuntimeMessage(
                    Error, " In 'W' I need either one or the same number of inputs as the Crv parameter."
                )
            if len(Height) not in (1, N):
                self.AddRuntimeMessage(
                    Error, " In 'H' I need either one or the same number of inputs as the Crv parameter."
                )
            if len(Category) not in (0, 1, N):
                self.AddRuntimeMessage(
                    Error, " In 'Category' I need either none, one or the same number of inputs as the Crv parameter."
                )

            # duplicate data if None or single value
            if len(ZVector) != N:
                ZVector = [ZVector[0] for _ in range(N)]
            if len(Width) != N:
                Width = [Width[0] for _ in range(N)]
            if len(Height) != N:
                Height = [Height[0] for _ in range(N)]
            if len(Category) != N:
                Category = [Category[0] for _ in range(N)]

            for line, z, w, h, c in zip(Centerline, ZVector, Width, Height, Category):
                guid, geometry = self._get_guid_and_geometry(line)
                rhino_line = rs.coerceline(geometry)
                line = line_to_compas(rhino_line)

                z = vector_to_compas(z) if z else None
                beam = CTBeam.from_centerline(centerline=line, width=w, height=h, z_vector=z)
                beam.attributes["rhino_guid"] = str(guid) if guid else None
                beam.attributes["category"] = c
                print(guid)
                if updateRefObj and guid:
                    update_rhobj_attributes_name(guid, "width", str(w))
                    update_rhobj_attributes_name(guid, "height", str(h))
                    update_rhobj_attributes_name(guid, "zvector", str(list(beam.frame.zaxis)))
                    update_rhobj_attributes_name(guid, "category", c)

                Beam.append(beam)
                scene.add(beam.blank)

        Blank = scene.draw()

        return Beam, Blank

    def _get_guid_and_geometry(self, line):
        # internalized curves and GH geometry will not have persistent GUIDs, referenced Rhino objects will
        # type hint on the input has to be 'ghdoc' for this to work
        guid = None
        geometry = line
        rhino_obj = ActiveDoc.Objects.FindId(line)
        if rhino_obj:
            guid = line
            geometry = rhino_obj.Geometry
        return guid, geometry
# ---------- end beam_8 ----------
vdis = VectorDisplay(Anchor=flatten(item), Vector=rotate.Geometry)
beam_9 = CTBeam(Centerline=crv_5, ZVector=rotate.Geometry, Width=0.2, Height=0.2, Category="hard")  # -> Beam, Blank; inputs Centerline: list, ZVector: list of Vector3d, Width: list, Height: list, Category: list, updateRefObj: Boolean; same code as beam_5
beam_10 = CTBeam(Centerline=crv_7, Width=0.1, Height=0.2, Category="soft")  # -> Beam, Blank; inputs Centerline: list, ZVector: list of Vector3d, Width: list, Height: list, Category: list, updateRefObj: Boolean; same code as beam_5
directjoints = CTDirectJointRules(JointOptions=l_butt, MainBeam=beam_5.Beam, SecondaryBeam=beam_6.Beam)  # -> Rule; inputs MainBeam: list, SecondaryBeam: list
#   port JointOptions: Joint Options Component
# ---------- directjoints: Python ----------
from ghpythonlib.componentbase import executingcomponent as component
from Grasshopper.Kernel.GH_RuntimeMessageLevel import Error
from Grasshopper.Kernel.GH_RuntimeMessageLevel import Warning

from compas_timber.connections import ConnectionSolver
from compas_timber.connections import JointTopology
from compas_timber.ghpython import DirectRule


class DirectJointRule(component):
    def RunScript(self, JointOptions, MainBeam, SecondaryBeam):
        if not MainBeam:
            self.AddRuntimeMessage(Warning, "Input parameter MainBeams failed to collect data.")
        if not SecondaryBeam:
            self.AddRuntimeMessage(Warning, "Input parameter CrossBeams failed to collect data.")
        if not (MainBeam and SecondaryBeam):
            return
        if not isinstance(MainBeam, list):
            MainBeam = [MainBeam]
        if not isinstance(SecondaryBeam, list):
            SecondaryBeam = [SecondaryBeam]
        if len(MainBeam) != len(SecondaryBeam):
            self.AddRuntimeMessage(Error, "Number of items in MainBeams and CrossBeams must match!")
            return
        Rules = []
        for main, secondary in zip(MainBeam, SecondaryBeam):
            topology, _, _ = ConnectionSolver().find_topology(main, secondary)
            if topology != JointOptions.type.SUPPORTED_TOPOLOGY:
                self.AddRuntimeMessage(
                    Warning,
                    "Beams meet with topology: {} which does not agree with joint of type: {}".format(
                        JointTopology.get_name(topology), JointOptions.type.__name__
                    ),
                )
                continue
            Rules.append(DirectRule(JointOptions.type, [secondary, main], **JointOptions.kwargs))
        return Rules
# ---------- end directjoints ----------
number_slider_2 = Slider(0.6, range=0..1)
l_butt_2 = CTLButtOptions(ModifyCross=Toggle(False), RejectI=Toggle(True))  # -> L_Butt; inputs SmallBeamButts: Boolean, ModifyCross: Boolean, RejectI: Boolean; same code as l_butt
l_butt_3 = CTLButtOptions()  # -> L_Butt; inputs SmallBeamButts: Boolean
#   port Gap: Gap for tolerance.
# ---------- l_butt_3: Python ----------
from ghpythonlib.componentbase import executingcomponent as component


from compas_timber.connections import LButtJoint
from compas_timber.ghpython import JointOptions


class LButtJointOptions(component):
    def RunScript(self, gap, small_beam_butts):
        args = {}
        if gap:
            args["gap"] = gap
        if small_beam_butts:
            args["small_beam_butts"] = small_beam_butts
        options = JointOptions(LButtJoint, **args)

        return options
# ---------- end l_butt_3 ----------
l_miter = CTLMiterJointOptions()  # -> L_Miter
#   port Cutoff: For very acute angles, limit the extension of the tip/beak of the joint.
# ---------- l_miter: Python ----------
from ghpythonlib.componentbase import executingcomponent as component


from compas_timber.connections import LMiterJoint
from compas_timber.ghpython import JointOptions


class LMiterJointOptions(component):
    def RunScript(self, Cutoff):
        args = {}
        if Cutoff:
            args["cutoff"] = Cutoff
        options = JointOptions(LMiterJoint, **args)

        return options
# ---------- end l_miter ----------
relay = Relay([beam_2.Beam, beam.Beam, beam_3.Beam, beam_4.Beam])
assembly = CTAssembly(Beams=[beam_5.Beam, beam_6.Beam], JointRules=flatten(directjoints), CreateGeometry=Toggle(True))  # -> Assembly, Geometry, DebugInfo; inputs Beams: list, JointRules: list, Features: list, CreateGeometry: Boolean
#   port Beams: Collection of Beams
# ---------- assembly: Python ----------
from compas.scene import Scene
from ghpythonlib.componentbase import executingcomponent as component
from Grasshopper.Kernel.GH_RuntimeMessageLevel import Warning

from compas_timber.assembly import TimberAssembly
from compas_timber.consumers import BrepGeometryConsumer
from compas_timber.connections import ConnectionSolver
from compas_timber.connections import JointTopology
from compas_timber.connections import BeamJoinningError
from compas_timber.ghpython import JointDefinition
from compas_timber.ghpython import CategoryRule
from compas_timber.ghpython import TopologyRule
from compas_timber.ghpython import DirectRule
from compas_timber.ghpython import DebugInfomation


class Assembly(component):
    def __init__(self):
        # maintains relationship of old_beam.id => new_beam_obj for referencing
        # lets us modify copies of the beams while referencing them using their old identities.
        self._beam_map = {}

    def _get_copied_beams(self, old_beams):
        """For the given old_beams returns their respective copies."""
        new_beams = []
        for beam in old_beams:
            new_beams.append(self._beam_map[id(beam)])
        return new_beams

    def get_joints_from_rules(self, beams, rules, topologies):
        if not isinstance(rules, list):
            rules = [rules]
        rules = [r for r in rules if r is not None]

        joints = []
        # rules have to be resolved into joint definitions
        topo_rules = {}
        cat_rules = []
        direct_rules = []

        for r in rules:  # separate category and topo and direct joint rules
            if isinstance(r, TopologyRule):
                topo_rules[r.topology_type] = r
            elif isinstance(r, CategoryRule):
                cat_rules.append(r)
            if isinstance(r, DirectRule):
                direct_rules.append(r)

        for topo in topologies:
            beam_a = topo["beam_a"]
            beam_b = topo["beam_b"]
            detected_topo = topo["detected_topo"]
            pair = beam_a, beam_b
            pair_joined = False

            if detected_topo == JointTopology.TOPO_UNKNOWN:
                continue

            for rule in direct_rules:  # apply direct rules first
                if rule.comply(pair):
                    joints.append(JointDefinition(rule.joint_type, rule.beams, **rule.kwargs))
                    pair_joined = True
                    break

            if not pair_joined:  # if no direct rule applies, apply category rules next
                for rule in cat_rules:
                    if not rule.comply(pair):
                        continue
                    if rule.joint_type.SUPPORTED_TOPOLOGY != detected_topo:
                        msg = "Conflict detected! Beams: {}, {} meet with topology: {} but rule assigns: {}"
                        self.AddRuntimeMessage(
                            Warning,
                            msg.format(
                                beam_a.key, beam_b.key, JointTopology.get_name(detected_topo), rule.joint_type.__name__
                            ),
                        )
                        continue
                    # sort by category to allow beam role by order (main beam first, cross beam second)
                    beam_a, beam_b = rule.reorder([beam_a, beam_b])
                    joints.append(JointDefinition(rule.joint_type, [beam_a, beam_b], **rule.kwargs))
                    break  # first matching rule

                else:  # no category rule applies, apply topology rules
                    if detected_topo not in topo_rules:
                        continue
                    else:
                        joints.append(
                            JointDefinition(
                                topo_rules[detected_topo].joint_type,
                                [beam_a, beam_b],
                                **topo_rules[detected_topo].kwargs
                            )
                        )
        return joints

    def RunScript(self, Beams, JointRules, Features, MaxDistance, CreateGeometry):
        if not Beams:
            self.AddRuntimeMessage(Warning, "Input parameter Beams failed to collect data")
        if not JointRules:
            self.AddRuntimeMessage(Warning, "Input parameter JointRules failed to collect data")
        if not (Beams):  # shows beams even if no joints are found
            return

        Assembly = TimberAssembly()
        debug_info = DebugInfomation()

        topologies = []
        solver = ConnectionSolver()
        found_pairs = solver.find_intersecting_pairs(Beams, rtree=True, max_distance=MaxDistance)
        for pair in found_pairs:
            beam_a, beam_b = pair
            detected_topo, beam_a, beam_b = solver.find_topology(beam_a, beam_b, max_distance=MaxDistance)
            if not detected_topo == JointTopology.TOPO_UNKNOWN:
                topologies.append({"detected_topo": detected_topo, "beam_a": beam_a, "beam_b": beam_b})
        Assembly.set_topologies(topologies)

        self._beam_map = {}
        beams = [b for b in Beams if b is not None]
        for beam in beams:
            c_beam = beam.copy()
            Assembly.add_beam(c_beam)
            self._beam_map[id(beam)] = c_beam
        beams = Assembly.beams

        joints = self.get_joints_from_rules(beams, JointRules, topologies)

        if joints:
            handled_beams = []
            joints = [j for j in joints if j is not None]
            # apply reversed. later joints in orginal list override ealier ones
            for joint in joints[::-1]:
                beams_to_pair = self._get_copied_beams(joint.beams)
                beam_pair_ids = set([id(beam) for beam in beams_to_pair])
                if beam_pair_ids in handled_beams:
                    continue
                try:
                    joint.joint_type.create(Assembly, *beams_to_pair, **joint.kwargs)
                except BeamJoinningError as bje:
                    debug_info.add_joint_error(bje)
                else:
                    handled_beams.append(beam_pair_ids)

        if Features:
            features = [f for f in Features if f is not None]
            for f_def in features:
                beams_to_modify = self._get_copied_beams(f_def.beams)
                for beam in beams_to_modify:
                    beam.add_features(f_def.feature)

        Geometry = None
        scene = Scene()
        if CreateGeometry:
            vis_consumer = BrepGeometryConsumer(Assembly)
            for result in vis_consumer.result:
                scene.add(result.geometry)
                if result.debug_info:
                    debug_info.add_feature_error(result.debug_info)
        else:
            for beam in Assembly.beams:
                scene.add(beam.blank)

        if debug_info.has_errors:
            self.AddRuntimeMessage(Warning, "Error found during joint creation. See DebugInfo output for details.")

        Geometry = scene.draw()
        return Assembly, Geometry, debug_info
# ---------- end assembly ----------
decomposebeam = CTDecomposeBeam(Beam=beam_6.Beam, ShowFrame=Toggle(True), ShowFaces=Toggle(True))  # -> Frame, Centerline, Box, Width, Height; inputs Beam: list, ShowFrame: Boolean, ShowFaces: Boolean
# ---------- decomposebeam: Python ----------
# flake8: noqa
from System.Drawing import Color
from compas.geometry import Line
from compas_rhino.conversions import line_to_rhino
from compas_rhino.conversions import point_to_rhino
from compas_rhino.conversions import frame_to_rhino_plane

from ghpythonlib.componentbase import executingcomponent as component


class BeamDecompose(component):

    RED = Color.FromArgb(255, 255, 100, 100)
    GREEN = Color.FromArgb(200, 50, 220, 100)
    BLUE = Color.FromArgb(200, 50, 150, 255)
    WHITE = Color.FromArgb(255, 255, 255, 255)
    YELLOW = Color.FromArgb(255, 255,255, 0)
    SCREEN_SIZE = 10
    RELATIVE_SIZE = 0

    def RunScript(self, beam, show_frame, show_faces):
        self.show_faces = show_faces if show_faces is not None else False
        self.show_frame = show_frame if show_frame is not None else False
        self.frames = []
        self.rhino_frames = []
        self.scales = []
        self.faces = []
        self.width = []
        self.height = []
        self.centerline = []

        for b in beam:
            self.frames.append(b.frame)
            self.rhino_frames.append(frame_to_rhino_plane(b.frame))
            self.scales.append(b.width + b.height)
            self.centerline.append(line_to_rhino(b.centerline))
            self.width.append(b.width)
            self.height.append(b.height)
            self.faces.append(b.faces)

        return self.rhino_frames, self.centerline, self.width, self.height

    def DrawViewportWires(self, arg):
        if self.Locked:
            return
        
        for f, s, faces in zip(self.frames, self.scales, self.faces):
            if self.show_frame:
                self._draw_frame(arg.Display, f, s)
            if self.show_faces:
                self._draw_faces(arg.Display, faces, s)      

    def _draw_frame(self, display, frame, scale):
        x = Line.from_point_and_vector(frame.point, frame.xaxis * scale)
        y = Line.from_point_and_vector(frame.point, frame.yaxis * scale)
        z = Line.from_point_and_vector(frame.point, frame.zaxis * scale)
        display.DrawArrow(line_to_rhino(x), self.RED, self.SCREEN_SIZE, self.RELATIVE_SIZE)
        display.DrawArrow(line_to_rhino(y), self.GREEN, self.SCREEN_SIZE, self.RELATIVE_SIZE)
        display.DrawArrow(line_to_rhino(z), self.BLUE, self.SCREEN_SIZE, self.RELATIVE_SIZE)

        x_loc = x.end + x.vector * scale * 1.1
        y_loc = y.end + y.vector * scale * 1.1
        z_loc = z.end + z.vector * scale * 1.1
        display.Draw2dText("X", self.RED, point_to_rhino(x_loc), True, 16, "Verdana")
        display.Draw2dText("Y", self.GREEN, point_to_rhino(y_loc), True, 16, "Verdana")
        display.Draw2dText("Z", self.BLUE, point_to_rhino(z_loc), True, 16, "Verdana")

    def _draw_faces(self, display, faces, scale):
        for index, face in enumerate(faces):
           normal = Line.from_point_and_vector(face.point, face.normal * scale)
           text = str(index)
           display.Draw2dText(text, self.WHITE, point_to_rhino(face.point), True, 16, "Verdana")
           display.DrawArrow(line_to_rhino(normal), self.YELLOW, self.SCREEN_SIZE, self.RELATIVE_SIZE)
# ---------- end decomposebeam ----------
t_half_lap = CTTHalfLapJointOptions()  # -> T_Half_Lap; inputs FlipLapSide: Boolean
#   port FlipLapSide: flip the side of the lap joint
# ---------- t_half_lap: Python ----------
from ghpythonlib.componentbase import executingcomponent as component

from compas_timber.connections import THalfLapJoint
from compas_timber.ghpython import JointOptions


class MyComponent(component):
    def RunScript(self, flip_lap_side, cut_plane_bias):
        args = {}
        if flip_lap_side:
            args["flip_lap_side"] = flip_lap_side
        if cut_plane_bias:
            args["cut_plane_bias"] = cut_plane_bias
        options = JointOptions(THalfLapJoint, **args)

        return options
# ---------- end t_half_lap ----------
l_half_lap = CTLHalfLapJointOptions()  # -> L_Half_Lap; inputs FlipLapSide: Boolean
#   port FlipLapSide: flip the side of the lap joint
# ---------- l_half_lap: Python ----------
from ghpythonlib.componentbase import executingcomponent as component


from compas_timber.connections import LHalfLapJoint
from compas_timber.ghpython import JointOptions


class MyComponent(component):
    def RunScript(self, flip_lap_side, cut_plane_bias):
        args = {}
        if flip_lap_side:
            args["flip_lap_side"] = flip_lap_side
        if cut_plane_bias:
            args["cut_plane_bias"] = cut_plane_bias

        options = JointOptions(LHalfLapJoint, **args)

        return options
# ---------- end l_half_lap ----------
jointsbytopo = CTTopologicalJointRules(L=l_butt_3)  # -> Rules
#   port L: Joint type to be applied to L topology. Default type is L-Miter. Input is a joint options component.
# ---------- jointsbytopo: Python ----------
from ghpythonlib.componentbase import executingcomponent as component
from Grasshopper.Kernel.GH_RuntimeMessageLevel import Warning

from compas_timber.connections import JointTopology
from compas_timber.ghpython import TopologyRule

from compas_timber.connections import LMiterJoint
from compas_timber.connections import TButtJoint
from compas_timber.connections import XHalfLapJoint


class TopologyJointRule(component):
    def RunScript(self, L, T, X):
        topoRules = []

        if L:
            if L.type.SUPPORTED_TOPOLOGY != JointTopology.TOPO_L:
                self.AddRuntimeMessage(Warning, "Joint type does not match topology. Joint may not be generated.")
            topoRules.append(TopologyRule(JointTopology.TOPO_L, L.type, **L.kwargs))
        else:
            topoRules.append(TopologyRule(JointTopology.TOPO_L, LMiterJoint))
        if T:
            if T.type.SUPPORTED_TOPOLOGY != JointTopology.TOPO_T:
                self.AddRuntimeMessage(Warning, "Joint type does not match topology. Joint may not be generated.")
            topoRules.append(TopologyRule(JointTopology.TOPO_T, T.type, **T.kwargs))
        else:
            topoRules.append(TopologyRule(JointTopology.TOPO_T, TButtJoint))
        if X:
            if X.type.SUPPORTED_TOPOLOGY != JointTopology.TOPO_X:
                self.AddRuntimeMessage(Warning, "Joint type does not match topology. Joint may not be generated.")
            topoRules.append(TopologyRule(JointTopology.TOPO_X, X.type, **X.kwargs))
        else:
            topoRules.append(TopologyRule(JointTopology.TOPO_X, XHalfLapJoint))

        return topoRules
# ---------- end jointsbytopo ----------
jointsbycategory = CTCategoryJointsRules(JointOptions=l_butt_2, CatA="soft", CatB="hard")  # -> Rule
#   port JointOptions: Joint Options component.
# ---------- jointsbycategory: Python ----------
from ghpythonlib.componentbase import executingcomponent as component

from compas_timber.ghpython import CategoryRule


class CategoryJointRule(component):
    def RunScript(self, JointOptions, CatA, CatB):
        if JointOptions and CatA and CatB:
            return CategoryRule(JointOptions.type, CatA, CatB, **JointOptions.kwargs)
# ---------- end jointsbycategory ----------
jointsbycategory_2 = CTCategoryJointsRules(JointOptions=l_miter, CatA="hard", CatB="hard")  # -> Rule; same code as jointsbycategory
showbeamindex = CTShowBeamIndex()
#   port Assembly: Assembly object.
# ---------- showbeamindex: Python ----------
# flake8: noqa
import System
from compas_rhino.conversions import point_to_rhino
from ghpythonlib.componentbase import executingcomponent as component


class ShowBeamIndex(component):
    def RunScript(self, Assembly):
        self.pt = []
        self.txt = []

        if not Assembly:
            return None
        for beam in Assembly.beams:
            for f_index, face in enumerate(beam.faces):
                self.pt.append(point_to_rhino(face.point))
                self.txt.append(str(f_index))

    def DrawViewportWires(self, arg):
        if self.Locked:
            return
        col = System.Drawing.Color.FromArgb(255, 255, 255, 255)
        # https://developer.rhino3d.com/api/RhinoCommon/html/M_Rhino_Display_DisplayPipeline_Draw2dText_5.htm
        for p, t in zip(self.pt, self.txt):
            arg.Display.Draw2dText(t, col, p, True, 16, "Verdana")
# ---------- end showbeamindex ----------
l_butt_4 = CTLButtOptions()  # -> L_Butt; inputs SmallBeamButts: Boolean; same code as l_butt_3

# ----
# Joint Application By Category
toggle_2 = BooleanToggle(True)
jointsbycategory_3 = CT_CategoryJointsRules(JointOptions=l_butt_4, CatA="top", CatB="end")  # -> Rule
#   port JointOptions: Joint Options component.
# ---------- jointsbycategory_3: Python ----------
from ghpythonlib.componentbase import executingcomponent as component

from compas_timber.connections import LButtJoint
from compas_timber.connections import LMiterJoint
from compas_timber.connections import TButtJoint
from compas_timber.connections import XHalfLapJoint
from compas_timber.connections import FrenchRidgeLapJoint
from compas_timber.ghpython import CategoryRule


class CategoryJointRule(component):

    def RunScript(self, JointOptions, CatA, CatB):
        if JointOptions and CatA and CatB:
            return CategoryRule(JointOptions.type, CatA, CatB, **JointOptions.kwargs)
# ---------- end jointsbycategory_3 ----------

showbeamindex_2 = CTShowBeamIndex()
#   port Assembly: Assembly object.
# ---------- showbeamindex_2: Python ----------
# flake8: noqa
import System
from compas_rhino.conversions import point_to_rhino
from ghpythonlib.componentbase import executingcomponent as component


class ShowBeamIndex(component):
    def RunScript(self, Assembly):
        self.pt = []
        self.txt = []

        if not Assembly:
            return None
        for beam in Assembly.beams:
            self.pt.append(point_to_rhino(beam.midpoint))
            self.txt.append(str(beam.key))

    def DrawViewportWires(self, arg):
        if self.Locked:
            return
        col = System.Drawing.Color.FromArgb(255, 255, 255, 255)
        # https://developer.rhino3d.com/api/RhinoCommon/html/M_Rhino_Display_DisplayPipeline_Draw2dText_5.htm
        for p, t in zip(self.pt, self.txt):
            arg.Display.Draw2dText(t, col, p, True, 16, "Verdana")
# ---------- end showbeamindex_2 ----------
assembly_2 = CTAssembly(
    Beams=beam_8.Beam,
    JointRules=flatten(jointsbytopo),
    MaxDistance=Slider(0.2, range=0.01..0.5),
    CreateGeometry=Toggle(True))  # -> Assembly, Geometry, DebugInfo; inputs Beams: list, JointRules: list, Features: list, CreateGeometry: Boolean
#   port Beams: Collection of Beams
# ---------- assembly_2: Python ----------
from compas.scene import Scene
from ghpythonlib.componentbase import executingcomponent as component
from Grasshopper.Kernel.GH_RuntimeMessageLevel import Warning

from compas_timber.assembly import TimberAssembly
from compas_timber.consumers import BrepGeometryConsumer
from compas_timber.connections import ConnectionSolver
from compas_timber.connections import JointTopology
from compas_timber.connections import BeamJoinningError
from compas_timber.ghpython import JointDefinition
from compas_timber.ghpython import CategoryRule
from compas_timber.ghpython import TopologyRule
from compas_timber.ghpython import DirectRule
from compas_timber.ghpython import DebugInfomation


class Assembly(component):
    def __init__(self):
        # maintains relationship of old_beam.id => new_beam_obj for referencing
        # lets us modify copies of the beams while referencing them using their old identities.
        self._beam_map = {}

    def _get_copied_beams(self, old_beams):
        """For the given old_beams returns their respective copies."""
        new_beams = []
        for beam in old_beams:
            new_beams.append(self._beam_map[id(beam)])
        return new_beams

    def get_joints_from_rules(self, beams, rules, topologies):
        if not isinstance(rules, list):
            rules = [rules]
        rules = [r for r in rules if r is not None]

        joints = []
        # rules have to be resolved into joint definitions
        topo_rules = {}
        cat_rules = []
        direct_rules = []

        for r in rules:  # separate category and topo and direct joint rules
            if isinstance(r, TopologyRule):
                topo_rules[r.topology_type] = r
            elif isinstance(r, CategoryRule):
                cat_rules.append(r)
            if isinstance(r, DirectRule):
                direct_rules.append(r)

        for topo in topologies:
            beam_a = topo["beam_a"]
            beam_b = topo["beam_b"]
            detected_topo = topo["detected_topo"]
            pair = beam_a, beam_b
            pair_joined = False

            if detected_topo == JointTopology.TOPO_UNKNOWN:
                continue

            for rule in direct_rules:  # apply direct rules first
                if rule.comply(pair):
                    joints.append(JointDefinition(rule.joint_type, [beam_a, beam_b], **rule.kwargs))
                    pair_joined = True
                    break

            if not pair_joined:  # if no direct rule applies, apply category rules next
                for rule in cat_rules:
                    if not rule.comply(pair):
                        continue
                    if rule.joint_type.SUPPORTED_TOPOLOGY != detected_topo:
                        msg = "Conflict detected! Beams: {}, {} meet with topology: {} but rule assigns: {}"
                        self.AddRuntimeMessage(
                            Warning,
                            msg.format(
                                beam_a.key, beam_b.key, JointTopology.get_name(detected_topo), rule.joint_type.__name__
                            ),
                        )
                        continue
                    # sort by category to allow beam role by order (main beam first, cross beam second)
                    beam_a, beam_b = rule.reorder([beam_a, beam_b])
                    joints.append(JointDefinition(rule.joint_type, [beam_a, beam_b], **rule.kwargs))
                    break  # first matching rule

                else:  # no category rule applies, apply topology rules
                    if detected_topo not in topo_rules:
                        continue
                    else:
                        joints.append(
                            JointDefinition(
                                topo_rules[detected_topo].joint_type,
                                [beam_a, beam_b],
                                **topo_rules[detected_topo].kwargs
                            )
                        )
        return joints

    def RunScript(self, Beams, JointRules, Features, MaxDistance, CreateGeometry):
        if not Beams:
            self.AddRuntimeMessage(Warning, "Input parameter Beams failed to collect data")
        if not JointRules:
            self.AddRuntimeMessage(Warning, "Input parameter JointRules failed to collect data")
        if not (Beams):  # shows beams even if no joints are found
            return

        Assembly = TimberAssembly()
        debug_info = DebugInfomation()

        topologies = []
        solver = ConnectionSolver()
        found_pairs = solver.find_intersecting_pairs(Beams, rtree=True, max_distance=MaxDistance)
        for pair in found_pairs:
            beam_a, beam_b = pair
            detected_topo, beam_a, beam_b = solver.find_topology(beam_a, beam_b, max_distance=MaxDistance)
            if not detected_topo == JointTopology.TOPO_UNKNOWN:
                topologies.append({"detected_topo": detected_topo, "beam_a": beam_a, "beam_b": beam_b})
        Assembly.set_topologies(topologies)

        self._beam_map = {}
        beams = [b for b in Beams if b is not None]
        for beam in beams:
            c_beam = beam.copy()
            Assembly.add_beam(c_beam)
            self._beam_map[id(beam)] = c_beam
        beams = Assembly.beams

        joints = self.get_joints_from_rules(beams, JointRules, topologies)

        if joints:
            handled_beams = []
            joints = [j for j in joints if j is not None]
            # apply reversed. later joints in orginal list override ealier ones
            for joint in joints[::-1]:
                beams_to_pair = self._get_copied_beams(joint.beams)
                beam_pair_ids = set([id(beam) for beam in beams_to_pair])
                if beam_pair_ids in handled_beams:
                    continue
                try:
                    joint.joint_type.create(Assembly, *beams_to_pair, **joint.kwargs)
                except BeamJoinningError as bje:
                    debug_info.add_joint_error(bje)
                else:
                    handled_beams.append(beam_pair_ids)

        if Features:
            features = [f for f in Features if f is not None]
            for f_def in features:
                beams_to_modify = self._get_copied_beams(f_def.beams)
                for beam in beams_to_modify:
                    beam.add_features(f_def.feature)

        Geometry = None
        scene = Scene()
        if CreateGeometry:
            vis_consumer = BrepGeometryConsumer(Assembly)
            for result in vis_consumer.result:
                scene.add(result.geometry)
                if result.debug_info:
                    debug_info.add_feature_error(result.debug_info)
        else:
            for beam in Assembly.beams:
                scene.add(beam.blank)

        if debug_info.has_errors:
            self.AddRuntimeMessage(Warning, "Error found during joint creation. See DebugInfo output for details.")

        Geometry = scene.draw()
        return Assembly, Geometry, debug_info
# ---------- end assembly_2 ----------
python_2 = GhPythonScript(Assembly=assembly.Assembly, i=Slider(0, range=0..3))  # -> out, a, info; inputs i: Int32
# ---------- python_2: Python ----------
from compas.scene import SceneObject
from compas.data import json_dumps

curr_joint = Assembly.joints[i]

a = [SceneObject(b.blank).draw()[0] for b in curr_joint.beams]

info = json_dumps(curr_joint.attributes, pretty=True)
# ---------- end python_2 ----------
# Direct Joint Application
l_miter_2 = CTLMiterJointOptions()  # -> L_Miter; same code as l_miter
assembly_3 = CTAssembly(
    Beams=[beam_9.Beam, beam_10.Beam],
    JointRules=flatten([jointsbycategory_2, jointsbycategory]),
    MaxDistance="0.02",
    CreateGeometry=Toggle(True))  # -> Assembly, Geometry, DebugInfo; inputs Beams: list, JointRules: list, Features: list, CreateGeometry: Boolean
#   port Beams: Collection of Beams
# ---------- assembly_3: Python ----------
from compas.scene import Scene
from ghpythonlib.componentbase import executingcomponent as component
from Grasshopper.Kernel.GH_RuntimeMessageLevel import Warning

from compas_timber.assembly import TimberAssembly
from compas_timber.consumers import BrepGeometryConsumer
from compas_timber.connections import ConnectionSolver
from compas_timber.connections import JointTopology
from compas_timber.connections import BeamJoinningError
from compas_timber.ghpython import JointDefinition
from compas_timber.ghpython import CategoryRule
from compas_timber.ghpython import TopologyRule
from compas_timber.ghpython import DirectRule
from compas_timber.ghpython import DebugInfomation


class Assembly(component):
    def __init__(self):
        # maintains relationship of old_beam.id => new_beam_obj for referencing
        # lets us modify copies of the beams while referencing them using their old identities.
        self._beam_map = {}

    def _get_copied_beams(self, old_beams):
        """For the given old_beams returns their respective copies."""
        new_beams = []
        for beam in old_beams:
            new_beams.append(self._beam_map[id(beam)])
        return new_beams

    def get_joints_from_rules(self, beams, rules, topologies):
        if not isinstance(rules, list):
            rules = [rules]
        rules = [r for r in rules if r is not None]

        joints = []
        # rules have to be resolved into joint definitions
        topo_rules = {}
        cat_rules = []
        direct_rules = []

        for r in rules:  # separate category and topo and direct joint rules
            if isinstance(r, TopologyRule):
                topo_rules[r.topology_type] = r
            elif isinstance(r, CategoryRule):
                cat_rules.append(r)
            if isinstance(r, DirectRule):
                direct_rules.append(r)

        for topo in topologies:
            beam_a = topo["beam_a"]
            beam_b = topo["beam_b"]
            detected_topo = topo["detected_topo"]
            pair = beam_a, beam_b
            pair_joined = False

            if detected_topo == JointTopology.TOPO_UNKNOWN:
                continue

            for rule in direct_rules:  # apply direct rules first
                if rule.comply(pair):
                    joints.append(JointDefinition(rule.joint_type, [beam_a, beam_b], **rule.kwargs))
                    pair_joined = True
                    break

            if not pair_joined:  # if no direct rule applies, apply category rules next
                for rule in cat_rules:
                    if not rule.comply(pair):
                        continue
                    if rule.joint_type.SUPPORTED_TOPOLOGY != detected_topo:
                        msg = "Conflict detected! Beams: {}, {} meet with topology: {} but rule assigns: {}"
                        self.AddRuntimeMessage(
                            Warning,
                            msg.format(
                                beam_a.key, beam_b.key, JointTopology.get_name(detected_topo), rule.joint_type.__name__
                            ),
                        )
#                        continue
                    # sort by category to allow beam role by order (main beam first, cross beam second)
                    beam_a, beam_b = rule.reorder([beam_a, beam_b])
                    joints.append(JointDefinition(rule.joint_type, [beam_a, beam_b], **rule.kwargs))
                    break  # first matching rule

                else:  # no category rule applies, apply topology rules
                    if detected_topo not in topo_rules:
                        continue
                    else:
                        joints.append(
                            JointDefinition(
                                topo_rules[detected_topo].joint_type,
                                [beam_a, beam_b],
                                **topo_rules[detected_topo].kwargs
                            )
                        )
        return joints

    def RunScript(self, Beams, JointRules, Features, MaxDistance, CreateGeometry):
        if not Beams:
            self.AddRuntimeMessage(Warning, "Input parameter Beams failed to collect data")
        if not JointRules:
            self.AddRuntimeMessage(Warning, "Input parameter JointRules failed to collect data")
        if not (Beams):  # shows beams even if no joints are found
            return

        Assembly = TimberAssembly()
        debug_info = DebugInfomation()

        topologies = []
        solver = ConnectionSolver()
        found_pairs = solver.find_intersecting_pairs(Beams, rtree=True, max_distance=MaxDistance)
        for pair in found_pairs:
            beam_a, beam_b = pair
            detected_topo, beam_a, beam_b = solver.find_topology(beam_a, beam_b, max_distance=MaxDistance)
            if not detected_topo == JointTopology.TOPO_UNKNOWN:
                topologies.append({"detected_topo": detected_topo, "beam_a": beam_a, "beam_b": beam_b})
        Assembly.set_topologies(topologies)

        self._beam_map = {}
        beams = [b for b in Beams if b is not None]
        for beam in beams:
            c_beam = beam.copy()
            Assembly.add_beam(c_beam)
            self._beam_map[id(beam)] = c_beam
        beams = Assembly.beams

        joints = self.get_joints_from_rules(beams, JointRules, topologies)

        if joints:
            handled_beams = []
            joints = [j for j in joints if j is not None]
            # apply reversed. later joints in orginal list override ealier ones
            for joint in joints[::-1]:
                beams_to_pair = self._get_copied_beams(joint.beams)
                beam_pair_ids = set([id(beam) for beam in beams_to_pair])
                if beam_pair_ids in handled_beams:
                    continue
                try:
                    joint.joint_type.create(Assembly, *beams_to_pair, **joint.kwargs)
                except BeamJoinningError as bje:
                    debug_info.add_joint_error(bje)
                else:
                    handled_beams.append(beam_pair_ids)

        if Features:
            features = [f for f in Features if f is not None]
            for f_def in features:
                beams_to_modify = self._get_copied_beams(f_def.beams)
                for beam in beams_to_modify:
                    beam.add_features(f_def.feature)

        Geometry = None
        scene = Scene()
        if CreateGeometry:
            vis_consumer = BrepGeometryConsumer(Assembly)
            for result in vis_consumer.result:
                scene.add(result.geometry)
                if result.debug_info:
                    debug_info.add_feature_error(result.debug_info)
        else:
            for beam in Assembly.beams:
                scene.add(beam.blank)

        if debug_info.has_errors:
            self.AddRuntimeMessage(Warning, "Error found during joint creation. See DebugInfo output for details.")

        Geometry = scene.draw()
        return Assembly, Geometry, debug_info
# ---------- end assembly_3 ----------
jointsbytopo_2 = CTTopologicalJointRules(L=l_half_lap, T=t_half_lap)  # -> Rules; same code as jointsbytopo
panel = Panel(python_2.info)
showbeamface = CTShowBeamFaceIndices()
#   port Assembly: Assembly object.
# ---------- showbeamface: Python ----------
# flake8: noqa
import System
from compas.geometry import Line
from compas_rhino.conversions import point_to_rhino
from compas_rhino.conversions import line_to_rhino
from ghpythonlib.componentbase import executingcomponent as component


class ShowBeamFaces(component):
    def RunScript(self, Assembly):
        self.pt = []
        self.txt = []
        self.normal = []
        self.scale = []

        if not Assembly:
            return None
        for beam in Assembly.beams:
            for f_index, face in enumerate(beam.faces):
                self.pt.append(point_to_rhino(face.point))
                self.txt.append(str(f_index))
                scale = beam.width + beam.height
                line = Line.from_point_and_vector(face.point, face.normal * scale)
                self.normal.append(line_to_rhino(line))

    def DrawViewportWires(self, arg):
        if self.Locked:
            return
        col = System.Drawing.Color.FromArgb(255, 255, 255, 255)
        normal_col = System.Drawing.Color.FromArgb(200, 50, 150, 255)
        screensize = 10
        relativesize = 0
        
#       https://developer.rhino3d.com/api/RhinoCommon/html/M_Rhino_Display_DisplayPipeline_Draw2dText_5.htm
        for p, t, n in zip(self.pt, self.txt, self.normal):
            arg.Display.DrawArrow(n, normal_col, screensize, relativesize)
            arg.Display.Draw2dText(t, col, p, True, 16, "Verdana")
# ---------- end showbeamface ----------
series = Series(Start=0, Step=Slider(5, range=0..10), Count=Slider(5, range=0..10))
assembly_4 = CTAssembly(Beams=beam_7.Beam, JointRules=flatten(jointsbytopo_2), CreateGeometry=Toggle(True))  # -> Assembly, Geometry, DebugInfo; inputs Beams: list, JointRules: list, Features: list, CreateGeometry: Boolean
#   port Beams: Collection of Beams
# ---------- assembly_4: Python ----------
from compas.scene import Scene
from ghpythonlib.componentbase import executingcomponent as component
from Grasshopper.Kernel.GH_RuntimeMessageLevel import Warning

from compas_timber.assembly import TimberAssembly
from compas_timber.consumers import BrepGeometryConsumer
from compas_timber.connections import ConnectionSolver
from compas_timber.connections import JointTopology
from compas_timber.connections import BeamJoinningError
from compas_timber.ghpython import JointDefinition
from compas_timber.ghpython import CategoryRule
from compas_timber.ghpython import TopologyRule
from compas_timber.ghpython import DirectRule
from compas_timber.ghpython import DebugInfomation


class Assembly(component):
    def __init__(self):
        # maintains relationship of old_beam.id => new_beam_obj for referencing
        # lets us modify copies of the beams while referencing them using their old identities.
        self._beam_map = {}

    def _get_copied_beams(self, old_beams):
        """For the given old_beams returns their respective copies."""
        new_beams = []
        for beam in old_beams:
            new_beams.append(self._beam_map[id(beam)])
        return new_beams

    def get_joints_from_rules(self, beams, rules, topologies):
        if not isinstance(rules, list):
            rules = [rules]
        rules = [r for r in rules if r is not None]

        joints = []
        # rules have to be resolved into joint definitions
        topo_rules = {}
        cat_rules = []
        direct_rules = []

        for r in rules:  # separate category and topo and direct joint rules
            if isinstance(r, TopologyRule):
                topo_rules[r.topology_type] = r
            elif isinstance(r, CategoryRule):
                cat_rules.append(r)
            if isinstance(r, DirectRule):
                direct_rules.append(r)

        for topo in topologies:
            beam_a = topo["beam_a"]
            beam_b = topo["beam_b"]
            detected_topo = topo["detected_topo"]
            pair = beam_a, beam_b
            pair_joined = False

            if detected_topo == JointTopology.TOPO_UNKNOWN:
                continue

            for rule in direct_rules:  # apply direct rules first
                if rule.comply(pair):
                    joints.append(JointDefinition(rule.joint_type, [beam_a, beam_b], **rule.kwargs))
                    pair_joined = True
                    break

            if not pair_joined:  # if no direct rule applies, apply category rules next
                for rule in cat_rules:
                    if not rule.comply(pair):
                        continue
                    if rule.joint_type.SUPPORTED_TOPOLOGY != detected_topo:
                        msg = "Conflict detected! Beams: {}, {} meet with topology: {} but rule assigns: {}"
                        self.AddRuntimeMessage(
                            Warning,
                            msg.format(
                                beam_a.key, beam_b.key, JointTopology.get_name(detected_topo), rule.joint_type.__name__
                            ),
                        )
                        continue
                    # sort by category to allow beam role by order (main beam first, cross beam second)
                    beam_a, beam_b = rule.reorder([beam_a, beam_b])
                    joints.append(JointDefinition(rule.joint_type, [beam_a, beam_b], **rule.kwargs))
                    break  # first matching rule

                else:  # no category rule applies, apply topology rules
                    if detected_topo not in topo_rules:
                        continue
                    else:
                        joints.append(
                            JointDefinition(
                                topo_rules[detected_topo].joint_type,
                                [beam_a, beam_b],
                                **topo_rules[detected_topo].kwargs
                            )
                        )
        return joints

    def RunScript(self, Beams, JointRules, Features, MaxDistance, CreateGeometry):
        if not Beams:
            self.AddRuntimeMessage(Warning, "Input parameter Beams failed to collect data")
        if not JointRules:
            self.AddRuntimeMessage(Warning, "Input parameter JointRules failed to collect data")
        if not (Beams):  # shows beams even if no joints are found
            return

        Assembly = TimberAssembly()
        debug_info = DebugInfomation()

        topologies = []
        solver = ConnectionSolver()
        found_pairs = solver.find_intersecting_pairs(Beams, rtree=True, max_distance=MaxDistance)
        for pair in found_pairs:
            beam_a, beam_b = pair
            detected_topo, beam_a, beam_b = solver.find_topology(beam_a, beam_b, max_distance=MaxDistance)
            if not detected_topo == JointTopology.TOPO_UNKNOWN:
                topologies.append({"detected_topo": detected_topo, "beam_a": beam_a, "beam_b": beam_b})
        Assembly.set_topologies(topologies)

        self._beam_map = {}
        beams = [b for b in Beams if b is not None]
        for beam in beams:
            c_beam = beam.copy()
            Assembly.add_beam(c_beam)
            self._beam_map[id(beam)] = c_beam
        beams = Assembly.beams

        joints = self.get_joints_from_rules(beams, JointRules, topologies)

        if joints:
            handled_beams = []
            joints = [j for j in joints if j is not None]
            # apply reversed. later joints in orginal list override ealier ones
            for joint in joints[::-1]:
                beams_to_pair = self._get_copied_beams(joint.beams)
                beam_pair_ids = set([id(beam) for beam in beams_to_pair])
                if beam_pair_ids in handled_beams:
                    continue
                try:
                    joint.joint_type.create(Assembly, *beams_to_pair, **joint.kwargs)
                except BeamJoinningError as bje:
                    debug_info.add_joint_error(bje)
                else:
                    handled_beams.append(beam_pair_ids)

        if Features:
            features = [f for f in Features if f is not None]
            for f_def in features:
                beams_to_modify = self._get_copied_beams(f_def.beams)
                for beam in beams_to_modify:
                    beam.add_features(f_def.feature)

        Geometry = None
        scene = Scene()
        if CreateGeometry:
            vis_consumer = BrepGeometryConsumer(Assembly)
            for result in vis_consumer.result:
                scene.add(result.geometry)
                if result.debug_info:
                    debug_info.add_feature_error(result.debug_info)

        if debug_info.has_errors:
            self.AddRuntimeMessage(Warning, "Error found during joint creation. See DebugInfo output for details.")

        Geometry = scene.draw()
        return Assembly, Geometry, debug_info
# ---------- end assembly_4 ----------
directjoints_2 = CTDirectJointRules(JointOptions=l_miter_2, MainBeam=beam_2.Beam, SecondaryBeam=beam_4.Beam)  # -> Rule; inputs MainBeam: list, SecondaryBeam: list; same code as directjoints
python_3 = GhPythonScript(x=assembly_3.Assembly, i=Slider(0, range=0..3))  # -> out, a; inputs i: Int32
# ---------- python_3: Python ----------
from compas.scene import SceneObject
curr = x.joints[i]

print(curr)
a = [SceneObject(b.blank).draw()[0] for b in curr.beams]
# ---------- end python_3 ----------
joiningerrors = CTShowJoiningErrors(DebugInfo=assembly_3.DebugInfo, i=Slider(1, range=0..2))  # -> Info, Geometry
#   port DebugInfo: DebugInformation object containing joining errors.
# ---------- joiningerrors: Python ----------
# flake8: noqa
from compas.scene import SceneObject

from Grasshopper.Kernel.GH_RuntimeMessageLevel import Warning
from ghpythonlib.componentbase import executingcomponent as component


class ShowJoiningErrors(component):
    def RunScript(self, debug_info, index):
        if index is None:
            self.AddRuntimeMessage(Warning, "Input parameter 'i' failed to collect data")
            return
        if not debug_info:
            self.AddRuntimeMessage(Warning, "Input parameter 'DebugInfo' failed to collect data")
            return
        if not debug_info.joint_errors:
            self.AddRuntimeMessage(Warning, "No joining errors found in input parameter 'DebugInfo'")
            return
        joining_errors = debug_info.joint_errors
        index = int(index) % len(joining_errors)
        error = joining_errors[index]

        geometries = [beam.blank for beam in error.beams]
        geometries.extend(error.debug_geometries)
        geo_objs = [SceneObject(geo) for geo in geometries]
        output = []
        for obj in geo_objs:
            output.extend(obj.draw())

        return "{} - {}".format(error.joint, error.debug_info), output
# ---------- end joiningerrors ----------
bakewithboxmap = CTBakeWithBoxMap(Assembly=assembly_3.Assembly, Bake=Button())  # inputs MapSize: list, Bake: Boolean
#   port Assembly: Assembly object (optional).
# ---------- bakewithboxmap: Python ----------
# flake8: noqa
import math
import random

from Rhino import Render
from Rhino.Geometry import Plane
from Rhino.Geometry import Interval
from Rhino.RhinoDoc import ActiveDoc
from Grasshopper.Kernel.GH_RuntimeMessageLevel import Warning
from Grasshopper.Kernel.GH_RuntimeMessageLevel import Error
from ghpythonlib.componentbase import executingcomponent as component
import rhinoscriptsyntax as rs

from compas_rhino.conversions import frame_to_rhino
from compas_timber.consumers import BrepGeometryConsumer


class BakeBoxMap(component):
    def RunScript(self, Assembly, MapSize, Bake):
        if MapSize and len(MapSize) != 3:
            self.AddRuntimeMessage(
                Error, "Input parameter MapSize requires exactly three float values (scale factors in x,y,z directions)"
            )
            return

        if MapSize:
            dimx, dimy, dimz = MapSize
        else:
            # for the pine 251 material bitmap, rotated
            dimx = 0.2
            dimy = 0.2
            dimz = 1.0

        if not Assembly:
            self.AddRuntimeMessage(Warning, "Input parameters Assembly failed to collect any Beam objects.")
            return

        if not Bake:
            return

        try:
            geometries = BrepGeometryConsumer(Assembly).result

            frames = [frame_to_rhino(b.frame) for b in Assembly.beams]
            breps = [g.geometry.native_brep for g in geometries]

            if frames and breps:
                rs.EnableRedraw(False)

                for brep, frame in zip(breps, frames):
                    guid = ActiveDoc.Objects.Add(brep)
                    boxmap = self.create_box_map(frame, dimx, dimy, dimz)
                    ActiveDoc.Objects.ModifyTextureMapping(guid, 1, boxmap)
        finally:
            rs.EnableRedraw(True)

    @staticmethod
    def create_box_map(pln, sx, sy, sz):
        """
        pln: frame of beam box, where x=main axis, y=width, z=height
        sx,sy,sz: box map size in x,y,z direction
        """

        v = pln.YAxis
        w = pln.ZAxis
        pt = pln.Origin

        # random deviation
        a = math.pi * 0.5
        randangle = (random.random() - 0.5) * a
        v.Rotate(randangle, pln.XAxis)

        b = math.pi * 0.01
        randangle = (random.random() - 0.5) * b
        w.Rotate(randangle, pln.XAxis)

        randpos = sx * random.random()
        pt += pln.XAxis * randpos

        # create box mapping
        mappingPln = Plane(pt, w, v)
        dx = Interval(-sx * 0.5, sx * 0.5)
        dy = Interval(-sy * 0.5, sy * 0.5)
        dz = Interval(-sz * 0.5, sz * 0.5)

        BoxMap = Render.TextureMapping.CreateBoxMapping(mappingPln, dx, dy, dz, False)

        return BoxMap
# ---------- end bakewithboxmap ----------
showjointtypes = CTShowJointTypes(Assembly=assembly_2.Assembly)
#   port Assembly: Assembly object.
# ---------- showjointtypes: Python ----------
# flake8: noqa
import System
from compas_rhino.conversions import point_to_rhino
from ghpythonlib.componentbase import executingcomponent as component

from compas_timber.utils.compas_extra import intersection_line_line_3D


class ShowJointTypes(component):
    def RunScript(self, Assembly):
        self.pt = []
        self.txt = []

        if not Assembly:
            return

        for joint in Assembly.joints:
            line_a, line_b = joint.beams[0].centerline, joint.beams[1].centerline
            [p1, t1], [p2, t2] = intersection_line_line_3D(line_a, line_b, float("inf"), False, 1e-3)
            p1 = point_to_rhino(p1)
            p2 = point_to_rhino(p2)

            self.pt.append((p2 + p1) / 2)
            self.txt.append(joint.joint_type)

    def DrawViewportWires(self, arg):
        if self.Locked:
            return
        col = System.Drawing.Color.FromArgb(255, 0, 0, 0)
        # https://developer.rhino3d.com/api/RhinoCommon/html/M_Rhino_Display_DisplayPipeline_Draw2dText_5.htm
        for p, t in zip(self.pt, self.txt):
            arg.Display.Draw2dText(t, col, p, True, 12, "Verdana")
# ---------- end showjointtypes ----------
showtopo = CTShowTopologyTypes()
#   port Assembly: Assembly object.
# ---------- showtopo: Python ----------
# flake8: noqa
import System
from compas_rhino.conversions import point_to_rhino
from ghpythonlib.componentbase import executingcomponent as component
from compas_timber.connections import JointTopology
from compas_timber.utils.compas_extra import intersection_line_line_3D


class ShowTopologyTypes(component):
    def RunScript(self, Assembly):
        self.pt = []
        self.txt = []

        if not Assembly:
            return
        for topo in Assembly.topologies:
            beam_a = topo["beam_a"]
            beam_b = topo["beam_b"]
            topology = topo.get("detected_topo")

            [p1, _], [p2, _] = intersection_line_line_3D(
                beam_a.centerline, beam_b.centerline, float("inf"), False, 1e-3
            )
            p1 = point_to_rhino(p1)
            p2 = point_to_rhino(p2)
            self.pt.append((p2 + p1) / 2)
            self.txt.append(JointTopology.get_name(topology))

    def DrawViewportWires(self, arg):
        if self.Locked:
            return
        col = System.Drawing.Color.FromArgb(0, 0, 255, 0)
        # https://developer.rhino3d.com/api/RhinoCommon/html/M_Rhino_Display_DisplayPipeline_Draw2dText_5.htm
        for p, t in zip(self.pt, self.txt):
            arg.Display.Draw2dText(t, col, p, True, 12, "Verdana")
# ---------- end showtopo ----------
showjointtypes_2 = CTShowJointTypes(Assembly=assembly_3.Assembly)  # same code as showjointtypes
geo_6 = Geometry([<brep referenced from the Rhino model> x8])
Z_3 = UnitZ(Factor=series)
panel_2 = Panel(joiningerrors.Info)
bakewithboxmap_2 = CTBakeWithBoxMap(Assembly=assembly_4.Assembly, Bake=Button())  # inputs MapSize: list, Bake: Boolean; same code as bakewithboxmap
showjointtypes_3 = CTShowJointTypes(Assembly=assembly_4.Assembly)  # same code as showjointtypes
showtopo_2 = CTShowTopologyTypes(Assembly=assembly_4.Assembly)  # same code as showtopo
showbeamface_2 = CTShowBeamFaceIndices(Assembly=assembly_3.Assembly)  # same code as showbeamface
move = Move(Geometry=graft(geo_6), Motion=Z_3)  # -> Geometry, Transform

# ----
# referenced curves
# referenced curve objects
panel_3 = Panel("top/bottom")
crv_8 = Curve([<curve referenced from the Rhino model> x4])
# internalized curves
crv_9 = Curve([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])
id_2 = Guid([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])
crv_10 = Curve([<curve referenced from the Rhino model> x4])
jointsbytopo_3 = CTTopologicalJointRules()  # -> Rules; same code as jointsbytopo

beam_11 = CTBeam(Centerline=crv_9, Width=0.1, Height=0.1, Category=panel_3)  # -> Beam, Blank; inputs Centerline: list, ZVector: list of Vector3d, Width: list, Height: list, Category: list, updateRefObj: Boolean; same code as beam_8
beam_12 = CTBeam(Centerline=id, Width=0.1, Height=0.1, Category="middle")  # -> Beam, Blank; inputs Centerline: list, ZVector: list of Vector3d, Width: list, Height: list, Category: list, updateRefObj: Boolean; same code as beam_8
beam_13 = CTBeam(Centerline=crv_8, Width=0.1, Height=0.1, Category=panel_3)  # -> Beam, Blank; inputs Centerline: list, ZVector: list of Vector3d, Width: list, Height: list, Category: list, updateRefObj: Boolean; same code as beam_8

relay_2 = Relay([beam_13.Beam, beam_12.Beam, beam_11.Beam])
findbeambyrhinoguid = CTFindBeamByRhinoGuid(Beams=relay_2, Guid=id_2)  # -> FoundBeam; inputs Beams: list, Guid: list of Guid
#   port Beams: A list of Beams.
# ---------- findbeambyrhinoguid: Python ----------
from ghpythonlib.componentbase import executingcomponent as component
from Grasshopper.Kernel.GH_RuntimeMessageLevel import Warning


class FindBeamByRhinoGuid(component):
    def RunScript(self, Beams, Guid):
        if not (Beams and Guid):
            return

        if not isinstance(Guid, list):
            Guid = [Guid]
        Guid = [str(g) for g in Guid]
        FoundBeam = []
        for beam in Beams:
            if beam.attributes.get("rhino_guid", None) in Guid:
                FoundBeam.append(beam)

        if not FoundBeam:
            self.AddRuntimeMessage(Warning, "No beams found!")

        return FoundBeam
# ---------- end findbeambyrhinoguid ----------
# Drill holes
drill_hole = CTDrillHoleFeature(Beam=findbeambyrhinoguid, Line=crv_10, Diameter="0.01", Length="1")  # -> Feature; inputs Beam: list, Line: Line
#   port Beam: Beam(s) to subtract Geometry from.
# ---------- drill_hole: Python ----------
from ghpythonlib.componentbase import executingcomponent as component
from Grasshopper.Kernel.GH_RuntimeMessageLevel import Warning

from compas_rhino.conversions import line_to_compas

from compas_timber.ghpython import FeatureDefinition
from compas_timber.parts import DrillFeature


class DrillHoleFeature(component):
    def RunScript(self, beam, line, diameter, length):
        if not beam:
            self.AddRuntimeMessage(Warning, "Input parameter Beams failed to collect data")
        if not line:
            self.AddRuntimeMessage(Warning, "Input parameter Line failed to collect data")
        if not diameter:
            self.AddRuntimeMessage(Warning, "Input parameter Diameter failed to collect data")
        if not length:
            self.AddRuntimeMessage(Warning, "Input parameter Length failed to collect data")

        if not (beam and line and diameter and length):
            return

        if not isinstance(beam, list):
            beam = [beam]

        f = DrillFeature(line_to_compas(line), diameter, length)
        return FeatureDefinition(f, beam)
# ---------- end drill_hole ----------
assembly_5 = CTAssembly(Beams=relay_2, JointRules=flatten(jointsbytopo_3), Features=drill_hole, MaxDistance="0.15", CreateGeometry=Toggle(True))  # -> Assembly, Geometry, DebugInfo; inputs Beams: list, JointRules: list, Features: list, CreateGeometry: Boolean; same code as assembly_2
showjointtypes_4 = CTShowJointTypes(Assembly=assembly_5.Assembly)  # same code as showjointtypes
featureerrors = CTShowFeatureErrors(DebugInfo=assembly_5.DebugInfo, i=Slider(3, range=0..10))  # -> Info, Geometry
#   port DebugInfo: DebugInformation object containing feature errors.
# ---------- featureerrors: Python ----------
# flake8: noqa
from compas.scene import SceneObject

from Grasshopper.Kernel.GH_RuntimeMessageLevel import Warning
from ghpythonlib.componentbase import executingcomponent as component


class ShowFeatureErrors(component):
    def RunScript(self, debug_info, index):
        if index is None:
            self.AddRuntimeMessage(Warning, "Input parameter 'i' failed to collect data")
            return
        if not debug_info:
            self.AddRuntimeMessage(Warning, "Input parameter 'DebugInfo' failed to collect data")
            return
        if not debug_info.feature_errors:
            self.AddRuntimeMessage(Warning, "No feature errors found in input parameter 'DebugInfo'")
            return
        feature_errors = debug_info.feature_errors
        index = int(index) % len(feature_errors)
        error = feature_errors[index]

        geometries = [error.feature_geometry, error.beam_geometry]
        geo_objs = [SceneObject(geo) for geo in geometries]
        output = []
        for obj in geo_objs:
            output.extend(obj.draw())

        return error.message, output
# ---------- end featureerrors ----------

# ----
# Joint Application By Topology
number_slider_3 = Slider(0.5, range=0..1)

l_half_lap_2 = CTLHalfLapJointOptions(FlipLapSide=Toggle(True))  # -> L_Half_Lap; inputs FlipLapSide: Boolean; same code as l_half_lap

jointsbytopo_4 = CTTopologicalJointRules(L=l_half_lap_2)  # -> Joints
#   port L: Joint type to be applied to L topology. Default type is L-Miter. If L-Butt, the beam with a larger cross section area will be used as crossing beam.
# ---------- jointsbytopo_4: Python ----------
from ghpythonlib.componentbase import executingcomponent as component
from Grasshopper.Kernel.GH_RuntimeMessageLevel import Warning

from compas_timber.connections import JointTopology
from compas_timber.ghpython import TopologyRule

from compas_timber.connections import LMiterJoint
from compas_timber.connections import TButtJoint
from compas_timber.connections import XHalfLapJoint


class MyComponent(component):
    def RunScript(self, L, T, X):
        topoRules = []




        if L:
            if not L.type.SUPPORTED_TOPOLOGY == JointTopology.TOPO_L:
                self.AddRuntimeMessage(Warning, "Joint type does not match topology. Joint may not be generated.")
            topoRules.append(TopologyRule(JointTopology.TOPO_L, L.type, **L.kwargs))
        else:
            topoRules.append(TopologyRule(JointTopology.TOPO_L, LMiterJoint))
        if T:
            if not T.type.SUPPORTED_TOPOLOGY == JointTopology.TOPO_T:
                self.AddRuntimeMessage(Warning, "Joint type does not match topology. Joint may not be generated.")
            topoRules.append(TopologyRule(JointTopology.TOPO_T, T.type, **T.kwargs))
        else:
            topoRules.append(TopologyRule(JointTopology.TOPO_T, TButtJoint))
        if X:
            if not X.type.SUPPORTED_TOPOLOGY == JointTopology.TOPO_X:
                self.AddRuntimeMessage(Warning, "Joint type does not match topology. Joint may not be generated.")
            topoRules.append(TopologyRule(JointTopology.TOPO_X, X.type, **X.kwargs))
        else:
            topoRules.append(TopologyRule(JointTopology.TOPO_X, XHalfLapJoint))

        return topoRules
# ---------- end jointsbytopo_4 ----------

relay_3 = Relay([jointsbytopo_4, jointsbycategory_3, directjoints_2])
assembly_6 = CTAssembly(Beams=relay, JointRules=flatten(relay_3), MaxDistance=Slider(0.5, range=0..1), CreateGeometry=Toggle(True))  # -> Assembly, Geometry, DebugInfo; inputs Beams: list, JointRules: list, Features: list, CreateGeometry: Boolean
#   port Beams: Collection of Beams
# ---------- assembly_6: Python ----------
from compas.scene import Scene
from ghpythonlib.componentbase import executingcomponent as component
from Grasshopper.Kernel.GH_RuntimeMessageLevel import Warning

from compas_timber.assembly import TimberAssembly
from compas_timber.consumers import BrepGeometryConsumer
from compas_timber.connections import ConnectionSolver
from compas_timber.connections import JointTopology
from compas_timber.connections import BeamJoinningError
from compas_timber.ghpython import JointDefinition
from compas_timber.ghpython import CategoryRule
from compas_timber.ghpython import TopologyRule
from compas_timber.ghpython import DirectRule
from compas_timber.ghpython import DebugInfomation


class Assembly(component):
    def __init__(self):
        # maintains relationship of old_beam.id => new_beam_obj for referencing
        # lets us modify copies of the beams while referencing them using their old identities.
        self._beam_map = {}

    def _get_copied_beams(self, old_beams):
        """For the given old_beams returns their respective copies."""
        new_beams = []
        for beam in old_beams:
            new_beams.append(self._beam_map[id(beam)])
        return new_beams

    def get_joints_from_rules(self, beams, rules, topologies):
        if not isinstance(rules, list):
            rules = [rules]
        rules = [r for r in rules if r is not None]

        joints = []
        # rules have to be resolved into joint definitions
        topo_rules = {}
        cat_rules = []
        direct_rules = []

        for r in rules:  # separate category and topo and direct joint rules
            if isinstance(r, TopologyRule):
                topo_rules[r.topology_type] = r
            elif isinstance(r, CategoryRule):
                cat_rules.append(r)
            if isinstance(r, DirectRule):
                direct_rules.append(r)

        for topo in topologies:
            beam_a = topo["beam_a"]
            beam_b = topo["beam_b"]
            detected_topo = topo["detected_topo"]
            pair = beam_a, beam_b
            pair_joined = False

            if detected_topo == JointTopology.TOPO_UNKNOWN:
                continue

            for rule in direct_rules:  # apply direct rules first
                if rule.comply(pair):
                    joints.append(JointDefinition(rule.joint_type, [beam_a, beam_b], **rule.kwargs))
                    pair_joined = True
                    break

            if not pair_joined:  # if no direct rule applies, apply category rules next
                for rule in cat_rules:
                    if not rule.comply(pair):
                        continue
                    if rule.joint_type.SUPPORTED_TOPOLOGY != detected_topo:
                        msg = "Conflict detected! Beams: {}, {} meet with topology: {} but rule assigns: {}"
                        self.AddRuntimeMessage(
                            Warning,
                            msg.format(
                                beam_a.key, beam_b.key, JointTopology.get_name(detected_topo), rule.joint_type.__name__
                            ),
                        )
                        continue
                    # sort by category to allow beam role by order (main beam first, cross beam second)
                    beam_a, beam_b = rule.reorder([beam_a, beam_b])
                    joints.append(JointDefinition(rule.joint_type, [beam_a, beam_b], **rule.kwargs))
                    break  # first matching rule

                else:  # no category rule applies, apply topology rules
                    if detected_topo not in topo_rules:
                        continue
                    else:
                        joints.append(
                            JointDefinition(
                                topo_rules[detected_topo].joint_type,
                                [beam_a, beam_b],
                                **topo_rules[detected_topo].kwargs
                            )
                        )
        return joints

    def RunScript(self, Beams, JointRules, Features, MaxDistance, CreateGeometry):
        if not Beams:
            self.AddRuntimeMessage(Warning, "Input parameter Beams failed to collect data")
        if not JointRules:
            self.AddRuntimeMessage(Warning, "Input parameter JointRules failed to collect data")
        if not (Beams):  # shows beams even if no joints are found
            return

        Assembly = TimberAssembly()
        debug_info = DebugInfomation()

        topologies = []
        solver = ConnectionSolver()
        found_pairs = solver.find_intersecting_pairs(Beams, rtree=True, max_distance=MaxDistance)
        for pair in found_pairs:
            beam_a, beam_b = pair
            detected_topo, beam_a, beam_b = solver.find_topology(beam_a, beam_b, max_distance=MaxDistance)
            if not detected_topo == JointTopology.TOPO_UNKNOWN:
                topologies.append({"detected_topo": detected_topo, "beam_a": beam_a, "beam_b": beam_b})
        Assembly.set_topologies(topologies)

        self._beam_map = {}
        beams = [b for b in Beams if b is not None]
        for beam in beams:
            c_beam = beam.copy()
            Assembly.add_beam(c_beam)
            self._beam_map[id(beam)] = c_beam
        beams = Assembly.beams

        joints = self.get_joints_from_rules(beams, JointRules, topologies)

        if joints:
            handled_beams = []
            joints = [j for j in joints if j is not None]
            # apply reversed. later joints in orginal list override ealier ones
            for joint in joints[::-1]:
                beams_to_pair = self._get_copied_beams(joint.beams)
                beam_pair_ids = set([id(beam) for beam in beams_to_pair])
                if beam_pair_ids in handled_beams:
                    continue
                try:
                    joint.joint_type.create(Assembly, *beams_to_pair, **joint.kwargs)
                except BeamJoinningError as bje:
                    debug_info.add_joint_error(bje)
                else:
                    handled_beams.append(beam_pair_ids)

        if Features:
            features = [f for f in Features if f is not None]
            for f_def in features:
                beams_to_modify = self._get_copied_beams(f_def.beams)
                for beam in beams_to_modify:
                    beam.add_features(f_def.feature)

        Geometry = None
        scene = Scene()
        
        vis_consumer = BrepGeometryConsumer(Assembly)
        
        if CreateGeometry:
            for result in vis_consumer.result:
                scene.add(result.geometry)
                if result.debug_info:
                    debug_info.add_feature_error(result.debug_info)
        else:
            for beam in Assembly.beams:
                scene.add(beam.blank)

        if debug_info.has_errors:
            self.AddRuntimeMessage(Warning, "Error found during joint creation. See DebugInfo output for details.")

        Geometry = scene.draw()
        return Assembly, Geometry, debug_info
# ---------- end assembly_6 ----------
showtopo_3 = CTShowTopologyTypes(Assembly=assembly_6.Assembly)  # same code as showtopo
showjointtypes_5 = CTShowJointTypes(Assembly=assembly_6.Assembly)  # same code as showjointtypes
