# Grasshopper definition SB_Demo.gh (Grasshopper 1.0.7)

jointoverride = CTSurfaceAssemblyJointOverride()  # -> LHalfLapJoint_edge_stud_plate
#   port flip_lap_side: flip_lap_side
#   port cut_plane_bias: cut_plane_bias
#   port LHalfLapJoint_edge_stud_plate: LHalfLapJoint edge_stud plate
# ---------- jointoverride: Python ----------
from ghpythonlib.componentbase import executingcomponent as component
from Grasshopper.Kernel.GH_RuntimeMessageLevel import Warning
import clr
import System
import inspect
from System.Windows.Forms import ToolStripSeparator
from System.Windows.Forms import ToolStripMenuItem
from collections import OrderedDict

from compas_timber.connections import Joint
from compas_timber.ghpython.ghcomponent_helpers import manage_dynamic_params
from compas_timber.ghpython.ghcomponent_helpers import get_leaf_subclasses
from compas_timber.ghpython.ghcomponent_helpers import rename_GH_output
from compas_timber.ghpython import CategoryRule
from compas_timber.assembly import SurfaceAssembly


class CategoryJointRule(component):
    def __init__(self):
        super(CategoryJointRule, self).__init__()
        self.cat_a = None
        self.cat_b = None
        self.classes = {}
        for cls in get_leaf_subclasses(Joint):
            self.classes[cls.__name__] = cls

        if ghenv.Component.Params.Output[0].NickName == "Rule":
            self.joint_type = None
        else:
            parsed_output = ghenv.Component.Params.Output[0].NickName.split(" ")
            self.joint_type = self.classes.get(parsed_output[0])
            if len(parsed_output) > 1:
                self.cat_a = parsed_output[1]
            if len(parsed_output) > 2:
                self.cat_b = parsed_output[2]


    def RunScript(self, *args):
        if not self.joint_type:
            ghenv.Component.Message = "Select joint type from context menu (right click)"
            self.AddRuntimeMessage(Warning, "Select joint type from context menu (right click)")
            return None
        else:
            ghenv.Component.Message = self.joint_type.__name__

            kwargs = {}
            for i, val in enumerate(args):
                if val:
                    kwargs[self.arg_names()[i + 2]] = val

            return CategoryRule(self.joint_type, self.cat_a, self.cat_b, **kwargs)

    def arg_names(self):
        names = inspect.getargspec(self.joint_type.__init__)[0][1:]
        for i in range(2):
            names[i] += " category"
        return [name for name in names if (name != "key") and (name != "frame")]

    def AppendAdditionalMenuItems(self, menu):
        for name in self.classes.keys():
            item = menu.Items.Add(name, None, self.on_item_click)
            if self.joint_type and name == self.joint_type.__name__:
                item.Checked = True
        if self.joint_type:
            menu.Items.Add(ToolStripSeparator())
            beam_a_menu = ToolStripMenuItem(self.arg_names()[0])
            menu.Items.Add(beam_a_menu)
            for name in SurfaceAssembly.beam_category_names():
                item = ToolStripMenuItem(name, None, self.on_beam_a_click)
                if name == self.cat_a:
                    item.Checked = True
                beam_a_menu.DropDownItems.Add(item)
            beam_b_menu = ToolStripMenuItem(self.arg_names()[1])
            menu.Items.Add(beam_b_menu)
            for name in SurfaceAssembly.beam_category_names():
                item = ToolStripMenuItem(name, None, self.on_beam_b_click)
                if name == self.cat_b:
                    item.Checked = True
                beam_b_menu.DropDownItems.Add(item)

    def output_name(self):
        name = self.joint_type.__name__
        if self.cat_a:
            name += " {}".format(self.cat_a)
        if self.cat_b:
            name += " {}".format(self.cat_b)
        return name

    def on_beam_a_click(self, sender, event_info):
        self.cat_a = sender.Text
        rename_GH_output(self.output_name(), 0, ghenv)
        ghenv.Component.ExpireSolution(True)

    def on_beam_b_click(self, sender, event_info):
        self.cat_b = sender.Text
        rename_GH_output(self.output_name(), 0, ghenv)
        ghenv.Component.ExpireSolution(True)

    def on_item_click(self, sender, event_info):
        self.joint_type = self.classes[str(sender)]
        rename_GH_output(self.output_name(), 0, ghenv)
        manage_dynamic_params(self.arg_names()[2:], ghenv, rename_count=0, permanent_param_count=0)
        ghenv.Component.ExpireSolution(True)
# ---------- end jointoverride ----------
jointoverride_2 = CTSurfaceAssemblyJointOverride()  # -> LMiterJoint_edge_stud_plate; same code as jointoverride
toggle = BooleanToggle(True)
geo = Geometry(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)
geo_2 = Geometry(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)
customdimensions = CTCustomBeamDimensions(width=Slider(200, range=0..1000))  # -> header
#   port width: Width dimension of beams of the selected type.
# ---------- customdimensions: Python ----------
from ghpythonlib.componentbase import executingcomponent as component
import clr
import System
from compas_timber.assembly import SurfaceAssembly

beam_category_names = SurfaceAssembly.beam_category_names()


def on_item_click(sender, event_info):
    ghenv.Component.Params.Output[0].NickName = str(sender)
    ghenv.Component.Params.OnParametersChanged()
    ghenv.Component.ExpireSolution(True)


class CustomBeamDimensions(component):
    def RunScript(self, width, height):
        dims = {}
        if ghenv.Component.Params.Output[0].NickName != "Dimensions":
            dims[ghenv.Component.Params.Output[0].NickName] = (width or 0, height or 0)
        return (dims,)  # return a tuple to allow passing dict between components

    def AppendAdditionalMenuItems(self, menu):
        for name in beam_category_names:
            item = menu.Items.Add(name, None, on_item_click)
            if name == ghenv.Component.Params.Output[0].NickName:
                item.Checked = True
# ---------- end customdimensions ----------
geo_3 = Geometry(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)
geo_4 = Geometry(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)
surfaceassemblyoptions = CTSurfaceAssemblyOptions(joint_override=jointoverride_2)  # -> Options; inputs lintel_posts: Boolean, custom_dimensions: list, joint_override: list, subtraction_volumes: list of Brep
#   port sheeting_outside: (optional) Thickness of sheeting on the side of assembly closest to input surface. If zero, no sheeting will be added.
# ---------- surfaceassemblyoptions: Python ----------
from ghpythonlib.componentbase import executingcomponent as component


class SurfaceAssemblyOptions(component):

    def RunScript(self, sheeting_outside, sheeting_inside, lintel_posts, edge_stud_offset, mill_depth, custom_dimensions, joint_overrides, subtraction_volumes):

        if sheeting_outside is not None and not isinstance(sheeting_outside, float):
            raise TypeError("sheeting_outside expected a float, got: {}".format(type(sheeting_outside)))
        if sheeting_inside is not None and not isinstance(sheeting_inside, float):
            raise TypeError("sheeting_inside expected a float, got: {}".format(type(sheeting_inside)))
        if lintel_posts is not None and not isinstance(lintel_posts, bool):
            raise TypeError("lintel_posts expected a bool, got: {}".format(type(lintel_posts)))

        dims = {}
        for item in custom_dimensions:
            for key, val in item.items():
                dims[key] = val

        dict = {
            "sheeting_outside": sheeting_outside,
            "sheeting_inside": sheeting_inside,
            "lintel_posts": lintel_posts,
            "edge_stud_offset": edge_stud_offset,
            "mill_depth": mill_depth,
            "custom_dimensions": dims,
            "joint_overrides": joint_overrides,
            "subtraction_volumes": subtraction_volumes
        }

        return (dict,)
# ---------- end surfaceassemblyoptions ----------
surfaceassemblyoptions_2 = CTSurfaceAssemblyOptions(custom_dimensions=customdimensions, joint_override=jointoverride)  # -> Options; inputs lintel_posts: Boolean, custom_dimensions: list, joint_override: list, subtraction_volumes: list of Brep; same code as surfaceassemblyoptions
surfaceassembly = CTSurfaceAssembly(surface=geo, options=surfaceassemblyoptions, CreateGeometry=toggle)  # -> Assembly, Geometry, debug; inputs surface: Brep, stud_direction: Vector3d, openings: list of Curve, CreateGeometry: Boolean
#   port surface: Referenced planar surface from which to generate beams and joint rules.
# ---------- surfaceassembly: Python ----------
from compas_timber.ghpython.workflow import CategoryRule
from ghpythonlib.componentbase import executingcomponent as component
from Grasshopper.Kernel.GH_RuntimeMessageLevel import Warning
from scriptcontext import sticky
from Rhino.Geometry import Brep as RhinoBrep
from Rhino.Geometry import Vector3d as RhinoVector

from compas.scene import Scene
from compas.geometry import Brep
from compas_timber.assembly import SurfaceAssembly
from compas_timber.ghpython import DebugInfomation
from compas_timber.consumers import BrepGeometryConsumer


class SurfaceAssemblyComponent(component):
    def RunScript(self, surface, stud_spacing, beam_width, frame_depth, z_axis, openings, options, CreateGeometry=False):
        # minimum inputs required
        if not surface:
            return

        if not isinstance(surface, RhinoBrep):
            raise TypeError("Expected a compas.geometry.Surface, got: {}".format(type(surface)))

        if not stud_spacing:
            vals =  sticky.get("surface_assembly_defaults", None)
            if vals:
                stud_spacing = vals.get("stud_spacing", None)
            if not stud_spacing:
                self.AddRuntimeMessage(Warning, "stud_spacing failed to collect data")
        if not isinstance(stud_spacing, float):
            raise TypeError("stud_spacing expected a float, got: {}".format(type(stud_spacing)))

        if not beam_width:
            vals =  sticky.get("surface_assembly_defaults", None)
            if vals:
                beam_width = vals.get("beam_width", None)
            if not beam_width:
                self.AddRuntimeMessage(Warning, "beam_width failed to collect data")
        if not isinstance(beam_width, float):
            raise TypeError("beam_width expected a float, got: {}".format(type(beam_width)))

        if not frame_depth:
            vals =  sticky.get("surface_assembly_defaults", None)
            if vals:
                frame_depth = vals.get("frame_depth", None)
            if not frame_depth:
                self.AddRuntimeMessage(Warning, "frame_depth failed to collect data")
        if not isinstance(frame_depth, float):
            raise TypeError("frame_depth expected a float, got: {}".format(type(frame_depth)))

        # reformat unset parameters for consistency
        if not z_axis:
            z_axis = None
        default_vals =  sticky.get("surface_assembly_defaults", None).copy()
        default_options = default_vals.get("options", {})


        if default_options:
            if not options:
                options = default_options
            else:
                for key, value in default_options.items():
                    if options.get(key, None) is None:
                        options[key] = value
                    elif isinstance(value, dict):
                        for k, v in value.items():
                            if options[key].get(k) is None:
                                options[key][k] = v
                    elif isinstance(value, list):
                        for v in value:
                            if isinstance(v, CategoryRule):
                                sets = [set([rule.category_a, rule.category_b]) for rule in options[key]]
                                if set([v.category_a, v.category_b]) not in sets:
                                    options[key].append(v)

        print(options)

        assembly = SurfaceAssembly(Brep.from_native(surface), stud_spacing, beam_width, frame_depth, z_axis, openings = openings, **options)

        debug_info = DebugInfomation()
        Geometry = None
        scene = Scene()
        if CreateGeometry:
            vis_consumer = BrepGeometryConsumer(assembly.assembly)
            for result in vis_consumer.result:
                scene.add(result.geometry)
                if result.debug_info:
                    debug_info._has_errors = False
                    for error in result.debug_info:
                        if error.message != "The volume does not intersect with beam geometry.":
                            debug_info.add_feature_error(result.debug_info)
                            debug_info._has_errors = True
        else:
            for beam in assembly.beams:
                scene.add(beam.blank)

        if debug_info.has_errors:
            self.AddRuntimeMessage(Warning, "Error found during joint creation. See DebugInfo output for details.")

        Geometry = scene.draw()

        return assembly.assembly, Geometry, debug_info
# ---------- end surfaceassembly ----------
surfaceassembly_2 = CTSurfaceAssembly(surface=geo_2, CreateGeometry=toggle)  # -> Assembly, Geometry, debug; inputs surface: Brep, stud_direction: Vector3d, openings: list of Curve, CreateGeometry: Boolean; same code as surfaceassembly
surfaceassembly_3 = CTSurfaceAssembly(surface=geo_3, CreateGeometry=toggle)  # -> Assembly, Geometry, debug; inputs surface: Brep, stud_direction: Vector3d, openings: list of Curve, CreateGeometry: Boolean; same code as surfaceassembly
surfaceassembly_4 = CTSurfaceAssembly(surface=geo_4, stud_spacing=Slider(1250, range=0..10000), CreateGeometry=toggle)  # -> Assembly, Geometry, debug; inputs surface: Brep, stud_direction: Vector3d, openings: list of Curve, CreateGeometry: Boolean; same code as surfaceassembly
surfaceassemblydefaults = CTSurfaceAssemblyDefaults(options=surfaceassemblyoptions_2)  # inputs stud_direction: Vector3d
#   port stud_spacing: spacing between studs.
#   port beam_width: Width of the cross-section.
#   port frame_depth: thickness of the frame section of the resulting assembly. used to set Beam.height
#   port stud_direction: (optional) Vector defining the direction of stud in the assembly. Default is world-Z
#   port options: (optional) SurfaceAssembly options.
# ---------- surfaceassemblydefaults: Python ----------
"""Creates a Beam from a LineCurve."""

from ghpythonlib.componentbase import executingcomponent as component
from Grasshopper.Kernel.GH_RuntimeMessageLevel import Warning
from scriptcontext import sticky

from Rhino.Geometry import Vector3d as RhinoVector



class SurfaceAssemblyDefaultsComponent(component):
    def RunScript(self, stud_spacing, beam_width, frame_depth, z_axis, options):
        if not stud_spacing:
            stud_spacing = 625.0
            self.AddRuntimeMessage(Warning, "default stud spacing 625.0 used")
        if not beam_width:
            beam_width = 60.0
            self.AddRuntimeMessage(Warning, "default beam_width 60.0 used")
        if not frame_depth:
            frame_depth = 200.0
            self.AddRuntimeMessage(Warning, "default frame_depth 200.0 used")
        if z_axis is not None and not isinstance(z_axis, RhinoVector):
            raise TypeError("Expected a compas.geometry.Vector, got: {}".format(type(z_axis)))
        if not z_axis:
            z_axis = RhinoVector(0, 0, 1)
            self.AddRuntimeMessage(Warning, "default z_axis used")

        if not options:
            options = {}

        sticky_dict = {
        "stud_spacing": stud_spacing,
        "beam_width": beam_width,
        "frame_depth": frame_depth,
        "z_axis": z_axis,
        "options": options
        }

        sticky.Add("surface_assembly_defaults", sticky_dict)

        return
# ---------- end surfaceassemblydefaults ----------
