# Grasshopper definition SurfaceAssemblySlabDemo.gh (Grasshopper 1.0.7)
# plug-ins: Human

pipe = Pipe(Curve=<geometry referenced from the Rhino model>, Radius=2, Caps=0)
jointoverride = CTSurfaceAssemblyJointOverride(mill_depth=Slider(1, range=0..10))  # -> TButtJoint_king_stud_header
# ---------- jointoverride: Python ----------
from ghpythonlib.componentbase import executingcomponent as component
from Grasshopper.Kernel.GH_RuntimeMessageLevel import Warning
import clr
import System
import inspect
from System.Windows.Forms import ToolStripSeparator
from System.Windows.Forms import ToolStripMenuItem
from collections import OrderedDict

from compas_timber.connections import Joint
from compas_timber.ghpython.ghcomponent_helpers import manage_dynamic_params
from compas_timber.ghpython.ghcomponent_helpers import get_leaf_subclasses
from compas_timber.ghpython.ghcomponent_helpers import rename_GH_output
from compas_timber.ghpython import CategoryRule
from compas_timber.assembly import SurfaceAssembly


class CategoryJointRule(component):
    def __init__(self):
        super(CategoryJointRule, self).__init__()
        self.cat_a = None
        self.cat_b = None
        self.classes = {}
        for cls in get_leaf_subclasses(Joint):
            self.classes[cls.__name__] = cls

        if ghenv.Component.Params.Output[0].NickName == "Rule":
            self.joint_type = None
        else:
            parsed_output = ghenv.Component.Params.Output[0].NickName.split(" ")
            self.joint_type = self.classes.get(parsed_output[0])
            if len(parsed_output) > 1:
                self.cat_a = parsed_output[1]
            if len(parsed_output) > 2:
                self.cat_b = parsed_output[2]


    def RunScript(self, *args):
        if not self.joint_type:
            ghenv.Component.Message = "Select joint type from context menu (right click)"
            self.AddRuntimeMessage(Warning, "Select joint type from context menu (right click)")
            return None
        else:
            ghenv.Component.Message = self.joint_type.__name__

            kwargs = {}
            for i, val in enumerate(args):
                if val:
                    kwargs[self.arg_names()[i + 2]] = val

            return CategoryRule(self.joint_type, self.cat_a, self.cat_b, **kwargs)

    def arg_names(self):
        names = inspect.getargspec(self.joint_type.__init__)[0][1:]
        for i in range(2):
            names[i] += " category"
        return [name for name in names if (name != "key") and (name != "frame")]

    def AppendAdditionalMenuItems(self, menu):
        for name in self.classes.keys():
            item = menu.Items.Add(name, None, self.on_item_click)
            if self.joint_type and name == self.joint_type.__name__:
                item.Checked = True
        if self.joint_type:
            menu.Items.Add(ToolStripSeparator())
            beam_a_menu = ToolStripMenuItem(self.arg_names()[0])
            menu.Items.Add(beam_a_menu)
            for name in SurfaceAssembly.beam_category_names():
                item = ToolStripMenuItem(name, None, self.on_beam_a_click)
                if name == self.cat_a:
                    item.Checked = True
                beam_a_menu.DropDownItems.Add(item)
            beam_b_menu = ToolStripMenuItem(self.arg_names()[1])
            menu.Items.Add(beam_b_menu)
            for name in SurfaceAssembly.beam_category_names():
                item = ToolStripMenuItem(name, None, self.on_beam_b_click)
                if name == self.cat_b:
                    item.Checked = True
                beam_b_menu.DropDownItems.Add(item)

    def output_name(self):
        name = self.joint_type.__name__
        if self.cat_a:
            name += " {}".format(self.cat_a)
        if self.cat_b:
            name += " {}".format(self.cat_b)
        return name

    def on_beam_a_click(self, sender, event_info):
        self.cat_a = sender.Text
        rename_GH_output(self.output_name(), 0, ghenv)
        ghenv.Component.ExpireSolution(True)

    def on_beam_b_click(self, sender, event_info):
        self.cat_b = sender.Text
        rename_GH_output(self.output_name(), 0, ghenv)
        ghenv.Component.ExpireSolution(True)

    def on_item_click(self, sender, event_info):
        self.joint_type = self.classes[str(sender)]
        rename_GH_output(self.output_name(), 0, ghenv)
        manage_dynamic_params(self.arg_names()[2:], ghenv, rename_count=0, permanent_param_count=0)
        ghenv.Component.ExpireSolution(True)
# ---------- end jointoverride ----------
cap = CapHoles(Brep=pipe)
geo = Geometry(<brep referenced from the Rhino model>)
surfaceassemblyoptions = CTSurfaceAssemblyOptions(
    lintel_posts=Toggle(False),
    edge_stud_offset=Slider(1, range=0..1),
    mill_depth=Slider(0.5, range=0..2),
    joint_override=jointoverride,
    subtraction_volumes=flatten([geo, cap]))  # -> Options; inputs lintel_posts: Boolean, custom_dimensions: list, joint_override: list, subtraction_volumes: list of Brep
#   port sheeting_outside: (optional) Thickness of sheeting on the side of assembly closest to input surface. If zero, no sheeting will be added.
# ---------- surfaceassemblyoptions: Python ----------
from ghpythonlib.componentbase import executingcomponent as component


class SurfaceAssemblyOptions(component):

    def RunScript(self, sheeting_outside, sheeting_inside, lintel_posts, edge_stud_offset, mill_depth, custom_dimensions, joint_overrides, subtraction_volumes):

        if sheeting_outside is not None and not isinstance(sheeting_outside, float):
            raise TypeError("sheeting_outside expected a float, got: {}".format(type(sheeting_outside)))
        if sheeting_inside is not None and not isinstance(sheeting_inside, float):
            raise TypeError("sheeting_inside expected a float, got: {}".format(type(sheeting_inside)))
        if lintel_posts is not None and not isinstance(lintel_posts, bool):
            raise TypeError("lintel_posts expected a bool, got: {}".format(type(lintel_posts)))

        dims = {}
        for item in custom_dimensions:
            for key, val in item.items():
                dims[key] = val

        dict = {
            "sheeting_outside": sheeting_outside,
            "sheeting_inside": sheeting_inside,
            "lintel_posts": lintel_posts,
            "edge_stud_offset": edge_stud_offset,
            "mill_depth": mill_depth,
            "custom_dimensions": dims,
            "joint_overrides": joint_overrides,
            "subtraction_volumes": subtraction_volumes
        }

        return (dict,)
# ---------- end surfaceassemblyoptions ----------
geo_2 = Geometry(<brep referenced from the Rhino model>)
geo_3 = Geometry([<curve referenced from the Rhino model> x2])
surfaceassembly = CTSurfaceAssembly(
    surface=geo_2,
    stud_spacing=Slider(62.5, range=25..100),
    beam_width=Slider(6, range=0..10),
    frame_depth=Slider(20, range=0..20),
    openings=geo_3,
    options=surfaceassemblyoptions,
    CreateGeometry=Toggle(True))  # -> Assembly, Geometry, debug; inputs surface: Brep, stud_direction: Vector3d, openings: list of Curve, CreateGeometry: Boolean
#   port surface: Referenced planar surface from which to generate beams and joint rules.
#   port stud_spacing: spacing between studs.
#   port beam_width: Width of the cross-section.
#   port frame_depth: thickness of the frame section of the resulting assembly. used to set Beam.height
#   port stud_direction: (optional) Vector defining the direction of stud in the assembly. Default is world-Z
#   port options: (optional) SurfaceAssembly options.
#   port CreateGeometry: generate joint and feature geometry
#   port Assembly: compas_timber TimberAssembly object.
#   port Geometry: Assembly geometry.
# ---------- surfaceassembly: Python ----------
"""Creates a Beam from a LineCurve."""

from ghpythonlib.componentbase import executingcomponent as component
from Grasshopper.Kernel.GH_RuntimeMessageLevel import Warning

from Rhino.Geometry import Brep as RhinoBrep
from Rhino.Geometry import Vector3d as RhinoVector
from compas.scene import Scene
from compas.geometry import Brep
from compas_timber.assembly import SurfaceAssembly
from compas_timber.ghpython import DebugInfomation
from compas_timber.consumers import BrepGeometryConsumer


class SurfaceAssemblyComponent(component):
    def RunScript(self, surface, stud_spacing, beam_width, frame_depth, z_axis, openings, options, CreateGeometry=False):
        # minimum inputs required
        if not surface:
            return
        if not isinstance(surface, RhinoBrep):
            raise TypeError("Expected a compas.geometry.Surface, got: {}".format(type(surface)))
        if not stud_spacing:
            self.AddRuntimeMessage(Warning, "Input parameter 'spacing' failed to collect data")
        if not isinstance(stud_spacing, float):
            raise TypeError("stud_spacing expected a float, got: {}".format(type(stud_spacing)))
        if z_axis is not None and not isinstance(z_axis, RhinoVector):
            raise TypeError("Expected a compas.geometry.Vector, got: {}".format(type(z_axis)))

        # reformat unset parameters for consistency
        if not z_axis:
            z_axis = None
        if not options:
            options = {}
        

        assembly = SurfaceAssembly(Brep.from_native(surface), stud_spacing, beam_width, frame_depth, z_axis, openings = openings, **options)

        debug_info = DebugInfomation()
        Geometry = None
        scene = Scene()
        if CreateGeometry:
            vis_consumer = BrepGeometryConsumer(assembly.assembly)
            for result in vis_consumer.result:
                scene.add(result.geometry)
                if result.debug_info:
                    debug_info._has_errors = False
                    for error in result.debug_info:
                        if error.message != "The volume does not intersect with beam geometry.":
                            debug_info.add_feature_error(result.debug_info)
                            debug_info._has_errors = True
        else:
            for beam in assembly.beams:
                scene.add(beam.blank)

        if debug_info.has_errors:
            self.AddRuntimeMessage(Warning, "Error found during joint creation. See DebugInfo output for details.")

        Geometry = scene.draw()

        return assembly.assembly, Geometry, debug_info
# ---------- end surfaceassembly ----------
reset = Button()
python = GhPythonScript(reset=reset)  # -> out, a; inputs reset: Boolean
# ---------- python: Python ----------
__author__ = "obucklin"
__version__ = "2023.09.14"

import rhinoscriptsyntax as rs
from compas_ghpython import unload_modules

if reset:
    unload_modules("compas_timber")
# ---------- end python ----------
debrep = DeconstructBrep(Brep=surfaceassembly.Geometry)  # -> Faces, Edges, Vertices
dc = DiffuseColor(RGB(0, 0, 0))
previewmat = CustomPreviewMaterials(Geometry=surfaceassembly.Geometry, DiffuseColor=RGB(255, 255, 255))
previewlw = CustomPreviewLineweights(Geometry=debrep.Edges, Shader=dc, Absolute=False)
