# Grasshopper definition T_plate_fastener_Demo.gh (Grasshopper 1.0.7)
# plug-ins: unload_CT

geo = Geometry(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)
geo_2 = Geometry(<brep referenced from the Rhino model>)
brep_subtraction_feature = CTBrepSubtractionFeature(Geometry=geo)  # -> Feature; inputs Beam: list, Geometry: Brep
#   port Beam: Beam(s) to subtract Geometry from.
# ---------- brep_subtraction_feature: Python ----------
from compas.geometry import Brep
from ghpythonlib.componentbase import executingcomponent as component
from Grasshopper.Kernel.GH_RuntimeMessageLevel import Warning

from compas_timber.design import FeatureDefinition
from compas_timber.elements import BrepSubtraction


class BrepSubtractionFeature(component):
    def RunScript(self, beam, geometry):
        if not geometry:
            self.AddRuntimeMessage(Warning, "Input parameter Geometry failed to collect data")

        if not isinstance(beam, list):
            beam = [beam]

        feature = BrepSubtraction(Brep.from_native(geometry))
        return FeatureDefinition(feature, beam)
# ---------- end brep_subtraction_feature ----------
trim_feature = CTTrimFeature(Plane=geo_2)  # -> Feature; inputs Beam: list, Plane: Plane
#   port Beam: Beam(s) to trim.
# ---------- trim_feature: Python ----------
from compas_rhino.conversions import plane_to_compas_frame
from ghpythonlib.componentbase import executingcomponent as component
from Grasshopper.Kernel.GH_RuntimeMessageLevel import Warning

from compas_timber.design import FeatureDefinition
from compas_timber.elements import CutFeature


class TrimmingFeature(component):
    def RunScript(self, beam, plane):
        if not plane:
            self.AddRuntimeMessage(Warning, "Input parameter Plane failed to collect data")

        if not isinstance(beam, list):
            beam = [beam]

        feature = CutFeature(plane_to_compas_frame(plane))
        return FeatureDefinition(feature, beam)
# ---------- end trim_feature ----------
geo_3 = Geometry(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)
drill_points = Geometry([Point(137.5, 0, 0), Point(212.5, 0, 0), Point(287.5, 0, 0)])
drill_points_2 = Geometry([Point(0, 150, 0), Point(0, 75, 0), Point(0, 0, 0), Point(0, -75, 0), Point(0, -150, 0)])
interface = CTFastenerBeamInterface(drill_points=drill_points_2, drill_diameters=Slider(12, range=0..100), extra_shapes=geo_3)  # -> Interface, shape; inputs outline_points: Curve, thickness: Curve, drill_points: list of Point3d, drill_diameters: list, extra_shapes: list of Brep, features: list
#   port outline_points: Referenced curve or line, Guid of curve or line in the active Rhino document. Defines the outline of the plate fastener.
# ---------- interface: Python ----------
from ghpythonlib.componentbase import executingcomponent as component
from compas_timber.design import FeatureDefinition
from compas_timber.elements import FastenerTimberInterface
from compas.geometry import Brep
from compas.scene import Scene

class MyComponent(component):

    def RunScript(self, outline_points, thickness, drill_points, drill_diameters, extra_shapes, features):
        holes = []
        if drill_points and drill_diameters:
            if len(drill_points) == len(drill_diameters):
                for pt, dia in zip(drill_points, drill_diameters):
                    holes.append({"point": pt, "diameter": dia, "vector": None, "through": True})
            elif len(drill_diameters) == 1:
                for pt in drill_points:
                    holes.append({"point": pt, "diameter": drill_diameters[0], "vector": None, "through": True})

        features = [feature.feature if isinstance(feature, FeatureDefinition) else feature for feature in features]

        fast_int = FastenerTimberInterface(outline_points, thickness, holes, shapes = [Brep.from_native(brep) for brep in extra_shapes], features = features)

        shape = None
        if outline_points:
            scene = Scene()
            scene.add(fast_int.shape)
            shape = scene.draw()

        return fast_int, shape
# ---------- end interface ----------
interface_2 = CTFastenerBeamInterface(drill_points=drill_points, drill_diameters=Slider(12, range=0..100), features=[brep_subtraction_feature, trim_feature])  # -> Interface, shape; inputs outline_points: Curve, thickness: Curve, drill_points: list of Point3d, drill_diameters: list, extra_shapes: list of Brep, features: list; same code as interface
crv = Curve([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])
crv_2 = Curve(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)
geo_4 = Geometry([<curve referenced from the Rhino model> x2])
platefastener = CTPlateFastener(Outline=crv_2, Cutouts=crv, main_beam_interface=interface_2.Interface, cross_beam_interface=interface.Interface)  # -> Fastener, Shape; inputs Outline: Curve, Cutouts: list of Curve
#   port Outline: Outline of the Plate Fastener.
# ---------- platefastener: Python ----------
from ghpythonlib.componentbase import executingcomponent as component
from compas_timber.elements import PlateFastener
from compas.scene import SceneObject
from compas_rhino.conversions import curve_to_compas


class MyComponent(component):

    def RunScript(self, outline, cutouts, main_beam_interface, cross_beam_interface):
        if not outline:
            return
        outline_curve = curve_to_compas(outline)
        cutout_curves = [curve_to_compas(cutout) for cutout in cutouts]
        fastener = PlateFastener.from_outline_thickness_interfaces_cutouts(outline_curve, thickness = 4, interfaces = [main_beam_interface, cross_beam_interface], cutouts=cutout_curves)
        return fastener,  SceneObject(item=fastener.shape).draw()
# ---------- end platefastener ----------
beam = CTBeam(Centerline=geo_4, Width=Slider(100, range=0..100), Height=Slider(200, range=0..1000))  # -> Beam, Blank; inputs Centerline: list, ZVector: list of Vector3d, Width: list, Height: list, Category: list, updateRefObj: Boolean
#   port Centerline: Referenced curve or line, Guid of curve or line in the active Rhino document.
#   port ZVector: Vector defining the orientation of the cross-section (corresponds to the height dimension). If None, a default will be taken.
#   port Width: Width of the cross-section (usually the smaller dimension).
#   port Height: Height of the cross-section (usually the larger dimension).
#   port Category: Category of a beam.
#   port updateRefObj: (optional) If True, the attributes in the referenced object will be updated/overwritten with the new values given here.
#   port Beam: Beam object(s).
#   port Blank: Shape of the beam's blank.
# ---------- beam: Python ----------
"""Creates a Beam from a LineCurve."""

import rhinoscriptsyntax as rs
from compas.scene import Scene
from compas_rhino.conversions import line_to_compas
from compas_rhino.conversions import vector_to_compas
from ghpythonlib.componentbase import executingcomponent as component
from Grasshopper.Kernel.GH_RuntimeMessageLevel import Error
from Grasshopper.Kernel.GH_RuntimeMessageLevel import Warning
from Rhino.RhinoDoc import ActiveDoc

from compas_timber.elements import Beam as CTBeam
from compas_timber.ghpython.rhino_object_name_attributes import update_rhobj_attributes_name


class Beam_fromCurve(component):
    def RunScript(self, centerline, z_vector, width, height, category, updateRefObj):
        # minimum inputs required
        if not centerline:
            self.AddRuntimeMessage(Warning, "Input parameter 'Centerline' failed to collect data")
        if not width:
            length = self._get_centerline_length(centerline)
            width = [length / 20]
        if not height:
            length = self._get_centerline_length(centerline)
            height = [length / 10]

        # reformat unset parameters for consistency
        if not z_vector:
            z_vector = [None]
        if not category:
            category = [None]

        beams = []
        blanks = []
        scene = Scene()

        if centerline and height and width:
            # check list lengths for consistency
            N = len(centerline)
            if len(z_vector) not in (0, 1, N):
                self.AddRuntimeMessage(
                    Error, " In 'ZVector' I need either none, one or the same number of inputs as the Crv parameter."
                )
            if len(width) not in (1, N):
                self.AddRuntimeMessage(
                    Error, " In 'W' I need either one or the same number of inputs as the Crv parameter."
                )
            if len(height) not in (1, N):
                self.AddRuntimeMessage(
                    Error, " In 'H' I need either one or the same number of inputs as the Crv parameter."
                )
            if len(category) not in (0, 1, N):
                self.AddRuntimeMessage(
                    Error, " In 'Category' I need either none, one or the same number of inputs as the Crv parameter."
                )

            # duplicate data if None or single value
            if len(z_vector) != N:
                z_vector = [z_vector[0] for _ in range(N)]
            if len(width) != N:
                width = [width[0] for _ in range(N)]
            if len(height) != N:
                height = [height[0] for _ in range(N)]
            if len(category) != N:
                category = [category[0] for _ in range(N)]

            for line, z, w, h, c in zip(centerline, z_vector, width, height, category):
                guid, geometry = self._get_guid_and_geometry(line)
                rhino_line = rs.coerceline(geometry)
                line = line_to_compas(rhino_line)

                z = vector_to_compas(z) if z else None
                beam = CTBeam.from_centerline(centerline=line, width=w, height=h, z_vector=z)
                beam.attributes["rhino_guid"] = str(guid) if guid else None
                beam.attributes["category"] = c
                print(guid)
                if updateRefObj and guid:
                    update_rhobj_attributes_name(guid, "width", str(w))
                    update_rhobj_attributes_name(guid, "height", str(h))
                    update_rhobj_attributes_name(guid, "zvector", str(list(beam.frame.zaxis)))
                    update_rhobj_attributes_name(guid, "category", c)

                beams.append(beam)
                scene.add(beam.blank)

        blanks = scene.draw()

        return beams, blanks

    def _get_guid_and_geometry(self, line):
        # internalized curves and GH geometry will not have persistent GUIDs, referenced Rhino objects will
        # type hint on the input has to be 'ghdoc' for this to work
        guid = None
        geometry = line
        rhino_obj = ActiveDoc.Objects.FindId(line)
        if rhino_obj:
            guid = line
            geometry = rhino_obj.Geometry
        return guid, geometry

    def _get_centerline_length(self, centerline):
        centerline_length = []
        for i in centerline:
            centerline_length.append(rs.CurveLength(i))
        if centerline_length:
            length_average = sum(centerline_length) / len(centerline_length)
        else:
            length_average = 1
        return length_average
# ---------- end beam ----------
t_topo_joint = CTTTopologicalJointRules(mill_depth=Slider(10, range=0..10), fastener=platefastener.Fastener)  # -> TButtPlateJoint
# ---------- t_topo_joint: Python ----------
import inspect

from ghpythonlib.componentbase import executingcomponent as component
from Grasshopper.Kernel.GH_RuntimeMessageLevel import Warning

from compas_timber.connections import Joint
from compas_timber.connections import JointTopology
from compas_timber.connections import TButtJoint
from compas_timber.design import TopologyRule
from compas_timber.ghpython.ghcomponent_helpers import get_leaf_subclasses
from compas_timber.ghpython.ghcomponent_helpers import manage_dynamic_params
from compas_timber.ghpython.ghcomponent_helpers import rename_gh_output


class T_TopologyJointRule(component):
    def __init__(self):
        super(T_TopologyJointRule, self).__init__()
        self.classes = {}
        for cls in get_leaf_subclasses(Joint):
            if cls.SUPPORTED_TOPOLOGY == JointTopology.TOPO_T:
                self.classes[cls.__name__] = cls
        if ghenv.Component.Params.Output[0].NickName == "Rule":
            self.joint_type = TButtJoint
            self.clicked = False
        else:
            self.joint_type = self.classes.get(ghenv.Component.Params.Output[0].NickName, None)
            self.clicked = True

    def RunScript(self, *args):
        if not self.clicked:
            ghenv.Component.Message = "Default: TButtJoint"
            self.AddRuntimeMessage(Warning, "TButtJoint is default, change in context menu (right click)")
            return TopologyRule(JointTopology.TOPO_T, TButtJoint)
        else:
            ghenv.Component.Message = self.joint_type.__name__
            kwargs = {}
            for i, val in enumerate(args):
                if val is not None:
                    kwargs[self.arg_names()[i]] = val
            if self.joint_type.SUPPORTED_TOPOLOGY != JointTopology.TOPO_T:
                self.AddRuntimeMessage(Warning, "Joint type does not match topology. Joint may not be generated.")
            return TopologyRule(JointTopology.TOPO_T, self.joint_type, **kwargs)

    def arg_names(self):
        names = inspect.getargspec(self.joint_type.__init__)[0][3:]
        return [name for name in names if (name != "key") and (name != "frame")]

    def AppendAdditionalMenuItems(self, menu):
        for name in self.classes.keys():
            item = menu.Items.Add(name, None, self.on_item_click)
            if self.joint_type and name == self.joint_type.__name__:
                item.Checked = True

    def on_item_click(self, sender, event_info):
        self.clicked = True
        self.joint_type = self.classes[str(sender)]
        rename_gh_output(self.joint_type.__name__, 0, ghenv)
        manage_dynamic_params(self.arg_names(), ghenv, rename_count=0, permanent_param_count=0)
        ghenv.Component.ExpireSolution(True)
# ---------- end t_topo_joint ----------
model = CTModel(Elements=flatten(beam.Beam), JointRules=flatten(t_topo_joint), CreateGeometry=Toggle(True))  # -> Model, Geometry, DebugInfo; inputs Elements: list, JointRules: list, Features: list, CreateGeometry: Boolean
#   port Elements: Collection of Beams
# ---------- model: Python ----------
from compas.scene import Scene
from compas.tolerance import TOL
from ghpythonlib.componentbase import executingcomponent as component
from Grasshopper.Kernel.GH_RuntimeMessageLevel import Warning

from compas_timber.connections import BeamJoinningError
from compas_timber.connections import JointTopology
from compas_timber.connections import LMiterJoint
from compas_timber.connections import TButtJoint
from compas_timber.connections import XHalfLapJoint
from compas_timber.design import DebugInfomation
from compas_timber.design import JointRule
from compas_timber.model import TimberModel

JOINT_DEFAULTS = {
    JointTopology.TOPO_X: XHalfLapJoint,
    JointTopology.TOPO_T: TButtJoint,
    JointTopology.TOPO_L: LMiterJoint,
}

# workaround for https://github.com/gramaziokohler/compas_timber/issues/280
TOL.absolute = 1e-6


class ModelComponent(component):
    def RunScript(self, Elements, JointRules, Features, MaxDistance, CreateGeometry):
        if not Elements:
            self.AddRuntimeMessage(Warning, "Input parameter Beams failed to collect data")
        if not JointRules:
            self.AddRuntimeMessage(Warning, "Input parameter JointRules failed to collect data")
        if not (Elements):  # shows beams even if no joints are found
            return
        if MaxDistance is None:
            MaxDistance = TOL.ABSOLUTE  # compared to calculted distance, so shouldn't be just 0.0

        Model = TimberModel()
        debug_info = DebugInfomation()
        for element in Elements:
            # prepare elements for downstream processing
            element.reset()
            Model.add_element(element)

        joints, unmatched_pairs = JointRule.joints_from_beams_and_rules(Model.beams, JointRules)

        if unmatched_pairs:
            for pair in unmatched_pairs:
                self.AddRuntimeMessage(
                    Warning, "No joint rule found for beams {} and {}".format(list(pair)[0].key, list(pair)[1].key)
                )  # TODO: add to debug_info

        if joints:
            # apply reversed. later joints in orginal list override ealier ones
            for joint in joints[::-1]:
                try:
                    joint.joint_type.create(Model, *joint.beams, **joint.kwargs)
                except BeamJoinningError as bje:
                    debug_info.add_joint_error(bje)

        # applies extensions and features resulting from joints
        Model.process_joinery()

        if Features:
            features = [f for f in Features if f is not None]
            for f_def in features:
                for element in f_def.elements:
                    element.add_features(f_def.feature)

        Geometry = None
        scene = Scene()
        for element in Model.elements():
            if CreateGeometry:
                scene.add(element.geometry)
                if element.debug_info:
                    debug_info.add_feature_error(element.debug_info)
            else:
                if element.is_beam or element.is_plate:
                    scene.add(element.blank)
                elif element.is_fastener:
                    scene.add(element.geometry)

        if debug_info.has_errors:
            self.AddRuntimeMessage(Warning, "Error found during joint creation. See DebugInfo output for details.")

        Geometry = scene.draw()
        return Model, Geometry, debug_info
# ---------- end model ----------
unload_ct = Unload_CT()
