# Grasshopper definition btlx.gh (Grasshopper 1.0.7)

# ----
# Butts no mills
crv = Curve([<curve referenced from the Rhino model> x4])
crv_2 = Curve(<curve referenced from the Rhino model>)
beam = CTBeam(Centerline=crv, Width=60, Height=120)  # -> Beam, Blank; inputs Centerline: list, ZVector: list of Vector3d, Width: list, Height: list, Category: list, updateRefObj: Boolean
#   port Centerline: Referenced curve or line, Guid of curve or line in the active Rhino document.
#   port ZVector: Vector defining the orientation of the cross-section (corresponds to the height dimension). If None, a default will be taken.
#   port Width: Width of the cross-section (usually the smaller dimension).
#   port Height: Height of the cross-section (usually the larger dimension).
#   port Category: Category of a beam.
#   port updateRefObj: (optional) If True, the attributes in the referenced object will be updated/overwritten with the new values given here.
#   port Beam: Beam object(s).
#   port Blank: Shape of the beam's blank.
# ---------- beam: Python ----------
"""Creates a Beam from a LineCurve."""

import rhinoscriptsyntax as rs
from compas.scene import Scene
from compas_rhino.conversions import line_to_compas
from compas_rhino.conversions import vector_to_compas
from ghpythonlib.componentbase import executingcomponent as component
from Grasshopper.Kernel.GH_RuntimeMessageLevel import Error
from Grasshopper.Kernel.GH_RuntimeMessageLevel import Warning
from Rhino.RhinoDoc import ActiveDoc

from compas_timber.elements import Beam as CTBeam
from compas_timber.ghpython.rhino_object_name_attributes import update_rhobj_attributes_name


class Beam_fromCurve(component):
    def RunScript(self, centerline, z_vector, width, height, category, updateRefObj):
        # minimum inputs required
        if not centerline:
            self.AddRuntimeMessage(Warning, "Input parameter 'Centerline' failed to collect data")
        if not width:
            self.AddRuntimeMessage(Warning, "Input parameter 'Width' failed to collect data")
        if not height:
            self.AddRuntimeMessage(Warning, "Input parameter 'Height' failed to collect data")

        # reformat unset parameters for consistency
        if not z_vector:
            z_vector = [None]
        if not category:
            category = [None]

        beams = []
        blanks = []
        scene = Scene()

        if centerline and height and width:
            # check list lengths for consistency
            N = len(centerline)
            if len(z_vector) not in (0, 1, N):
                self.AddRuntimeMessage(
                    Error, " In 'ZVector' I need either none, one or the same number of inputs as the Crv parameter."
                )
            if len(width) not in (1, N):
                self.AddRuntimeMessage(
                    Error, " In 'W' I need either one or the same number of inputs as the Crv parameter."
                )
            if len(height) not in (1, N):
                self.AddRuntimeMessage(
                    Error, " In 'H' I need either one or the same number of inputs as the Crv parameter."
                )
            if len(category) not in (0, 1, N):
                self.AddRuntimeMessage(
                    Error, " In 'Category' I need either none, one or the same number of inputs as the Crv parameter."
                )

            # duplicate data if None or single value
            if len(z_vector) != N:
                z_vector = [z_vector[0] for _ in range(N)]
            if len(width) != N:
                width = [width[0] for _ in range(N)]
            if len(height) != N:
                height = [height[0] for _ in range(N)]
            if len(category) != N:
                category = [category[0] for _ in range(N)]

            for line, z, w, h, c in zip(centerline, z_vector, width, height, category):
                guid, geometry = self._get_guid_and_geometry(line)
                rhino_line = rs.coerceline(geometry)
                line = line_to_compas(rhino_line)

                z = vector_to_compas(z) if z else None
                beam = CTBeam.from_centerline(centerline=line, width=w, height=h, z_vector=z)
                beam.attributes["rhino_guid"] = str(guid) if guid else None
                beam.attributes["category"] = c
                print(guid)
                if updateRefObj and guid:
                    update_rhobj_attributes_name(guid, "width", str(w))
                    update_rhobj_attributes_name(guid, "height", str(h))
                    update_rhobj_attributes_name(guid, "zvector", str(list(beam.frame.zaxis)))
                    update_rhobj_attributes_name(guid, "category", c)

                beams.append(beam)
                scene.add(beam.blank)

        blanks = scene.draw()

        return beams, blanks

    def _get_guid_and_geometry(self, line):
        # internalized curves and GH geometry will not have persistent GUIDs, referenced Rhino objects will
        # type hint on the input has to be 'ghdoc' for this to work
        guid = None
        geometry = line
        rhino_obj = ActiveDoc.Objects.FindId(line)
        if rhino_obj:
            guid = line
            geometry = rhino_obj.Geometry
        return guid, geometry
# ---------- end beam ----------
beam_2 = CTBeam(Centerline=crv_2, Width=60, Height=120)  # -> Beam, Blank; inputs Centerline: list, ZVector: list of Vector3d, Width: list, Height: list, Category: list, updateRefObj: Boolean; same code as beam
defaultjoints = CTDefaultJointRules()  # -> Rules
# ---------- defaultjoints: Python ----------
from ghpythonlib.componentbase import executingcomponent as component

from compas_timber.connections import JointTopology
from compas_timber.connections import LMiterJoint
from compas_timber.connections import TButtJoint
from compas_timber.connections import XHalfLapJoint
from compas_timber.design import TopologyRule


class DefaultJointRule(component):
    def RunScript(self):
        topoRules = []
        topoRules.append(TopologyRule(JointTopology.TOPO_L, LMiterJoint))
        topoRules.append(TopologyRule(JointTopology.TOPO_T, TButtJoint))
        topoRules.append(TopologyRule(JointTopology.TOPO_X, XHalfLapJoint))

        return topoRules
# ---------- end defaultjoints ----------
model = CTModel(Elements=flatten([beam_2.Beam, beam.Beam]), JointRules=flatten(defaultjoints), CreateGeometry=Toggle(True))  # -> Model, Geometry, DebugInfo; inputs Elements: list, JointRules: list, Features: list, CreateGeometry: Boolean
#   port Elements: Collection of Beams
# ---------- model: Python ----------
from compas.scene import Scene
from compas.tolerance import TOL
from ghpythonlib.componentbase import executingcomponent as component
from Grasshopper.Kernel.GH_RuntimeMessageLevel import Warning

from compas_timber.connections import BeamJoinningError
from compas_timber.connections import ConnectionSolver
from compas_timber.connections import JointTopology
from compas_timber.connections import LMiterJoint
from compas_timber.connections import TButtJoint
from compas_timber.connections import XHalfLapJoint
from compas_timber.design import CategoryRule
from compas_timber.design import DebugInfomation
from compas_timber.design import DirectRule
from compas_timber.design import JointDefinition
from compas_timber.design import TopologyRule
from compas_timber.model import TimberModel

JOINT_DEFAULTS = {
    JointTopology.TOPO_X: XHalfLapJoint,
    JointTopology.TOPO_T: TButtJoint,
    JointTopology.TOPO_L: LMiterJoint,
}


# workaround for https://github.com/gramaziokohler/compas_timber/issues/280
TOL.absolute = 1e-6


class ModelComponent(component):
    def get_joints_from_rules(self, beams, rules, topologies):
        if not isinstance(rules, list):
            rules = [rules]
        rules = [r for r in rules if r is not None]

        joints = []
        # rules have to be resolved into joint definitions
        topo_rules = {}
        cat_rules = []
        direct_rules = []

        # TODO: refactor this into some kind of a rule reloving class/function
        for r in rules:  # separate category and topo and direct joint rules
            if isinstance(r, TopologyRule):
                if topo_rules.get(r.topology_type, None):  # if rule for this Topo exists
                    if (r.joint_type != JOINT_DEFAULTS[r.topology_type]) or (
                        len(r.kwargs) != 0
                    ):  # if this rule is NOT default
                        topo_rules[r.topology_type] = r
                else:
                    topo_rules[r.topology_type] = r
            elif isinstance(r, CategoryRule):
                cat_rules.append(r)
            if isinstance(r, DirectRule):
                direct_rules.append(r)

        for topo in topologies:
            beam_a = topo["beam_a"]
            beam_b = topo["beam_b"]
            detected_topo = topo["detected_topo"]
            pair = beam_a, beam_b
            pair_joined = False

            if detected_topo == JointTopology.TOPO_UNKNOWN:
                continue

            for rule in direct_rules:  # apply direct rules first
                if rule.comply(pair):
                    joints.append(JointDefinition(rule.joint_type, rule.beams, **rule.kwargs))
                    pair_joined = True
                    break

            if not pair_joined:  # if no direct rule applies, apply category rules next
                for rule in cat_rules:
                    if not rule.comply(pair):
                        continue
                    if rule.joint_type.SUPPORTED_TOPOLOGY != detected_topo:
                        msg = "Conflict detected! Beams: {}, {} meet with topology: {} but rule assigns: {}"
                        self.AddRuntimeMessage(
                            Warning,
                            msg.format(
                                beam_a.guid,
                                beam_b.guid,
                                JointTopology.get_name(detected_topo),
                                rule.joint_type.__name__,
                            ),
                        )
                        continue
                    if rule.topos and detected_topo not in rule.topos:
                        msg = "Conflict detected! Beams: {}, {} meet with topology: {} but rule allows: {}"
                        self.AddRuntimeMessage(
                            Warning,
                            msg.format(
                                beam_a.guid,
                                beam_b.guid,
                                JointTopology.get_name(detected_topo),
                                [JointTopology.get_name(topo) for topo in rule.topos],
                            ),
                        )
                        continue
                    # sort by category to allow beam role by order (main beam first, cross beam second)
                    beam_a, beam_b = rule.reorder([beam_a, beam_b])
                    joints.append(JointDefinition(rule.joint_type, [beam_a, beam_b], **rule.kwargs))
                    break  # first matching rule

                else:  # no category rule applies, apply topology rules
                    if detected_topo not in topo_rules:
                        continue
                    else:
                        joints.append(
                            JointDefinition(
                                topo_rules[detected_topo].joint_type,
                                [beam_a, beam_b],
                                **topo_rules[detected_topo].kwargs
                            )
                        )
        return joints

    def RunScript(self, Elements, JointRules, Features, MaxDistance, CreateGeometry):
        if not Elements:
            self.AddRuntimeMessage(Warning, "Input parameter Beams failed to collect data")
        if not JointRules:
            self.AddRuntimeMessage(Warning, "Input parameter JointRules failed to collect data")
        if not (Elements):  # shows beams even if no joints are found
            return
        if MaxDistance is None:
            MaxDistance = TOL.ABSOLUTE  # compared to calculted distance, so shouldn't be just 0.0

        Model = TimberModel()
        debug_info = DebugInfomation()
        for element in Elements:
            # prepare elements for downstream processing
            if element is None:
                continue
            element.remove_features()
            if hasattr(element, "remove_blank_extension"):
                element.remove_blank_extension()
            element.debug_info = []
            Model.add_element(element)

        topologies = []
        solver = ConnectionSolver()
        found_pairs = solver.find_intersecting_pairs(list(Model.beams), rtree=True, max_distance=MaxDistance)
        for pair in found_pairs:
            beam_a, beam_b = pair
            detected_topo, beam_a, beam_b = solver.find_topology(beam_a, beam_b, max_distance=MaxDistance)
            if not detected_topo == JointTopology.TOPO_UNKNOWN:
                topologies.append({"detected_topo": detected_topo, "beam_a": beam_a, "beam_b": beam_b})
        Model.set_topologies(topologies)

        joints = self.get_joints_from_rules(Model.beams, JointRules, topologies)

        if joints:
            handled_beams = []
            joints = [j for j in joints if j is not None]
            # apply reversed. later joints in orginal list override ealier ones
            for joint in joints[::-1]:
                beams_to_pair = joint.beams
                beam_pair_ids = set([id(beam) for beam in beams_to_pair])
                if beam_pair_ids in handled_beams:
                    continue
                try:
                    joint.joint_type.create(Model, *beams_to_pair, **joint.kwargs)
                except BeamJoinningError as bje:
                    debug_info.add_joint_error(bje)
                else:
                    handled_beams.append(beam_pair_ids)

        # applies extensions and features resulting from joints
        Model.process_joinery()

        if Features:
            features = [f for f in Features if f is not None]
            for f_def in features:
                for element in f_def.elements:
                    element.add_features(f_def.feature)

        Geometry = None
        scene = Scene()
        for element in Model.elements():
            if CreateGeometry:
                scene.add(element.geometry)
                if element.debug_info:
                    debug_info.add_feature_error(element.debug_info)
            else:
                scene.add(element.blank)

        if debug_info.has_errors:
            self.AddRuntimeMessage(Warning, "Error found during joint creation. See DebugInfo output for details.")

        Geometry = scene.draw()
        return Model, Geometry, debug_info
# ---------- end model ----------
path = FilePath("C:\Users\ckasirer\Documents\Projects\COMPAS Timber\mario\model_sides_nomill.btlx")
writebtlx = CTWriteBTLx(Model=model.Model, Path=path, Write=Button())  # -> BTLx; inputs Write: Boolean
#   port Model: Model object.
# ---------- writebtlx: Python ----------
import Rhino
from ghpythonlib.componentbase import executingcomponent as component
from Grasshopper.Kernel.GH_RuntimeMessageLevel import Warning

from compas_timber.fabrication import BTLx


class WriteBTLx(component):
    def RunScript(self, model, path, write):
        if not model:
            self.AddRuntimeMessage(Warning, "Input parameter Model failed to collect data")
            return

        btlx = BTLx(model)
        btlx.history["FileName"] = Rhino.RhinoDoc.ActiveDoc.Name

        if write:
            if not path:
                self.AddRuntimeMessage(Warning, "Input parameter Path failed to collect data")
                return
            if path[-5:] != ".btlx":
                path += ".btlx"
            with open(path, "w") as f:
                f.write(btlx.btlx_string())
        return btlx.btlx_string()
# ---------- end writebtlx ----------

# ----
# Butts with mills and birdsmouth (BTLx only!)
crv_3 = Curve([<curve referenced from the Rhino model> x4])
crv_4 = Curve(<curve referenced from the Rhino model>)
beam_3 = CTBeam(Centerline=crv_3, Width=60, Height=120)  # -> Beam, Blank; inputs Centerline: list, ZVector: list of Vector3d, Width: list, Height: list, Category: list, updateRefObj: Boolean; same code as beam
beam_4 = CTBeam(Centerline=crv_4, Width=120, Height=120)  # -> Beam, Blank; inputs Centerline: list, ZVector: list of Vector3d, Width: list, Height: list, Category: list, updateRefObj: Boolean; same code as beam
defaultjoints_2 = CTDefaultJointRules()  # -> Rules; same code as defaultjoints
t_topo_joint = CTTTopologicalJointRules(mill_depth=Slider(16, range=10..100), birdsmouth=Toggle(True))  # -> TButtJoint
# ---------- t_topo_joint: Python ----------
import inspect

from ghpythonlib.componentbase import executingcomponent as component
from Grasshopper.Kernel.GH_RuntimeMessageLevel import Warning

from compas_timber.connections import Joint
from compas_timber.connections import JointTopology
from compas_timber.connections import TButtJoint
from compas_timber.design import TopologyRule
from compas_timber.ghpython.ghcomponent_helpers import get_leaf_subclasses
from compas_timber.ghpython.ghcomponent_helpers import manage_dynamic_params
from compas_timber.ghpython.ghcomponent_helpers import rename_gh_output


class T_TopologyJointRule(component):
    def __init__(self):
        super(T_TopologyJointRule, self).__init__()
        self.classes = {}
        for cls in get_leaf_subclasses(Joint):
            if cls.SUPPORTED_TOPOLOGY == JointTopology.TOPO_T:
                self.classes[cls.__name__] = cls
        if ghenv.Component.Params.Output[0].NickName == "Rule":
            self.joint_type = TButtJoint
            self.clicked = False
        else:
            self.joint_type = self.classes.get(ghenv.Component.Params.Output[0].NickName, None)
            self.clicked = True

    def RunScript(self, *args):
        if not self.clicked:
            ghenv.Component.Message = "Default: TButtJoint"
            self.AddRuntimeMessage(Warning, "TButtJoint is default, change in context menu (right click)")
            return TopologyRule(JointTopology.TOPO_T, TButtJoint)
        else:
            ghenv.Component.Message = self.joint_type.__name__
            kwargs = {}
            for i, val in enumerate(args):
                if val is not None:
                    kwargs[self.arg_names()[i]] = val
            if self.joint_type.SUPPORTED_TOPOLOGY != JointTopology.TOPO_T:
                self.AddRuntimeMessage(Warning, "Joint type does not match topology. Joint may not be generated.")
            return TopologyRule(JointTopology.TOPO_T, self.joint_type, **kwargs)

    def arg_names(self):
        names = inspect.getargspec(self.joint_type.__init__)[0][3:]
        return [name for name in names if (name != "key") and (name != "frame")]

    def AppendAdditionalMenuItems(self, menu):
        for name in self.classes.keys():
            item = menu.Items.Add(name, None, self.on_item_click)
            if self.joint_type and name == self.joint_type.__name__:
                item.Checked = True

    def on_item_click(self, sender, event_info):
        self.clicked = True
        self.joint_type = self.classes[str(sender)]
        rename_gh_output(self.joint_type.__name__, 0, ghenv)
        manage_dynamic_params(self.arg_names(), ghenv, rename_count=0, permanent_param_count=0)
        ghenv.Component.ExpireSolution(True)
# ---------- end t_topo_joint ----------
model_2 = CTModel(
    Elements=flatten([beam_4.Beam, beam_3.Beam]),
    JointRules=flatten([defaultjoints_2, t_topo_joint]),
    CreateGeometry=Toggle(True))  # -> Model, Geometry, DebugInfo; inputs Elements: list, JointRules: list, Features: list, CreateGeometry: Boolean; same code as model
path_2 = FilePath("C:\Users\ckasirer\Documents\Projects\COMPAS Timber\mario\birdsmouth")
writebtlx_2 = CTWriteBTLx(Model=model_2.Model, Path=path_2, Write=Button())  # -> BTLx; inputs Write: Boolean; same code as writebtlx

# ----
# Butts with mills
crv_5 = Curve([<curve referenced from the Rhino model> x4])
crv_6 = Curve(<curve referenced from the Rhino model>)
beam_5 = CTBeam(Centerline=crv_5, Width=60, Height=120)  # -> Beam, Blank; inputs Centerline: list, ZVector: list of Vector3d, Width: list, Height: list, Category: list, updateRefObj: Boolean; same code as beam
beam_6 = CTBeam(Centerline=crv_6, Width=120, Height=120)  # -> Beam, Blank; inputs Centerline: list, ZVector: list of Vector3d, Width: list, Height: list, Category: list, updateRefObj: Boolean; same code as beam
defaultjoints_3 = CTDefaultJointRules()  # -> Rules; same code as defaultjoints
t_topo_joint_2 = CTTTopologicalJointRules(mill_depth=Slider(16, range=10..100))  # -> TButtJoint; same code as t_topo_joint
model_3 = CTModel(
    Elements=flatten([beam_6.Beam, beam_5.Beam]),
    JointRules=flatten([defaultjoints_3, t_topo_joint_2]),
    CreateGeometry=Toggle(True))  # -> Model, Geometry, DebugInfo; inputs Elements: list, JointRules: list, Features: list, CreateGeometry: Boolean; same code as model
path_3 = FilePath("C:\Users\ckasirer\Documents\Projects\COMPAS Timber\mario\model_sides")
writebtlx_3 = CTWriteBTLx(Model=model_3.Model, Path=path_3, Write=Button())  # -> BTLx; inputs Write: Boolean; same code as writebtlx

# ----
# L Butts with mills
crv_7 = Curve(<curve referenced from the Rhino model>)
crv_8 = Curve(<curve referenced from the Rhino model>)
crv_9 = Curve(<curve referenced from the Rhino model>)
beam_7 = CTBeam(Centerline=crv_7, Width=120, Height=120)  # -> Beam, Blank; inputs Centerline: list, ZVector: list of Vector3d, Width: list, Height: list, Category: list, updateRefObj: Boolean; same code as beam
beam_8 = CTBeam(Centerline=crv_8, Width=120, Height=120)  # -> Beam, Blank; inputs Centerline: list, ZVector: list of Vector3d, Width: list, Height: list, Category: list, updateRefObj: Boolean; same code as beam
beam_9 = CTBeam(Centerline=crv_9, Width=120, Height=120)  # -> Beam, Blank; inputs Centerline: list, ZVector: list of Vector3d, Width: list, Height: list, Category: list, updateRefObj: Boolean; same code as beam
number_slider = Slider(15, range=10..100)
directjoints = CTDirectJointRules(main_beam=beam_7.Beam, cross_beam=beam_8.Beam, mill_depth=number_slider)  # -> LButtJoint; inputs main_beam: list, cross_beam: list
# ---------- directjoints: Python ----------
import inspect

from ghpythonlib.componentbase import executingcomponent as component
from Grasshopper.Kernel.GH_RuntimeMessageLevel import Error
from Grasshopper.Kernel.GH_RuntimeMessageLevel import Warning

from compas_timber.connections import ConnectionSolver
from compas_timber.connections import Joint
from compas_timber.connections import JointTopology
from compas_timber.design import DirectRule
from compas_timber.ghpython.ghcomponent_helpers import get_leaf_subclasses
from compas_timber.ghpython.ghcomponent_helpers import manage_dynamic_params
from compas_timber.ghpython.ghcomponent_helpers import rename_gh_output


class DirectJointRule(component):
    def __init__(self):
        super(DirectJointRule, self).__init__()
        self.classes = {}
        for cls in get_leaf_subclasses(Joint):
            self.classes[cls.__name__] = cls

        if ghenv.Component.Params.Output[0].NickName == "Rule":
            self.joint_type = None
        else:
            self.joint_type = self.classes.get(ghenv.Component.Params.Output[0].NickName, None)

    def RunScript(self, *args):
        if not self.joint_type:
            ghenv.Component.Message = "Select joint type from context menu (right click)"
            self.AddRuntimeMessage(Warning, "Select joint type from context menu (right click)")
            return None
        else:
            ghenv.Component.Message = self.joint_type.__name__
            beam_a = args[0]
            beam_b = args[1]
            kwargs = {}
            for i, val in enumerate(args[2:]):
                if val is not None:
                    kwargs[self.arg_names()[i + 2]] = val

            if not beam_a:
                self.AddRuntimeMessage(
                    Warning, "Input parameter {} failed to collect data.".format(self.arg_names()[0])
                )
            if not beam_b:
                self.AddRuntimeMessage(
                    Warning, "Input parameter {} failed to collect data.".format(self.arg_names()[1])
                )
            if not (args[0] and args[1]):
                return
            if not isinstance(beam_a, list):
                beam_a = [beam_a]
            if not isinstance(beam_b, list):
                beam_b = [beam_b]
            if len(beam_a) != len(beam_b):
                self.AddRuntimeMessage(
                    Error, "Number of items in {} and {} must match!".format(self.arg_names()[0], self.arg_names()[1])
                )
                return
            Rules = []
            for main, secondary in zip(beam_a, beam_b):
                topology, _, _ = ConnectionSolver().find_topology(main, secondary)
                if topology != self.joint_type.SUPPORTED_TOPOLOGY:
                    self.AddRuntimeMessage(
                        Warning,
                        "Beams meet with topology: {} which does not agree with joint of type: {}".format(
                            JointTopology.get_name(topology), self.joint_type.__name__
                        ),
                    )
                Rules.append(DirectRule(self.joint_type, [secondary, main], **kwargs))
            return Rules

    def arg_names(self):
        return inspect.getargspec(self.joint_type.__init__)[0][1:]

    def AppendAdditionalMenuItems(self, menu):
        for name in self.classes.keys():
            item = menu.Items.Add(name, None, self.on_item_click)
            if self.joint_type and name == self.joint_type.__name__:
                item.Checked = True

    def on_item_click(self, sender, event_info):
        self.joint_type = self.classes[str(sender)]
        rename_gh_output(self.joint_type.__name__, 0, ghenv)
        manage_dynamic_params(self.arg_names(), ghenv, rename_count=2, permanent_param_count=0)
        ghenv.Component.ExpireSolution(True)
# ---------- end directjoints ----------
directjoints_2 = CTDirectJointRules(main_beam=beam_8.Beam, cross_beam=beam_9.Beam, mill_depth=number_slider)  # -> LButtJoint; inputs main_beam: list, cross_beam: list; same code as directjoints
model_4 = CTModel(
    Elements=flatten([beam_7.Beam, beam_8.Beam, beam_9.Beam]),
    JointRules=flatten([directjoints, directjoints_2]),
    CreateGeometry=Toggle(True))  # -> Model, Geometry, DebugInfo; inputs Elements: list, JointRules: list, Features: list, CreateGeometry: Boolean; same code as model
path_4 = FilePath("C:\Users\ckasirer\Documents\Projects\COMPAS Timber\mario\l_butts_mill.btlx")
writebtlx_4 = CTWriteBTLx(Model=model_4.Model, Path=path_4, Write=Button())  # -> BTLx; inputs Write: Boolean; same code as writebtlx

# ----
# L Butts no mills
crv_10 = Curve(<curve referenced from the Rhino model>)
crv_11 = Curve(<curve referenced from the Rhino model>)
crv_12 = Curve(<curve referenced from the Rhino model>)
beam_10 = CTBeam(Centerline=crv_10, Width=120, Height=120)  # -> Beam, Blank; inputs Centerline: list, ZVector: list of Vector3d, Width: list, Height: list, Category: list, updateRefObj: Boolean; same code as beam
beam_11 = CTBeam(Centerline=crv_11, Width=120, Height=120)  # -> Beam, Blank; inputs Centerline: list, ZVector: list of Vector3d, Width: list, Height: list, Category: list, updateRefObj: Boolean; same code as beam
beam_12 = CTBeam(Centerline=crv_12, Width=120, Height=120)  # -> Beam, Blank; inputs Centerline: list, ZVector: list of Vector3d, Width: list, Height: list, Category: list, updateRefObj: Boolean; same code as beam
directjoints_3 = CTDirectJointRules(main_beam=beam_10.Beam, cross_beam=beam_11.Beam)  # -> LButtJoint; inputs main_beam: list, cross_beam: list; same code as directjoints
directjoints_4 = CTDirectJointRules(main_beam=beam_11.Beam, cross_beam=beam_12.Beam)  # -> LButtJoint; inputs main_beam: list, cross_beam: list; same code as directjoints
model_5 = CTModel(
    Elements=flatten([beam_10.Beam, beam_11.Beam, beam_12.Beam]),
    JointRules=flatten([directjoints_3, directjoints_4]),
    CreateGeometry=Toggle(True))  # -> Model, Geometry, DebugInfo; inputs Elements: list, JointRules: list, Features: list, CreateGeometry: Boolean; same code as model
path_5 = FilePath("C:\Users\ckasirer\Documents\Projects\COMPAS Timber\mario\l_butts_nomill")
writebtlx_5 = CTWriteBTLx(Model=model_5.Model, Path=path_5, Write=Button())  # -> BTLx; inputs Write: Boolean; same code as writebtlx
