# Grasshopper definition cpython.gh (Grasshopper 1.0.8)

crv = Curve(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)
crv_2 = Curve(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)
crv_3 = Curve(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)
beam = CTBeam(centerline=crv_3, category="cross")  # -> Beam, Blank; inputs centerline: list, z_vector: list of Vector3d, width: list of Double, height: list of Double, category: list of String, updateRefObj: Boolean
#   port centerline: Referenced curve or line, Guid of curve or line in the active Rhino document.
#   port z_vector: Vector defining the orientation of the cross-section (corresponds to the height dimension). If None, a default will be taken.
#   port width: Width of the cross-section (usually the smaller dimension).
#   port height: Height of the cross-section (usually the larger dimension).
#   port category: Category of a beam.
#   port updateRefObj: (optional) If True, the attributes in the referenced object will be updated/overwritten with the new values given here.
#   port Beam: Beam object(s).
#   port Blank: Shape of the beam's blank.
# ---------- beam: Python ----------
"""Creates a Beam from a LineCurve."""

# flake8: noqa
import Grasshopper
import Rhino
import rhinoscriptsyntax as rs
import System
from compas.scene import Scene
from compas_rhino.conversions import line_to_compas
from compas_rhino.conversions import vector_to_compas

from compas_timber.elements import Beam as CTBeam
from compas_timber.ghpython.rhino_object_name_attributes import update_rhobj_attributes_name
from compas_timber.ghpython.ghcomponent_helpers import list_input_valid_cpython


class Beam_fromCurve(Grasshopper.Kernel.GH_ScriptInstance):
    def RunScript(self,
            centerline: System.Collections.Generic.List[object],
            z_vector: System.Collections.Generic.List[Rhino.Geometry.Vector3d],
            width: System.Collections.Generic.List[float],
            height: System.Collections.Generic.List[float],
            category: System.Collections.Generic.List[str],
            updateRefObj: bool):
        # minimum inputs required
        if not list_input_valid_cpython(ghenv, centerline, "Centerline"):
            return
        if not width:
            length = self._get_centerline_length(centerline)
            width = [length / 20]
        if not height:
            length = self._get_centerline_length(centerline)
            height = [length / 10]

        # reformat unset parameters for consistency
        if not z_vector:
            z_vector = [None]
        if not category:
            category = [None]

        beams = []
        blanks = []
        scene = Scene()

        if centerline and height and width:
            # check list lengths for consistency
            N = len(centerline)
            if len(z_vector) not in (0, 1, N):
                ghenv.Component.AddRuntimeMessage(
                    Grasshopper.Kernel.GH_RuntimeMessageLevel.Error, " In 'ZVector' I need either none, one or the same number of inputs as the Crv parameter."
                )
            if len(width) not in (1, N):
                ghenv.Component.AddRuntimeMessage(Grasshopper.Kernel.GH_RuntimeMessageLevel.Error, " In 'W' I need either one or the same number of inputs as the Crv parameter.")
            if len(height) not in (1, N):
                ghenv.Component.AddRuntimeMessage(Grasshopper.Kernel.GH_RuntimeMessageLevel.Error, " In 'H' I need either one or the same number of inputs as the Crv parameter.")
            if len(category) not in (0, 1, N):
                ghenv.Component.AddRuntimeMessage(
                    Grasshopper.Kernel.GH_RuntimeMessageLevel.Error, " In 'Category' I need either none, one or the same number of inputs as the Crv parameter."
                )

            # duplicate data if None or single value
            if len(z_vector) != N:
                z_vector = [z_vector[0] for _ in range(N)]
            if len(width) != N:
                width = [width[0] for _ in range(N)]
            if len(height) != N:
                height = [height[0] for _ in range(N)]
            if len(category) != N:
                category = [category[0] for _ in range(N)]

            for line, z, w, h, c in zip(centerline, z_vector, width, height, category):
                guid, geometry = self._get_guid_and_geometry(line)
                rhino_line = rs.coerceline(geometry)
                line = line_to_compas(rhino_line)

                z = vector_to_compas(z) if z else None
                beam = CTBeam.from_centerline(centerline=line, width=w, height=h, z_vector=z)
                beam.attributes["rhino_guid"] = str(guid) if guid else None
                beam.attributes["category"] = c
                if updateRefObj and guid:
                    update_rhobj_attributes_name(guid, "width", str(w))
                    update_rhobj_attributes_name(guid, "height", str(h))
                    update_rhobj_attributes_name(guid, "zvector", str(list(beam.frame.zaxis)))
                    update_rhobj_attributes_name(guid, "category", c)

                beams.append(beam)
                scene.add(beam.blank)

        blanks = scene.draw()

        return beams, blanks

    def _get_guid_and_geometry(self, line):
        # internalized curves and GH geometry will not have persistent GUIDs, referenced Rhino objects will
        # type hint on the input has to be 'ghdoc' for this to work
        guid = None
        geometry = line
        rhino_obj = Rhino.RhinoDoc.ActiveDoc.Objects.FindId(line)
        if rhino_obj:
            guid = line
            geometry = rhino_obj.Geometry
        return guid, geometry

    def _get_centerline_length(self, centerline):
        centerline_length = []
        for i in centerline:
            centerline_length.append(rs.CurveLength(i))
        if centerline_length:
            length_average = sum(centerline_length) / len(centerline_length)
        else:
            length_average = 1
        return length_average
# ---------- end beam ----------
beam_2 = CTBeam(centerline=crv, category="main")  # -> Beam, Blank; inputs centerline: list, z_vector: list of Vector3d, width: list of Double, height: list of Double, category: list of String, updateRefObj: Boolean; same code as beam
beam_3 = CTBeam(centerline=crv_2)  # -> Beam, Blank; inputs centerline: list, z_vector: list of Vector3d, width: list of Double, height: list of Double, category: list of String, updateRefObj: Boolean; same code as beam
crv_4 = Curve([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])
decomposebeam = CTDecomposeBeam(beam=beam_2.Beam, show_frame=True)  # -> Frame, Centerline, Box, Width, Height; inputs beam: list, show_frame: Boolean, show_faces: Boolean
#   port show_frame: If True, shows the Beam's frame.
#   port show_faces: If True, shows the Beam's faces with their indices and normals
#   port Frame: A plane (frame) representing the Beam's local coordinate system.
#   port Centerline: The centerline of the Beam.
#   port Box: Box representing the original shape of the Beam.
#   port Width: The width of the Beam's cross-section.
#   port Height: The height of the Beam's cross-section.
# ---------- decomposebeam: Python ----------
"""Extracts main geometric characteristics of a Beam."""
# flake8: noqa
import Grasshopper
import System
from System.Drawing import Color

from compas.geometry import Line
from compas_rhino.conversions import frame_to_rhino_plane
from compas_rhino.conversions import line_to_rhino
from compas_rhino.conversions import point_to_rhino
from compas_rhino.conversions import box_to_rhino

from compas_timber.ghpython.ghcomponent_helpers import list_input_valid_cpython


class BeamDecompose(Grasshopper.Kernel.GH_ScriptInstance):
    RED = Color.FromArgb(255, 255, 100, 100)
    GREEN = Color.FromArgb(200, 50, 220, 100)
    BLUE = Color.FromArgb(200, 50, 150, 255)
    WHITE = Color.FromArgb(255, 255, 255, 255)
    YELLOW = Color.FromArgb(255, 255, 255, 0)
    SCREEN_SIZE = 10
    RELATIVE_SIZE = 0

    def RunScript(self,
            beam: System.Collections.Generic.List[object],
            show_frame: bool,
            show_faces: bool):
        self.show_faces = show_faces if show_faces is not None else False
        self.show_frame = show_frame if show_frame is not None else False
        self.frames = []
        self.rhino_frames = []
        self.scales = []
        self.faces = []
        self.width = []
        self.height = []
        self.centerline = []
        self.shapes = []
        if not list_input_valid_cpython(ghenv, beam, "beam"):
            return
        else:
            for b in beam:
                self.frames.append(b.frame)
                self.rhino_frames.append(frame_to_rhino_plane(b.frame))
                self.scales.append(b.width + b.height)
                self.centerline.append(line_to_rhino(b.centerline))
                self.shapes.append(box_to_rhino(b.shape))
                self.width.append(b.width)
                self.height.append(b.height)
                self.faces.append(b.faces)

            return self.rhino_frames, self.centerline, self.shapes, self.width, self.height

    def DrawViewportWires(self, arg):
        if ghenv.Component.Locked:
            return

        for f, s, faces in zip(self.frames, self.scales, self.faces):
            if self.show_frame:
                self._draw_frame(arg.Display, f, s)
            if self.show_faces:
                self._draw_faces(arg.Display, faces, s)

    def _draw_frame(self, display, frame, scale):
        x = Line.from_point_and_vector(frame.point, frame.xaxis * scale)
        y = Line.from_point_and_vector(frame.point, frame.yaxis * scale)
        z = Line.from_point_and_vector(frame.point, frame.zaxis * scale)
        display.DrawArrow(line_to_rhino(x), self.RED, self.SCREEN_SIZE, self.RELATIVE_SIZE)
        display.DrawArrow(line_to_rhino(y), self.GREEN, self.SCREEN_SIZE, self.RELATIVE_SIZE)
        display.DrawArrow(line_to_rhino(z), self.BLUE, self.SCREEN_SIZE, self.RELATIVE_SIZE)

        x_loc = x.end + x.vector * scale * 1.1
        y_loc = y.end + y.vector * scale * 1.1
        z_loc = z.end + z.vector * scale * 1.1
        display.Draw2dText("X", self.RED, point_to_rhino(x_loc), True, 16, "Verdana")
        display.Draw2dText("Y", self.GREEN, point_to_rhino(y_loc), True, 16, "Verdana")
        display.Draw2dText("Z", self.BLUE, point_to_rhino(z_loc), True, 16, "Verdana")

    def _draw_faces(self, display, faces, scale):
        for index, face in enumerate(faces):
            normal = Line.from_point_and_vector(face.point, face.normal * scale)
            text = str(index)
            display.Draw2dText(text, self.WHITE, point_to_rhino(face.point), True, 16, "Verdana")
            display.DrawArrow(line_to_rhino(normal), self.YELLOW, self.SCREEN_SIZE, self.RELATIVE_SIZE)
# ---------- end decomposebeam ----------
t_topo_joint = CTTTopologicalJointRules()  # -> TButtJoint
#   port TButtJoint: List of JointDefinitions.
# ---------- t_topo_joint: Python ----------
"""makes rule to apply joint type to T topology. Defualts to TButtJoint"""
# flake8: noqa
import inspect

import Grasshopper

from compas_timber.connections import Joint
from compas_timber.connections import JointTopology
from compas_timber.connections import TButtJoint
from compas_timber.design import TopologyRule
from compas_timber.ghpython.ghcomponent_helpers import get_leaf_subclasses
from compas_timber.ghpython.ghcomponent_helpers import manage_cpython_dynamic_params
from compas_timber.ghpython.ghcomponent_helpers import rename_cpython_gh_output


class T_TopologyJointRule(Grasshopper.Kernel.GH_ScriptInstance):
    def __init__(self):
        super(T_TopologyJointRule, self).__init__()
        self.classes = {}
        for cls in get_leaf_subclasses(Joint):
            supported_topo = cls.SUPPORTED_TOPOLOGY
            if not isinstance(supported_topo, list):
                supported_topo = [supported_topo]
            if JointTopology.TOPO_T in supported_topo:
                self.classes[cls.__name__] = cls
        if ghenv.Component.Params.Output[0].NickName == "Rule":
            self.joint_type = TButtJoint
            self.clicked = False
        else:
            self.joint_type = self.classes.get(ghenv.Component.Params.Output[0].NickName, None)
            self.clicked = True

    def RunScript(self, *args):
        if not self.clicked:
            ghenv.Component.Message = "Default: TButtJoint"
            ghenv.Component.AddRuntimeMessage(Grasshopper.Kernel.GH_RuntimeMessageLevel.Warning, "TButtJoint is default, change in context menu (right click)")
            return TopologyRule(JointTopology.TOPO_T, TButtJoint)
        else:
            ghenv.Component.Message = self.joint_type.__name__
            kwargs = {}
            for i, val in enumerate(args):
                if val is not None:
                    kwargs[self.arg_names()[i]] = val
            supported_topo = self.joint_type.SUPPORTED_TOPOLOGY
            if not isinstance(supported_topo, list):
                supported_topo = [supported_topo]
            if JointTopology.TOPO_T not in supported_topo:
                ghenv.Component.AddRuntimeMessage(Grasshopper.Kernel.GH_RuntimeMessageLevel.Warning, "Joint type does not match topology. Joint may not be generated.")
            return TopologyRule(JointTopology.TOPO_T, self.joint_type, **kwargs)

    def arg_names(self):
        names = inspect.getargspec(self.joint_type.__init__)[0][3:]
        return [name for name in names if (name != "key") and (name != "frame")] + ["max_distance"]

    def AppendAdditionalMenuItems(self, menu):
        for name in self.classes.keys():
            item = menu.Items.Add(name, None, self.on_item_click)
            if self.joint_type and name == self.joint_type.__name__:
                item.Checked = True

    def on_item_click(self, sender, event_info):
        self.clicked = True
        self.joint_type = self.classes[str(sender)]
        rename_cpython_gh_output(self.joint_type.__name__, 0, ghenv)
        manage_cpython_dynamic_params(self.arg_names(), ghenv, rename_count=0, permanent_param_count=0)
        ghenv.Component.ExpireSolution(True)
# ---------- end t_topo_joint ----------
l_topo_joint = CTLTopologicalJointRules()  # -> LMiterJoint
#   port LMiterJoint: List of JointDefinitions.
# ---------- l_topo_joint: Python ----------
"""makes rule to apply joint type to L topology. Defualts to LMiterJoint"""
# flake8: noqa
import inspect

import Grasshopper

from compas_timber.connections import Joint
from compas_timber.connections import JointTopology
from compas_timber.connections import LMiterJoint
from compas_timber.design import TopologyRule
from compas_timber.ghpython.ghcomponent_helpers import get_leaf_subclasses
from compas_timber.ghpython.ghcomponent_helpers import manage_cpython_dynamic_params
from compas_timber.ghpython.ghcomponent_helpers import rename_cpython_gh_output


class L_TopologyJointRule(Grasshopper.Kernel.GH_ScriptInstance):
    def __init__(self):
        super(L_TopologyJointRule, self).__init__()
        self.classes = {}
        for cls in get_leaf_subclasses(Joint):
            supported_topo = cls.SUPPORTED_TOPOLOGY
            if not isinstance(supported_topo, list):
                supported_topo = [supported_topo]
            if JointTopology.TOPO_L in supported_topo:
                self.classes[cls.__name__] = cls
        if ghenv.Component.Params.Output[0].NickName == "Rule":
            self.joint_type = LMiterJoint
            self.clicked = False
        else:
            self.joint_type = self.classes.get(ghenv.Component.Params.Output[0].NickName, None)
            self.clicked = True

    def RunScript(self, *args):
        if not self.clicked:
            ghenv.Component.Message = "Default: LMiterJoint"
            ghenv.Component.AddRuntimeMessage(Grasshopper.Kernel.GH_RuntimeMessageLevel.Warning, "LMiterJoint is default, change in context menu (right click)")
            return TopologyRule(JointTopology.TOPO_L, LMiterJoint)
        else:
            ghenv.Component.Message = self.joint_type.__name__
            kwargs = {}
            for i, val in enumerate(args):
                if val is not None:
                    kwargs[self.arg_names()[i]] = val
            supported_topo = self.joint_type.SUPPORTED_TOPOLOGY
            if not isinstance(supported_topo, list):
                supported_topo = [supported_topo]
            if JointTopology.TOPO_L not in supported_topo:
                ghenv.Component.AddRuntimeMessage(Grasshopper.Kernel.GH_RuntimeMessageLevel.Warning, "Joint type does not match topology. Joint may not be generated.")
            return TopologyRule(JointTopology.TOPO_L, self.joint_type, **kwargs)

    def arg_names(self):
        names = inspect.getargspec(self.joint_type.__init__)[0][3:]
        return [name for name in names if (name != "key") and (name != "frame")] + ["max_distance"]

    def AppendAdditionalMenuItems(self, menu):
        for name in self.classes.keys():
            item = menu.Items.Add(name, None, self.on_item_click)
            if self.joint_type and name == self.joint_type.__name__:
                item.Checked = True

    def on_item_click(self, sender, event_info):
        self.clicked = True
        self.joint_type = self.classes[str(sender)]
        rename_cpython_gh_output(self.joint_type.__name__, 0, ghenv)
        manage_cpython_dynamic_params(self.arg_names(), ghenv, rename_count=0, permanent_param_count=0)
        ghenv.Component.ExpireSolution(True)
# ---------- end l_topo_joint ----------
btlxfromgeo = CTBTLxFromGeometry(element=beam_3.Beam, line=crv_4, diameter="10")  # -> Drilling; inputs element: list
#   port element: Element to apply BTLx feature to.
#   port Drilling: Feature Definition. Should connect to CT_Model features input or a Fastener Timber Interface features input.
# ---------- btlxfromgeo: Python ----------
# flake8: noqa
import inspect

import Grasshopper
import Rhino.Geometry as rg
import System
from compas.geometry import Line
from compas_rhino.conversions import plane_to_compas
from compas_rhino.conversions import polyline_to_compas

from compas_timber.fabrication import BTLxFromGeometryDefinition
from compas_timber.fabrication import BTLxProcessing
from compas_timber.ghpython import get_leaf_subclasses
from compas_timber.ghpython import manage_cpython_dynamic_params
from compas_timber.ghpython import rename_cpython_gh_output
from compas_timber.ghpython import warning
from compas_timber.ghpython import error
from compas_timber.ghpython import message

import rhinoscriptsyntax as rs


class BTLxFromGeometry(Grasshopper.Kernel.GH_ScriptInstance):
    def __init__(self):
        super(BTLxFromGeometry, self).__init__()
        self.classes = {}
        self.geometry_count = 0
        for cls in get_leaf_subclasses(BTLxProcessing):
            functions = inspect.getmembers(cls, predicate=inspect.ismethod)
            if "from_shapes_and_element" in [func[0] for func in functions]:
                self.classes[cls.__name__] = cls

        if ghenv.Component.Params.Output[0].NickName == "Features":
            self.processing_type = None
        else:
            self.processing_type = self.classes.get(ghenv.Component.Params.Output[0].NickName, None)

    @property
    def component(self):
        return ghenv.Component  # type: ignore

    def RunScript(self, elements: System.Collections.Generic.List[object], *args):
        if not self.processing_type:
            warning(self.component, "Select Process type from context menu (right click)")
            return None
        else:
            message(self.component, self.processing_type.__name__)
            for arg, arg_name in zip(args, self.arg_names()[0 : self.geometry_count]):
                if arg is None:
                    warning(self.component, f"Input parameter {arg_name} failed to collect data")

            geometries = []
            for geo, arg_name in zip(args, self.arg_names()[0 : self.geometry_count]):
                geo = rs.coercegeometry(geo)  # guid to geometry

                if isinstance(geo, rg.LineCurve):
                    geometries.append(Line(geo.PointAtStart, geo.PointAtEnd))
                elif isinstance(geo, rg.Plane):
                    geometries.append(plane_to_compas(geo))
                elif isinstance(geo, rg.PolylineCurve):
                    geometries.append(polyline_to_compas(geo.ToPolyline()))
                else:
                    error(self.component, f"Input parameter {arg_name} collect unusable data")

            if not geometries:
                warning(self.component, "no valid geometry collected")
                return

            kwargs = {"geometries": geometries}
            if elements:
                kwargs["elements"] = list(elements)
            for key, val in zip(self.arg_names()[self.geometry_count :], args[self.geometry_count :]):
                if val is not None:
                    kwargs[key] = val
            return BTLxFromGeometryDefinition(self.processing_type, **kwargs)

    def arg_names(self):
        names = inspect.getargspec(self.processing_type.from_shapes_and_element)[0][1:]
        count = 0
        for name in names:
            if name == "element":
                break
            else:
                count += 1
        self.geometry_count = count
        return [name for name in names if name != "element"]

    def AppendAdditionalMenuItems(self, menu):
        for name in self.classes.keys():
            item = menu.Items.Add(name, None, self.on_item_click)
            if self.processing_type and name == self.processing_type.__name__:
                item.Checked = True

    def on_item_click(self, sender, event_info):
        self.processing_type = self.classes[str(sender)]
        rename_cpython_gh_output(self.processing_type.__name__, 0, ghenv)
        manage_cpython_dynamic_params(self.arg_names(), ghenv, rename_count=0, permanent_param_count=1)
        ghenv.Component.ExpireSolution(True)
# ---------- end btlxfromgeo ----------
model = CTModel(
    Elements=flatten([beam_2.Beam, beam.Beam, beam_3.Beam]),
    JointRules=flatten([l_topo_joint, t_topo_joint]),
    Features=flatten(btlxfromgeo),
    CreateGeometry=Toggle(True))  # -> Model, Geometry, DebugInfo; inputs Elements: list, Containers: list, JointRules: list, Features: list, MaxDistance: Double, CreateGeometry: Boolean
#   port Elements: Collection of Beams
#   port Containers: Container elements, such as walls, floors, roofs, etc.
#   port JointRules: Collection of joint rules.
#   port Features: Collection of feature definitions.
#   port MaxDistance: Max Distance Tolerance for topology detection.
#   port CreateGeometry: If True, Beam and joint geometry is created for visualization.
#   port Model: Model object.
#   port Geometry: Geometry of the beams and joints.
#   port DebugInfo: Debug information object in the case of feature or joining errors.
# ---------- model: Python ----------
"""Creates an Model"""

# flake8: noqa
import Grasshopper
import System
from compas.scene import Scene
from compas.tolerance import TOL

from compas_timber.design import DebugInfomation
from compas_timber.design import JointRule
from compas_timber.design import WallPopulator
from compas_timber.elements import Beam
from compas_timber.elements import Plate
from compas_timber.errors import FeatureApplicationError
from compas_timber.model import TimberModel
from compas_timber.ghpython import warning

# workaround for https://github.com/gramaziokohler/compas_timber/issues/280
TOL.absolute = 1e-6


class ModelComponent(Grasshopper.Kernel.GH_ScriptInstance):
    @property
    def component(self):
        return ghenv.Component  # type: ignore

    def RunScript(self,
            Elements: System.Collections.Generic.List[object],
            Containers: System.Collections.Generic.List[object],
            JointRules: System.Collections.Generic.List[object],
            Features: System.Collections.Generic.List[object],
            MaxDistance: float,
            CreateGeometry: bool):
        # this used to be default behavior in Rhino7.. I think..
        Elements = Elements or []
        Containers = Containers or []
        JointRules = JointRules or []
        Features = Features or []
        if not Elements:
            warning(self.component, "Input parameter Beams failed to collect data")
        if not JointRules:
            warning(self.component, "Input parameter JointRules failed to collect data")
        if not (Elements or Containers):  # shows beams even if no joints are found
            return
        if MaxDistance is None:
            MaxDistance = TOL.ABSOLUTE  # compared to calculted distance, so shouldn't be just 0.0

        # clear Nones
        Containers = [c for c in Containers if c is not None]

        Model = TimberModel()
        debug_info = DebugInfomation()

        ##### Adding elements #####
        for element in Elements:
            # prepare elements for downstream processing
            element.reset()
            Model.add_element(element)

        for index, c_def in enumerate(Containers):
            slab = c_def.slab
            Model.add_group_element(slab, name=slab.name + str(index))

        Model.connect_adjacent_walls()

        ##### Wall populating #####
        config_sets = [c_def.config_set for c_def in Containers]
        populators = []
        if any(config_sets):
            populators = WallPopulator.from_model(Model, config_sets)

        handled_pairs = []
        wall_joint_definitions = []
        for populator, slab in zip(populators, Model.slabs):
            elements = populator.create_elements()
            Model.add_elements(elements, parent=slab.name)
            joint_definitions = populator.create_joint_definitions(elements, MaxDistance)
            wall_joint_definitions.extend(joint_definitions)
            for j_def in joint_definitions:
                element_a, element_b = j_def.elements
                handled_pairs.append({element_a, element_b})

        ##### Handle joinery #####
        joint_defs, unmatched_pairs = JointRule.joints_from_beams_and_rules(Model.beams, JointRules, MaxDistance, handled_pairs=handled_pairs)
        if unmatched_pairs:
            for pair in unmatched_pairs:
                e_a, e_b = pair
                warning(self.component, f"No joint rule found for beams {e_a.key} and {e_b.key}")  # TODO: add to debug_info

        if wall_joint_definitions:
            joint_defs += wall_joint_definitions

        # apply reversed. later joints in orginal list override ealier ones
        for joint_def in joint_defs[::-1]:
            joint_def.joint_type.create(Model, *joint_def.elements, **joint_def.kwargs)

        # checks elements compatibility and applies extensions and features resulting from joints
        bje = Model.process_joinery()
        if bje:
            debug_info.add_joint_error(bje)

        ##### Handle user features #####
        if Features:
            feature_errors = []
            features = [f for f in Features if f is not None]
            for f_def in features:
                if not f_def.elements:
                    warning(self.component, "Features defined in model must have elements defined. Features without elements will be ignored")
                    continue

                for element in f_def.elements:
                    try:
                        feature = f_def.feature_from_element(element)
                        print(feature.diameter)
                        element.add_features(feature)
                    except FeatureApplicationError as ex:
                        feature_errors.append(ex)

            for error in feature_errors:
                debug_info.add_feature_error(error)

        ##### Visualization #####
        Geometry = None
        scene = Scene()
        for element in Model.elements():
            if CreateGeometry:
                scene.add(element.geometry)
                if getattr(element, "debug_info", False):
                    debug_info.add_feature_error(element.debug_info)
            else:
                if isinstance(element, Beam) or isinstance(element, Plate):
                    scene.add(element.blank)
                else:
                    scene.add(element.geometry)

        if debug_info.has_errors:
            warning(self.component, "Error found during joint creation. See DebugInfo output for details.")

        Geometry = scene.draw()
        return Model, Geometry, debug_info
# ---------- end model ----------
path = FilePath()
writebtlx = CTWriteBTLx(model=model.Model, path=path, write=Button())  # -> BTLx; inputs write: Boolean
#   port model: Model object.
#   port path: Filepath for new BTLx.
#   port write: Write to file.
#   port BTLx: Pretty BTLx string
# ---------- writebtlx: Python ----------
"""Writes a BTLx file for machining of model parts."""
# flake8: noqa
import Grasshopper
import Rhino

from compas_timber.fabrication import BTLxWriter
from compas_timber.ghpython.ghcomponent_helpers import item_input_valid_cpython


class WriteBTLx(Grasshopper.Kernel.GH_ScriptInstance):
    def RunScript(self, model, path, write: bool):
        if not item_input_valid_cpython(ghenv, model, "Model"):
            return

        btlx = BTLxWriter(file_name=str(Rhino.RhinoDoc.ActiveDoc.Name))

        if write:
            if not item_input_valid_cpython(ghenv, path, "Path"):
                return
            XML = btlx.write(model, path)
        else:
            XML = btlx.model_to_xml(model)

        return XML
# ---------- end writebtlx ----------
# requires a textrue file mapped to layer
bakewithboxmap = CTBakeWithBoxMap(model=model.Model, Bake=Button())  # inputs map_size: list of Double, Bake: Boolean; disabled
#   port model: Model object (optional).
#   port map_size: Scaling of the BoxMap in x,y,z directions (list of three positive values) (optional).
#   port Bake: Set to True to Bake. Nothing happens if None or False.
# ---------- bakewithboxmap: Python ----------
# flake8: noqa
import math
import random

import Grasshopper
import System
import Rhino
import rhinoscriptsyntax as rs
from compas_rhino.conversions import frame_to_rhino
from compas_timber.ghpython.ghcomponent_helpers import item_input_valid_cpython

from Rhino import Render
from Rhino.Geometry import Interval
from Rhino.Geometry import Plane


class BakeBoxMap(Grasshopper.Kernel.GH_ScriptInstance):
    def RunScript(self,
            model,
            map_size: System.Collections.Generic.List[float],
            Bake: bool):
        if map_size and len(map_size) != 3:
            ghenv.Component.AddRuntimeMessage(
                Grasshopper.Kernel.GH_RuntimeMessageLevel.Error, "Input parameter MapSize requires exactly three float values (scale factors in x,y,z directions)"
            )
            return

        unit_system = Rhino.RhinoDoc.ActiveDoc.ModelUnitSystem

        if map_size:
            dimx, dimy, dimz = map_size
        else:
            # for the pine 251 material bitmap, rotated
            if unit_system == Rhino.UnitSystem.Meters:
                dimx = 0.2
                dimy = 0.2
                dimz = 1.0
            if unit_system == Rhino.UnitSystem.Centimeters:
                dimx = 20
                dimy = 20
                dimz = 100
            if unit_system == Rhino.UnitSystem.Millimeters:
                dimx = 200
                dimy = 200
                dimz = 1000

        if not item_input_valid_cpython(ghenv, model, "Model"):
            return

        if not Bake:
            return

        try:
            frames = [frame_to_rhino(b.frame) for b in model.beams]
            breps = [beam.geometry.native_brep for beam in model.beams]

            if frames and breps:
                rs.EnableRedraw(False)

                for brep, frame in zip(breps, frames):
                    guid = Rhino.RhinoDoc.ActiveDoc.Objects.Add(brep)
                    boxmap = self.create_box_map(frame, dimx, dimy, dimz)
                    Rhino.RhinoDoc.ActiveDoc.Objects.ModifyTextureMapping(guid, 1, boxmap)
        finally:
            rs.EnableRedraw(True)

    @staticmethod
    def create_box_map(pln, sx, sy, sz):
        """
        pln: frame of beam box, where x=main axis, y=width, z=height
        sx,sy,sz: box map size in x,y,z direction
        """

        v = pln.YAxis
        w = pln.ZAxis
        pt = pln.Origin

        # random deviation
        a = math.pi * 0.5
        randangle = (random.random() - 0.5) * a
        v.Rotate(randangle, pln.XAxis)

        b = math.pi * 0.01
        randangle = (random.random() - 0.5) * b
        w.Rotate(randangle, pln.XAxis)

        randpos = sx * random.random()
        pt += pln.XAxis * randpos

        # create box mapping
        mappingPln = Plane(pt, w, v)
        dx = Interval(-sx * 0.5, sx * 0.5)
        dy = Interval(-sy * 0.5, sy * 0.5)
        dz = Interval(-sz * 0.5, sz * 0.5)

        BoxMap = Render.TextureMapping.CreateBoxMapping(mappingPln, dx, dy, dz, False)

        return BoxMap
# ---------- end bakewithboxmap ----------
