# Grasshopper definition demo.gh (Grasshopper 1.0.7)
# Copyright: 2022

geometry_pipeline = GeometryPipeline(
    GroupByLayer=False,
    GroupByType=False,
    IncludeHidden=True,
    IncludeLocked=True,
    LayerFilter="CatA",
    NameFilter="*",
    SublayerFiltering=True,
    TypeFilter=4)
geometry_pipeline_2 = GeometryPipeline(
    GroupByLayer=False,
    GroupByType=False,
    IncludeHidden=True,
    IncludeLocked=True,
    LayerFilter="CatB",
    NameFilter="*",
    SublayerFiltering=True,
    TypeFilter=4)
reload_modules = ReloadModules(module_names="compas_timber", reload=Button())  # inputs module_names: list, reload: Boolean
# ---------- reload_modules: Python ----------
import sys
def unload_modules(top_level_module_name):
    #copied from: 
    #https://github.com/compas-dev/compas/blob/331c38bb843dba4b428a2cad59f3ef2115061086/src/compas_rhino/utilities/misc.py#L265
    
    """Unloads all modules named starting with the specified string.
    This function eases the development workflow when editing a library that is
    used from Rhino/Grasshopper.
    Parameters
    ----------
    top_level_module_name : :obj:`str`
        Name of the top-level module to unload.
    Returns
    -------
    list
        List of unloaded module names.
    """
    modules = filter(lambda m: m.startswith(top_level_module_name), sys.modules)

    for module in modules:
        sys.modules.pop(module)

    return modules


if reload:
    for module in module_names:
        unload_modules(module)
# ---------- end reload_modules ----------
jointtype_selection = JointTypeSelection({"T-Butt", "L-Butt", "L-Miter"}, selected="L-Butt")
jointtype_selection_2 = JointTypeSelection({"T-Butt", "L-Butt", "L-Miter"}, selected="L-Butt")

# ----
# define Joints by rules
# define Joints individually
jointtype_selection_3 = JointTypeSelection({"T-Butt", "L-Butt", "L-Miter"}, selected="L-Miter")
crv = Curve(<curve referenced from the Rhino model>)
crv_2 = Curve(<curve referenced from the Rhino model>)

# ----
# define other Features
panel = Panel("0")
plane = Plane(Plane(origin=(2.890523737, 2, 0), x=(-0.7577391191, 0.6525576047, 0), y=(0.08914476863, 0.1035134339, 0.9906251457)))

# ----
# create Beams
guid = Guid([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])
guid_2 = Guid([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])

jointcategoryrule = COMPAS_TIMBERJointCategoryRule(JointType=jointtype_selection, CatA="B", CatB="A")  # -> Rule
# ---------- jointcategoryrule: Python ----------
from ghpythonlib.componentbase import executingcomponent as component

from compas_timber.connections import LButtJoint
from compas_timber.connections import LMiterJoint
from compas_timber.connections import TButtJoint
from compas_timber.ghpython import CategoryRule


class JointCategoryRule(component):
    # TODO: auto fill with subclasses of Joint
    MAP = {"T-Butt": TButtJoint, "L-Miter": LMiterJoint, "L-Butt": LButtJoint}

    def RunScript(self, JointType, CatA, CatB):
        if JointType and CatA and CatB:
            return CategoryRule(self.MAP[JointType], CatA, CatB)
# ---------- end jointcategoryrule ----------
jointcategoryrule_2 = COMPAS_TIMBERJointCategoryRule(JointType=jointtype_selection_2, CatA="B", CatB="B")  # -> Rule; same code as jointcategoryrule
jointcategoryrule_3 = COMPAS_TIMBERJointCategoryRule(JointType=jointtype_selection_3, CatA="A", CatB="A")  # -> Rule; same code as jointcategoryrule
beamfromguid = COMPAS_TIMBERBeamFromCurveGuid(RefCenterline=guid, Width="0.06", Height="0.12", Category="A")  # -> Beam; inputs RefCenterline: list of Guid, ZVector: list of Vector3d, Width: list, Height: list, Category: list, updateRefObj: Boolean
#   port RefCenterline: Referenced curve or line, Guid of curve or line in the active Rhino document.
# ---------- beamfromguid: Python ----------
import Rhino
from compas_rhino.conversions import RhinoCurve
from compas_rhino.conversions import vector_to_compas
from ghpythonlib.componentbase import executingcomponent as component
from Grasshopper.Kernel.GH_RuntimeMessageLevel import Error
from Grasshopper.Kernel.GH_RuntimeMessageLevel import Warning

from compas_timber.ghpython.rhino_object_name_attributes import update_rhobj_attributes_name
from compas_timber.parts.beam import Beam as ctBeam


class Beam_fromCurveGuid(component):
    def RunScript(self, RefCenterline, ZVector, Width, Height, Category, updateRefObj):
        if not RefCenterline:
            self.AddRuntimeMessage(Warning, "Input parameter RefCenterline failed to collect data")
        if not Width:
            self.AddRuntimeMessage(Warning, "Input parameter Width failed to collect data")
        if not Height:
            self.AddRuntimeMessage(Warning, "Input parameter Height failed to collect data")

        if not (RefCenterline and Width and Height):
            # minimal required input
            return None

        ZVector = ZVector or [None]
        Category = Category or [None]

        if RefCenterline and Height and Height:
            # check list lengths for consistency
            N = len(RefCenterline)
            if len(ZVector) not in (0, 1, N):
                self.AddRuntimeMessage(
                    Error,
                    " In 'ZVector' I need either none, one or the same number of inputs as the refCrv parameter.",
                )
            if len(Width) not in (1, N):
                self.AddRuntimeMessage(
                    Error, " In 'Width' I need either one or the same number of inputs as the refCrv parameter."
                )
            if len(Height) not in (1, N):
                self.AddRuntimeMessage(
                    Error, " In 'Height' I need either one or the same number of inputs as the refCrv parameter."
                )
            if len(Category) not in (0, 1, N):
                self.AddRuntimeMessage(
                    Error,
                    " In 'Category' I need either none, one or the same number of inputs as the refCrv parameter.",
                )

        # match number of elemets to number of curves
        if len(ZVector) != N:
            ZVector = [ZVector[0]] * N
        if len(Width) != N:
            Width = [Width[0]] * N
        if len(Height) != N:
            Height = [Height[0]] * N
        if len(Category) != N:
            Category = [Category[0]] * N

        beams = []
        for guid, z, w, h, c in zip(RefCenterline, ZVector, Width, Height, Category):
            curve = RhinoCurve.from_object(Rhino.RhinoDoc.ActiveDoc.Objects.FindId(guid))
            line = curve.to_compas_line()
            if z:
                z = vector_to_compas(z)
            beam = ctBeam.from_centerline(line, w, h, z_vector=z)
            beam.attributes["rhino_guid"] = str(guid)
            beam.attributes["category"] = c

            if updateRefObj:
                update_rhobj_attributes_name(guid, "width", str(w))
                update_rhobj_attributes_name(guid, "height", str(h))
                update_rhobj_attributes_name(guid, "zvector", str(list(beam.frame.zaxis)))
                update_rhobj_attributes_name(guid, "category", c)

            beams.append(beam)
        Beam = beams
        return Beam
# ---------- end beamfromguid ----------
beamfromguid_2 = COMPAS_TIMBERBeamFromCurveGuid(RefCenterline=guid_2, Width="0.06", Height="0.12", Category="B", updateRefObj=Toggle(False))  # -> Beam; inputs RefCenterline: list of Guid, ZVector: list of Vector3d, Width: list, Height: list, Category: list, updateRefObj: Boolean; same code as beamfromguid
relay = Relay([beamfromguid, beamfromguid_2])
findbeambyrhinoguid = COMPAS_TIMBERFindBeamByRhinoGuid(Beams=relay, Guid=crv)  # -> FoundBeam; inputs Beams: list, Guid: list of Guid
#   port Beams: A list of Beams.
# ---------- findbeambyrhinoguid: Python ----------
from ghpythonlib.componentbase import executingcomponent as component
from Grasshopper.Kernel.GH_RuntimeMessageLevel import Warning


class FindBeamByRhinoGuid(component):
    def RunScript(self, Beams, Guid):
        if not (Beams and Guid):
            return

        if not isinstance(Guid, list):
            Guid = [Guid]
        Guid = [str(g) for g in Guid]
        FoundBeam = []
        for beam in Beams:
            if beam.attributes.get("rhino_guid", None) in Guid:
                FoundBeam.append(beam)

        if not FoundBeam:
            self.AddRuntimeMessage(Warning, "No beams found!")

        return FoundBeam
# ---------- end findbeambyrhinoguid ----------
findbeambyrhinoguid_2 = COMPAS_TIMBERFindBeamByRhinoGuid(Beams=relay, Guid=crv_2)  # -> FoundBeam; inputs Beams: list, Guid: list of Guid; same code as findbeambyrhinoguid
item = ListItem(List=relay, Index=panel, Wrap=True)
trim_feature = COMPAS_TIMBERTrimFeature(Beam=item, Plane=plane)  # -> Feature; inputs Beam: list, Plane: list of Plane
#   port Beam: Beam(s) to trim.
# ---------- trim_feature: Python ----------
from compas_rhino.conversions import plane_to_compas_frame
from ghpythonlib.componentbase import executingcomponent as component
from Grasshopper.Kernel.GH_RuntimeMessageLevel import Warning

from compas_timber.ghpython import FeatureDefinition
from compas_timber.parts import BeamTrimmingFeature


class TrimmingFeature(component):
    def RunScript(self, Beam, Plane):
        if not Beam:
            self.AddRuntimeMessage(Warning, "Input parameter Beam failed to collect data")
        if not Plane:
            self.AddRuntimeMessage(Warning, "Input parameter Plane failed to collect data")
        if not (Beam and Plane):
            return

        if not isinstance(Beam, list):
            Beam = [Beam]
        if not isinstance(Plane, list):
            Plane = [Plane]

        Feature = []
        for plane in Plane:
            feature = BeamTrimmingFeature(plane_to_compas_frame(plane))
            Feature.append(FeatureDefinition(feature, Beam))

        return Feature
# ---------- end trim_feature ----------
automaticjoints = COMPAS_TIMBERAutomaticJoints(Beams=relay, Rules=[jointcategoryrule_3, jointcategoryrule, jointcategoryrule_2])  # -> Joints, Info; inputs Beams: list, Rules: list
#   port Beams: Collection of Beams.
# ---------- automaticjoints: Python ----------
from ghpythonlib.componentbase import executingcomponent as component
from Grasshopper.Kernel.GH_RuntimeMessageLevel import Warning

from compas_timber.connections import ConnectionSolver
from compas_timber.connections import JointTopology
from compas_timber.ghpython import JointDefinition


class AutotomaticJoints(component):
    def RunScript(self, Beams, Rules, MaxDistance):
        if not Beams:
            self.AddRuntimeMessage(Warning, "Input parameter Beams failed to collect data")
        if not Rules:
            self.AddRuntimeMessage(Warning, "Input parameter Rules failed to collect data")
        if not (Beams and Rules):
            return

        if not isinstance(Rules, list):
            Rules = [Rules]
        rules = [r for r in Rules if r is not None]

        solver = ConnectionSolver()
        found_pairs = solver.find_intersecting_pairs(Beams, rtree=True, max_distance=MaxDistance)
        Joints = []
        Info = []
        # rules have to be resolved into joint definitions
        for pair in found_pairs:
            beam_a, beam_b = pair
            detected_topo, beam_a, beam_b = solver.find_topology(beam_a, beam_b, max_distance=MaxDistance)

            if detected_topo == JointTopology.TOPO_UNKNOWN:
                continue

            for rule in rules:
                if not rule.comply(pair):
                    continue
                if rule.joint_type.SUPPORTED_TOPOLOGY != detected_topo:
                    msg = "Conflict detected! Beams: {}, {} meet with topology: {} but rule assigns: {}"
                    Info.append(
                        msg.format(beam_a, beam_b, JointTopology.get_name(detected_topo), rule.joint_type.__name__)
                    )
                    continue
                # sort by category to allow beam role by order (main beam first, cross beam second)
                beam_a, beam_b = rule.reorder([beam_a, beam_b])
                Joints.append(JointDefinition(rule.joint_type, [beam_a, beam_b]))
                break  # first matching rule

        return Joints, Info
# ---------- end automaticjoints ----------
jointdef_l_butt = COMPAS_TIMBERJointDefLButt(MainBeam=findbeambyrhinoguid, CrossBeam=findbeambyrhinoguid_2)  # -> Joint; inputs MainBeam: list, CrossBeam: list
#   port MainBeam: First (main) Beam.
# ---------- jointdef_l_butt: Python ----------
from ghpythonlib.componentbase import executingcomponent as component
from Grasshopper.Kernel.GH_RuntimeMessageLevel import Error
from Grasshopper.Kernel.GH_RuntimeMessageLevel import Warning

from compas_timber.connections import ConnectionSolver
from compas_timber.connections import LButtJoint
from compas_timber.connections import JointTopology
from compas_timber.ghpython import JointDefinition


class LButtDefinition(component):
    def RunScript(self, MainBeam, CrossBeam):
        if not MainBeam:
            self.AddRuntimeMessage(Warning, "Input parameter MainBeams failed to collect data.")
        if not CrossBeam:
            self.AddRuntimeMessage(Warning, "Input parameter CrossBeams failed to collect data.")
        if not (MainBeam and CrossBeam):
            return
        if not isinstance(MainBeam, list):
            MainBeam = [MainBeam]
        if not isinstance(CrossBeam, list):
            CrossBeam = [CrossBeam]
        if len(MainBeam) != len(CrossBeam):
            self.AddRuntimeMessage(Error, "Number of items in MainBeams and CrossBeams must match!")
            return

        Joint = []
        for main, cross in zip(MainBeam, CrossBeam):
            topology, _, _ = ConnectionSolver().find_topology(main, cross)
            if topology != LButtJoint.SUPPORTED_TOPOLOGY:
                self.AddRuntimeMessage(
                    Warning,
                    "Beams meet with topology: {} which does not agree with joint of type: {}".format(
                        JointTopology.get_name(topology), LButtJoint.__name__
                    ),
                )
                continue
            Joint.append(JointDefinition(LButtJoint, [main, cross]))
        return Joint
# ---------- end jointdef_l_butt ----------
showbeamframe = COMPAS_TIMBERShowBeamFrame(Beam=relay)  # inputs Beam: list
# ---------- showbeamframe: Python ----------
# flake8: noqa
import Rhino.Geometry as rg
import System
from compas_rhino.conversions import frame_to_rhino
from ghpythonlib.componentbase import executingcomponent as component


class ShowBeamFrame(component):
    def RunScript(self, Beam):
        self.frame = [frame_to_rhino(b.frame) for b in Beam]
        self.scale = [b.width + b.height for b in Beam]

    def DrawViewportWires(self, arg):
        if self.Locked:
            return

        colorX = System.Drawing.Color.FromArgb(255, 255, 100, 100)
        colorY = System.Drawing.Color.FromArgb(200, 50, 220, 100)
        colorZ = System.Drawing.Color.FromArgb(200, 50, 150, 255)
        screensize = 10
        relativesize = 0

        for f, s in zip(self.frame, self.scale):
            arg.Display.DrawArrow(rg.Line(f.Origin, f.XAxis * s), colorX, screensize, relativesize)
            arg.Display.DrawArrow(rg.Line(f.Origin, f.YAxis * s), colorY, screensize, relativesize)
            arg.Display.DrawArrow(rg.Line(f.Origin, f.ZAxis * s), colorZ, screensize, relativesize)

            arg.Display.Draw2dText("X", colorX, f.Origin + f.XAxis * s * 1.1, True, 16, "Verdana")
            arg.Display.Draw2dText("Y", colorY, f.Origin + f.YAxis * s * 1.1, True, 16, "Verdana")
            arg.Display.Draw2dText("Z", colorZ, f.Origin + f.ZAxis * s * 1.1, True, 16, "Verdana")
# ---------- end showbeamframe ----------
showbeam = COMPAS_TIMBERShowBeam(Beam=relay)  # -> Box; inputs Beam: list
#   port Box: Box representing the original shape of the Beam.
# ---------- showbeam: Python ----------
"""Shows the original shape of the Beam."""
# flake8: noqa
from compas_rhino.conversions import box_to_rhino

from compas_timber.ghpython.ghcomponent_helpers import list_input_valid

if list_input_valid(ghenv.Component, Beam, "Beam"):
    Box = [box_to_rhino(b.shape) for b in Beam]
# ---------- end showbeam ----------
merge = Merge(Data1=flatten(automaticjoints.Joints), Data2=flatten(jointdef_l_butt))

# ----
# create Assembly
# apply Joints & Features
toggle = BooleanToggle(True)

assembly = COMPAS_TIMBERAssembly(Beams=relay, Joints=flatten(merge), Features=trim_feature, applyFeatures=toggle)  # -> Assembly, Errors; inputs Beams: list, Joints: list, Features: list, applyFeatures: Boolean
#   port Beams: Collection of Beams
# ---------- assembly: Python ----------
from ghpythonlib.componentbase import executingcomponent as component
from Grasshopper.Kernel.GH_RuntimeMessageLevel import Warning

from compas_timber.assembly import TimberAssembly


class Assembly(component):
    def __init__(self):
        # maintains relationship of old_beam.id => new_beam_obj for referencing
        # lets us modify copies of the beams while referencing them using their old identities.
        self._beam_map = {}

    def _get_copied_beams(self, old_beams):
        """For the given old_beams returns their respective copies."""
        new_beams = []
        for beam in old_beams:
            new_beams.append(self._beam_map[id(beam)])
        return new_beams

    def RunScript(self, Beams, Joints, Features, applyFeatures):
        if not Beams:
            self.AddRuntimeMessage(Warning, "Input parameter 'Beams' failed to collect data")
            return

        Assembly = TimberAssembly()
        self._beam_map = {}
        beams = [b for b in Beams if b is not None]
        for beam in beams:
            c_beam = beam.copy()
            Assembly.add_beam(c_beam)
            self._beam_map[id(beam)] = c_beam
        beams = Assembly.beams

        if Joints:
            handled_beams = []
            joints = [j for j in Joints if j is not None]
            # apply reversed. later joints in orginal list override ealier ones
            for joint in joints[::-1]:
                beams_to_pair = self._get_copied_beams(joint.beams)
                beam_pair_ids = set([id(beam) for beam in beams_to_pair])
                if beam_pair_ids in handled_beams:
                    continue
                joint.joint_type.create(Assembly, *beams_to_pair)
                handled_beams.append(beam_pair_ids)

        Errors = []

        if Features:
            features = [f for f in Features if f is not None]
            for f_def in features:
                beams_to_modify = self._get_copied_beams(f_def.beams)
                for beam in beams_to_modify:
                    beam.add_feature(f_def.feature)
        if applyFeatures:
            for beam in Assembly.beams:
                Errors.extend(beam.apply_features())

        return Assembly, Errors
# ---------- end assembly ----------
showassembly = COMPAS_TIMBERShowAssembly(Assembly=assembly.Assembly)  # -> Brep
#   port Assembly: Assembly object.
# ---------- showassembly: Python ----------
from compas.artists import Artist
from ghpythonlib.componentbase import executingcomponent as component
from Grasshopper.Kernel.GH_RuntimeMessageLevel import Warning


class ShowAssembly(component):
    def RunScript(self, Assembly):
        if not Assembly:
            self.AddRuntimeMessage(Warning, "Input parameter Assembly failed to collect data")
            return
        Assembly = Assembly.copy()  # we're gonna be making changes to upstream objects

        Brep = []
        for beam in Assembly.beams:
            Brep.append(Artist(beam.get_geometry(True)).draw())

        return Brep
# ---------- end showassembly ----------
showbeamindex = COMPAS_TIMBERShowBeamIndex(Assembly=assembly.Assembly)
#   port Assembly: Assembly object.
# ---------- showbeamindex: Python ----------
# flake8: noqa
import System
from compas_rhino.conversions import point_to_rhino
from ghpythonlib.componentbase import executingcomponent as component


class ShowBeamIndex(component):
    def RunScript(self, Assembly):
        self.pt = []
        self.txt = []

        if not Assembly:
            return None
        for beam in Assembly.beams:
            self.pt.append(point_to_rhino(beam.midpoint))
            self.txt.append(str(beam.key))

    def DrawViewportWires(self, arg):
        if self.Locked:
            return
        col = System.Drawing.Color.FromArgb(255, 255, 255, 255)
        # https://developer.rhino3d.com/api/RhinoCommon/html/M_Rhino_Display_DisplayPipeline_Draw2dText_5.htm
        for p, t in zip(self.pt, self.txt):
            arg.Display.Draw2dText(t, col, p, True, 16, "Verdana")
# ---------- end showbeamindex ----------
showjointtypes = COMPAS_TIMBERShowJointTypes(Assembly=assembly.Assembly)
#   port Assembly: Assembly object.
# ---------- showjointtypes: Python ----------
# flake8: noqa
import System
from compas_rhino.conversions import point_to_rhino
from ghpythonlib.componentbase import executingcomponent as component

from compas_timber.utils.compas_extra import intersection_line_line_3D


class ShowJointTypes(component):
    def RunScript(self, Assembly):
        self.pt = []
        self.txt = []

        if not Assembly:
            return

        for joint in Assembly.joints:
            line_a, line_b = joint.beams[0].centerline, joint.beams[1].centerline
            [p1, t1], [p2, t2] = intersection_line_line_3D(line_a, line_b, float("inf"), False, 1e-3)
            p1 = point_to_rhino(p1)
            p2 = point_to_rhino(p2)

            self.pt.append((p2 + p1) / 2)
            self.txt.append(joint.joint_type)

    def DrawViewportWires(self, arg):
        if self.Locked:
            return
        col = System.Drawing.Color.FromArgb(255, 0, 0, 0)
        # https://developer.rhino3d.com/api/RhinoCommon/html/M_Rhino_Display_DisplayPipeline_Draw2dText_5.htm
        for p, t in zip(self.pt, self.txt):
            arg.Display.Draw2dText(t, col, p, True, 12, "Verdana")
# ---------- end showjointtypes ----------
bakewithboxmap = COMPAS_TIMBERBakeWithBoxMap(Assembly=assembly.Assembly, Bake=Button())  # inputs Beam: list, MapSize: list, Bake: Boolean
#   port Assembly: Assembly object (optional).
# ---------- bakewithboxmap: Python ----------
# flake8: noqa
import math
import random

import Rhino
import Rhino.Geometry as rg
import rhinoscriptsyntax as rs
from compas.artists import Artist
from compas_rhino.conversions import frame_to_rhino
from Grasshopper.Kernel.GH_RuntimeMessageLevel import Error
from Grasshopper.Kernel.GH_RuntimeMessageLevel import Warning


def create_box_map(pln, sx, sy, sz):
    """
    pln: frame of beam box, where x=main axis, y=width, z=height
    sx,sy,sz: box map size in x,y,z direction
    """

    v = pln.YAxis
    w = pln.ZAxis
    pt = pln.Origin

    # random deviation
    a = math.pi * 0.5
    randangle = (random.random() - 0.5) * a
    v.Rotate(randangle, pln.XAxis)

    b = math.pi * 0.01
    randangle = (random.random() - 0.5) * b
    w.Rotate(randangle, pln.XAxis)

    randpos = sx * random.random()
    pt += pln.XAxis * randpos

    # create box mapping
    mappingPln = rg.Plane(pt, w, v)
    dx = rg.Interval(-sx * 0.5, sx * 0.5)
    dy = rg.Interval(-sy * 0.5, sy * 0.5)
    dz = rg.Interval(-sz * 0.5, sz * 0.5)

    BoxMap = Rhino.Render.TextureMapping.CreateBoxMapping(mappingPln, dx, dy, dz, False)

    return BoxMap, mappingPln


if not MapSize:
    # for the pine 251 material bitmap, rotated
    dimx = 0.2
    dimy = 0.2
    dimz = 1.0

elif len(MapSize) != 3:
    ghenv.Component.AddRuntimeMessage(
        Error, "Input parameter MapSize requires exactly three float values (scale factors in x,y,z directions)"
    )
else:
    dimx, dimy, dimz = MapSize

Beams = Beam  # Beam is a list of Beams or an empty list
if Assembly:
    Beams.extend(Assembly.beams)

if not Beams:
    ghenv.Component.AddRuntimeMessage(Warning, "Input parameters Assembly and Beam failed to collect any Beam objects.")
    _inputok = False
else:
    _inputok = True

try:
    if _inputok and Bake:
        frames = [frame_to_rhino(b.frame) for b in Beam]
        breps = [Artist(b.get_geometry(True)).draw() for b in Beam]

        if frames and breps:
            rs.EnableRedraw(False)
            rhino_doc = Rhino.RhinoDoc.ActiveDoc

            for brep, frame in zip(breps, frames):
                attributes = None
                guid = rhino_doc.Objects.Add(brep, attributes)
                boxmap, map_pln = create_box_map(frame, dimx, dimy, dimz)
                rhino_doc.Objects.ModifyTextureMapping(guid, 1, boxmap)
finally:
    rs.EnableRedraw(True)
    rs.Redraw()
# ---------- end bakewithboxmap ----------
