# Grasshopper definition test_pocket.ghx (Grasshopper 1.0.7)

# ---- group: LINE MODEL
crv = Curve([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])

# ----
data = Data(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)
scale = Scale(Geometry=crv, Center=Point(0, 0, 0), Factor=Slider(1000, range=0..1000))  # -> Geometry, Transform
transform = Transform(Geometry=data, Transform=scale.Transform)

# ---- group: quick srf normals
midpt = CurveMiddle(Curve=scale.Geometry)
meshcp = MeshClosestPoint(Point=midpt, Mesh=transform)  # -> Point, Index, Parameter
meval = MeshEval(Mesh=transform, Parameter=meshcp.Parameter)  # -> Point, Normal, Colour

# ----
number_slider = Slider(2, range=0..71)
number_slider_2 = Slider(10, range=0..71)
crv_2 = Curve(scale.Geometry)
vec = Vector(meval.Normal)
beam = CTBeam(Centerline=crv_2, ZVector=vec, Width=Slider(40, range=0..100), Height=Slider(60, range=0..100))  # -> Beam, Blank; inputs Centerline: list, ZVector: list of Vector3d, Width: list, Height: list, Category: list, updateRefObj: Boolean
#   port Centerline: Referenced curve or line, Guid of curve or line in the active Rhino document.
#   port ZVector: Vector defining the orientation of the cross-section (corresponds to the height dimension). If None, a default will be taken.
#   port Width: Width of the cross-section (usually the smaller dimension).
#   port Height: Height of the cross-section (usually the larger dimension).
#   port Category: Category of a beam.
#   port updateRefObj: (optional) If True, the attributes in the referenced object will be updated/overwritten with the new values given here.
#   port Beam: Beam object(s).
#   port Blank: Shape of the beam's blank.
# ---------- beam: Python ----------
"""Creates a Beam from a LineCurve."""

import rhinoscriptsyntax as rs
from compas.scene import Scene
from compas_rhino.conversions import line_to_compas
from compas_rhino.conversions import vector_to_compas
from ghpythonlib.componentbase import executingcomponent as component
from Grasshopper.Kernel.GH_RuntimeMessageLevel import Error
from Grasshopper.Kernel.GH_RuntimeMessageLevel import Warning
from Rhino.RhinoDoc import ActiveDoc

from compas_timber.elements import Beam as CTBeam
from compas_timber.ghpython.rhino_object_name_attributes import update_rhobj_attributes_name


class Beam_fromCurve(component):
    def RunScript(self, centerline, z_vector, width, height, category, updateRefObj):
        # minimum inputs required
        if not centerline:
            self.AddRuntimeMessage(Warning, "Input parameter 'Centerline' failed to collect data")
        if not width:
            length = self._get_centerline_length(centerline)
            width = [length / 20]
        if not height:
            length = self._get_centerline_length(centerline)
            height = [length / 10]

        # reformat unset parameters for consistency
        if not z_vector:
            z_vector = [None]
        if not category:
            category = [None]

        beams = []
        blanks = []
        scene = Scene()

        if centerline and height and width:
            # check list lengths for consistency
            N = len(centerline)
            if len(z_vector) not in (0, 1, N):
                self.AddRuntimeMessage(Error, " In 'ZVector' I need either none, one or the same number of inputs as the Crv parameter.")
            if len(width) not in (1, N):
                self.AddRuntimeMessage(Error, " In 'W' I need either one or the same number of inputs as the Crv parameter.")
            if len(height) not in (1, N):
                self.AddRuntimeMessage(Error, " In 'H' I need either one or the same number of inputs as the Crv parameter.")
            if len(category) not in (0, 1, N):
                self.AddRuntimeMessage(Error, " In 'Category' I need either none, one or the same number of inputs as the Crv parameter.")

            # duplicate data if None or single value
            if len(z_vector) != N:
                z_vector = [z_vector[0] for _ in range(N)]
            if len(width) != N:
                width = [width[0] for _ in range(N)]
            if len(height) != N:
                height = [height[0] for _ in range(N)]
            if len(category) != N:
                category = [category[0] for _ in range(N)]

            for line, z, w, h, c in zip(centerline, z_vector, width, height, category):
                guid, geometry = self._get_guid_and_geometry(line)
                rhino_line = rs.coerceline(geometry)
                line = line_to_compas(rhino_line)

                z = vector_to_compas(z) if z else None
                beam = CTBeam.from_centerline(centerline=line, width=w, height=h, z_vector=z)
                beam.attributes["rhino_guid"] = str(guid) if guid else None
                beam.attributes["category"] = c
                if updateRefObj and guid:
                    update_rhobj_attributes_name(guid, "width", str(w))
                    update_rhobj_attributes_name(guid, "height", str(h))
                    update_rhobj_attributes_name(guid, "zvector", str(list(beam.frame.zaxis)))
                    update_rhobj_attributes_name(guid, "category", c)

                beams.append(beam)
                scene.add(beam.blank)

        blanks = scene.draw()

        return beams, blanks

    def _get_guid_and_geometry(self, line):
        # internalized curves and GH geometry will not have persistent GUIDs, referenced Rhino objects will
        # type hint on the input has to be 'ghdoc' for this to work
        guid = None
        geometry = line
        rhino_obj = ActiveDoc.Objects.FindId(line)
        if rhino_obj:
            guid = line
            geometry = rhino_obj.Geometry
        return guid, geometry

    def _get_centerline_length(self, centerline):
        centerline_length = []
        for i in centerline:
            centerline_length.append(rs.CurveLength(i))
        if centerline_length:
            length_average = sum(centerline_length) / len(centerline_length)
        else:
            length_average = 1
        return length_average
# ---------- end beam ----------
item = ListItem(List=vec, Index=[number_slider, number_slider_2], Wrap=True)
item_2 = ListItem(List=crv_2, Index=[number_slider, number_slider_2], Wrap=True)
dispatch = Dispatch(List=item, DispatchPattern=[True, False])  # -> ListA, ListB
dispatch_2 = Dispatch(List=item_2, DispatchPattern=[True, False])  # -> ListA, ListB
item_3 = ListItem(List=item, Index=0, Wrap=True)
end = EndPoints(Curve=item_3)  # -> Start, End
crv_3 = Curve([<curve referenced from the Rhino model> x2])

# ---- group: cross
crv_4 = Curve(dispatch_2.ListB)

# ---- group: main
crv_5 = Curve(dispatch_2.ListA)

# ----
pt = Point(end.Start)
dispatch_3 = Dispatch(List=crv_3, DispatchPattern=[True, False])  # -> ListA, ListB
pt_2 = Point(Point(-687.7030116, -710.9456494, 2203.177184))
pln = Plane(Plane(origin=(-687.7030116, -710.9456494, 2203.177184), x=(0.1267757701, -0.9813657223, -0.1443926011), y=(0.990494813, 0.1174122281, 0.07165468693)))
line = Line(Line((-687.7030116, -710.9456494, 2203.177184), (-682.0366333, -756.5378027, 2198.425776)))
beam_2 = CTBeam(Centerline=crv_5, ZVector=dispatch.ListA, Width=Slider(40, range=0..100), Height=Slider(60, range=0..100))  # -> Beam, Blank; inputs Centerline: list, ZVector: list of Vector3d, Width: list, Height: list, Category: list, updateRefObj: Boolean; same code as beam
beam_3 = CTBeam(Centerline=crv_4, ZVector=dispatch.ListB, Width=Slider(40, range=0..100), Height=Slider(60, range=0..100))  # -> Beam, Blank; inputs Centerline: list, ZVector: list of Vector3d, Width: list, Height: list, Category: list, updateRefObj: Boolean; same code as beam
end_2 = EndPoints(Curve=crv_4)  # -> Start, End
crv_6 = Curve([<curve referenced from the Rhino model> x2])
angle = Angle(VectorA=dispatch_3.ListA, VectorB=dispatch_3.ListB, Plane=pln)  # -> Angle, Reflex; disabled
pl = PlaneNormal(Origin=pt_2, ZAxis=line)  # disabled
pt_3 = Point(end_2.Start)
project = Project(Geometry=crv_6, Plane=pl)  # -> Geometry, Transform; disabled
deg = Degrees(Radians=angle.Angle)  # disabled
dispatch_4 = Dispatch(List=project.Geometry, DispatchPattern=[True, False])  # -> ListA, ListB; disabled
angle_2 = Angle(VectorA=dispatch_4.ListA, VectorB=dispatch_4.ListB)  # -> Angle, Reflex; disabled
deg_2 = Degrees(Radians=angle_2.Angle)  # disabled
panel = Panel(deg_2)  # disabled

# ---- group: cross
crv_7 = Curve(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)

# ----
python = GhPythonScript(cross_beam=beam_2.Beam, main_beam=beam_3.Beam)  # -> out, neg_vols, mesh_vols, main_geo, cross_geo, main_params, pocket_volume, pocket_volume_cross, planes; disabled
# ---------- python: Python ----------
from compas_rhino import unload_modules
from compas_rhino.conversions import plane_to_rhino, frame_to_rhino
from compas_timber.connections import XLapJoint, LapJoint
from compas_timber.fabrication import Lap, Pocket
from compas.geometry import Frame, Brep, Plane, angle_vectors, intersection_plane_plane_plane, Line, Polyhedron, convex_hull

unload_modules('compas_timber')

lap = LapJoint(main_beam, cross_beam)
neg_vols = lap._create_negative_volumes()
mesh_vols = [neg_vol.to_mesh() for neg_vol in neg_vols]
print(neg_vols[0].vertices)

mesh_main = neg_vols[0].to_mesh()
mesh_cross = neg_vols[1].to_mesh()

pocket_main = Pocket.from_volume_and_beam(mesh_main, main_beam, lap.main_ref_side_index)
main_geo = pocket_main.apply(main_beam.geometry,main_beam)
main_params = pocket_main.params_dict
print(main_params)
#pocket_volume = pocket.volume_from_params_and_beam(main_beam)

pocket_cross = Pocket.from_volume_and_beam(mesh_cross, cross_beam, lap.cross_ref_side_index)
cross_geo = pocket_cross.apply(cross_beam.geometry, cross_beam)
#pocket_volume_cross = pocket_cross.volume_from_params_and_beam(cross_beam)
# ---------- end python ----------
number_slider_3 = Slider(20, range=0..100)  # disabled
x_topo_joint = CTXTopologicalJointRules()  # -> XLapJoint; disabled
#   port flip_lap_side: flip_lap_side
# ---------- x_topo_joint: Python ----------
import inspect

from ghpythonlib.componentbase import executingcomponent as component
from Grasshopper.Kernel.GH_RuntimeMessageLevel import Warning

from compas_timber.connections import Joint
from compas_timber.connections import JointTopology
from compas_timber.connections import XLapJoint
from compas_timber.design import TopologyRule
from compas_timber.ghpython.ghcomponent_helpers import get_leaf_subclasses
from compas_timber.ghpython.ghcomponent_helpers import manage_dynamic_params
from compas_timber.ghpython.ghcomponent_helpers import rename_gh_output


class X_TopologyJointRule(component):
    def __init__(self):
        super(X_TopologyJointRule, self).__init__()
        self.classes = {}
        for cls in get_leaf_subclasses(Joint):
            supported_topo = cls.SUPPORTED_TOPOLOGY
            if not isinstance(supported_topo, list):
                supported_topo = [supported_topo]
            if JointTopology.TOPO_X in supported_topo:
                self.classes[cls.__name__] = cls
        if ghenv.Component.Params.Output[0].NickName == "Rule":
            self.joint_type = XLapJoint
            self.clicked = False
        else:
            self.joint_type = self.classes.get(ghenv.Component.Params.Output[0].NickName, None)
            self.clicked = True

    def RunScript(self, *args):
        if not self.clicked:
            ghenv.Component.Message = "Default: XLapJoint"
            self.AddRuntimeMessage(Warning, "XLapJoint is default, change in context menu (right click)")
            return TopologyRule(JointTopology.TOPO_X, XLapJoint)
        else:
            ghenv.Component.Message = self.joint_type.__name__
            kwargs = {}
            for i, val in enumerate(args):
                if val is not None:
                    kwargs[self.arg_names()[i]] = val
            supported_topo = self.joint_type.SUPPORTED_TOPOLOGY
            if not isinstance(supported_topo, list):
                supported_topo = [supported_topo]
            if JointTopology.TOPO_X not in supported_topo:
                self.AddRuntimeMessage(Warning, "Joint type does not match topology. Joint may not be generated.")
            return TopologyRule(JointTopology.TOPO_X, self.joint_type, **kwargs)

    def arg_names(self):
        names = inspect.getargspec(self.joint_type.__init__)[0][3:]
        return [name for name in names if (name != "key") and (name != "frame")]

    def AppendAdditionalMenuItems(self, menu):
        for name in self.classes.keys():
            item = menu.Items.Add(name, None, self.on_item_click)
            if self.joint_type and name == self.joint_type.__name__:
                item.Checked = True

    def on_item_click(self, sender, event_info):
        self.clicked = True
        self.joint_type = self.classes[str(sender)]
        rename_gh_output(self.joint_type.__name__, 0, ghenv)
        manage_dynamic_params(self.arg_names(), ghenv, rename_count=0, permanent_param_count=0)
        ghenv.Component.ExpireSolution(True)
# ---------- end x_topo_joint ----------
python_2 = GhPythonScript(cross_beam=beam_2.Beam, main_beam=beam_3.Beam)  # -> out, neg_vols, mesh_main, main_geo, cross_geo, main_params, pocket_volume, pocket_volume_cross, planes; disabled
# ---------- python_2: Python ----------
from compas_rhino import unload_modules
from compas_rhino.conversions import plane_to_rhino, frame_to_rhino
from compas_timber.connections import XLapJoint, LapJoint
from compas_timber.fabrication import Lap, Pocket
from compas.geometry import Frame, Brep, Plane, angle_vectors, intersection_plane_plane_plane, Line, Polyhedron, convex_hull

unload_modules('compas_timber')

lap = LapJoint(main_beam, cross_beam)
neg_vols = lap._create_negative_volumes()
mesh_vols = [neg_vol.to_mesh() for neg_vol in neg_vols]

mesh_main = neg_vols[0].to_mesh()
mesh_cross = neg_vols[1].to_mesh()

pocket_main = Pocket.from_volume_and_beam(mesh_main, main_beam, lap.main_ref_side_index)
main_geo = pocket_main.apply(main_beam.geometry,main_beam)
main_params = pocket_main.params_dict
print(main_params)
#pocket_volume = pocket.volume_from_params_and_beam(main_beam)

pocket_cross = Pocket.from_volume_and_beam(mesh_cross, cross_beam, lap.cross_ref_side_index)
cross_geo = pocket_cross.apply(cross_beam.geometry, cross_beam)
#pocket_volume_cross = pocket_cross.volume_from_params_and_beam(cross_beam)


# get ref_side, and ref_edge from the beam
ref_side = main_beam.ref_sides[lap.main_ref_side_index]

# get planes from volume
# Extract planes from the volume
planes = [mesh_main.face_plane(i) for i in range(mesh_main.number_of_faces())]
# sort the planes based on the reference side
planes = [plane_to_rhino(plane) for plane in pocket_main._sort_planes(planes, ref_side)]
# ---------- end python_2 ----------

# ---- group: main
crv_8 = Curve([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])

# ----
panel_2 = Panel(python_2.out)  # disabled
toggle = BooleanToggle(True)  # disabled
merge = Merge(Data1=beam_2.Beam, Data2=beam_3.Beam)  # disabled
number_slider_4 = Slider(60, range=0..100)  # disabled
number_slider_5 = Slider(5, range=0..5)  # disabled
number_slider_6 = Slider(40, range=0..100)  # disabled
xprod = CrossProduct(VectorA=crv_8, VectorB=crv_7, Unitize=False)  # -> Vector, Length; disabled
number_slider_7 = Slider(60, range=0..100)  # disabled
number_slider_8 = Slider(40, range=0..100)  # disabled
model = CTModel(Elements=flatten(merge), JointRules=flatten(x_topo_joint), MaxDistance=number_slider_3, CreateGeometry=toggle)  # -> Model, Geometry, DebugInfo; inputs Elements: list, JointRules: list, Features: list, CreateGeometry: Boolean; disabled
#   port Elements: Collection of Beams
# ---------- model: Python ----------
from compas.scene import Scene
from compas.tolerance import TOL
from ghpythonlib.componentbase import executingcomponent as component
from Grasshopper.Kernel.GH_RuntimeMessageLevel import Warning

from compas_timber.connections import JointTopology
from compas_timber.connections import LMiterJoint
from compas_timber.connections import TButtJoint
from compas_timber.connections import XLapJoint
from compas_timber.design import DebugInfomation
from compas_timber.design import JointRule
from compas_timber.elements import Beam
from compas_timber.elements import Plate
from compas_timber.model import TimberModel

JOINT_DEFAULTS = {
    JointTopology.TOPO_X: XLapJoint,
    JointTopology.TOPO_T: TButtJoint,
    JointTopology.TOPO_L: LMiterJoint,
}

# workaround for https://github.com/gramaziokohler/compas_timber/issues/280
TOL.absolute = 1e-6


class ModelComponent(component):
    def RunScript(self, Elements, JointRules, Features, MaxDistance, CreateGeometry):
        if not Elements:
            self.AddRuntimeMessage(Warning, "Input parameter Beams failed to collect data")
        if not JointRules:
            self.AddRuntimeMessage(Warning, "Input parameter JointRules failed to collect data")
        if not (Elements):  # shows beams even if no joints are found
            return
        if MaxDistance is None:
            MaxDistance = TOL.ABSOLUTE  # compared to calculted distance, so shouldn't be just 0.0

        Model = TimberModel()
        debug_info = DebugInfomation()
        for element in Elements:
            # prepare elements for downstream processing
            element.reset()
            Model.add_element(element)

        joints, unmatched_pairs = JointRule.joints_from_beams_and_rules(Model.beams, JointRules, MaxDistance)

        if unmatched_pairs:
            for pair in unmatched_pairs:
                self.AddRuntimeMessage(Warning, "No joint rule found for beams {} and {}".format(list(pair)[0].key, list(pair)[1].key))  # TODO: add to debug_info

        if joints:
            # apply reversed. later joints in orginal list override ealier ones
            for joint in joints[::-1]:
                joint.joint_type.create(Model, *joint.elements, **joint.kwargs)

        # checks elements compatibility and applies extensions and features resulting from joints
        bje = Model.process_joinery()
        if bje:
            debug_info.add_joint_error(bje)

        if Features:
            features = [f for f in Features if f is not None]
            for f_def in features:
                if not f_def.elements:
                    self.AddRuntimeMessage(Warning, "Features defined in model must have elements defined. Features without elements will be ignored")
                else:
                    for element in f_def.elements:
                        element.add_features(f_def.feature_from_element(element))

        Geometry = None
        scene = Scene()
        for element in Model.elements():
            if CreateGeometry:
                scene.add(element.geometry)
                if element.debug_info:
                    debug_info.add_feature_error(element.debug_info)
            else:
                if isinstance(element, Beam) or isinstance(element, Plate):
                    scene.add(element.blank)
                else:
                    scene.add(element.geometry)

        if debug_info.has_errors:
            self.AddRuntimeMessage(Warning, "Error found during joint creation. See DebugInfo output for details.")

        Geometry = scene.draw()
        return Model, Geometry, debug_info
# ---------- end model ----------
draw = Draw(cg=python_2.planes)  # -> flatten(rg); disabled
#   port cg: The COMPAS geometry or datastructure to be drawn.
#   port rg: The Rhino geometry object.
# ---------- draw: Python ----------
"""
Draws COMPAS geometry in Grasshopper.
"""

from ghpythonlib.componentbase import executingcomponent as component

from compas.scene import SceneObject


class CompasToRhinoGeometry(component):
    def RunScript(self, cg):
        if not cg:
            return None

        return SceneObject(item=cg).draw()
# ---------- end draw ----------
draw_2 = Draw(cg=python.planes)  # -> rg; disabled; same code as draw
draw_3 = Draw(cg=python.mesh_vols)  # -> rg; disabled; same code as draw
draw_4 = Draw(cg=python.main_geo)  # -> rg; disabled; same code as draw
draw_5 = Draw(cg=python.cross_geo)  # -> rg; disabled; same code as draw
draw_6 = Draw(cg=python.neg_vols)  # -> rg; disabled; same code as draw
draw_7 = Draw(cg=python_2.main_geo)  # -> flatten(rg); disabled; same code as draw
draw_8 = Draw(cg=python_2.mesh_main)  # -> flatten(rg); disabled; same code as draw
item_4 = ListItem(List=python_2.planes, Index=number_slider_5, Wrap=True)  # disabled
item_5 = ListItem(List=flatten(draw_6), Index=0, Wrap=True)  # disabled
beam_4 = CTBeam(Centerline=crv_8, ZVector=xprod.Vector, Width=number_slider_8, Height=number_slider_7)  # -> Beam, Blank; inputs Centerline: list, ZVector: list of Vector3d, Width: list, Height: list, Category: list, updateRefObj: Boolean; disabled; same code as beam
beam_5 = CTBeam(Centerline=crv_7, Width=number_slider_6, Height=number_slider_4)  # -> Beam, Blank; inputs Centerline: list, ZVector: list of Vector3d, Width: list, Height: list, Category: list, updateRefObj: Boolean; disabled; same code as beam
panel_3 = Panel(python.out)  # disabled
item_6 = ListItem(List=reverse(beam_4.Beam), Index=0, Wrap=True)  # disabled
x_topo_joint_2 = CTXTopologicalJointRules()  # -> XLapJoint; same code as x_topo_joint
merge_2 = Merge(Data1=beam_4.Beam, Data2=beam_5.Beam)  # disabled
model_2 = CTModel(
    Elements=flatten(beam.Beam),
    JointRules=flatten(x_topo_joint_2),
    MaxDistance=Slider(20, range=0..100),
    CreateGeometry=Toggle(True))  # -> Model, Geometry, DebugInfo; inputs Elements: list, JointRules: list, Features: list, CreateGeometry: Boolean
#   port Elements: Collection of Beams
# ---------- model_2: Python ----------
from compas.scene import Scene
from compas.tolerance import TOL
from ghpythonlib.componentbase import executingcomponent as component
from Grasshopper.Kernel.GH_RuntimeMessageLevel import Warning

from compas_timber.connections import JointTopology
from compas_timber.connections import LMiterJoint
from compas_timber.connections import TButtJoint
from compas_timber.connections import XLapJoint
from compas_timber.design import DebugInfomation
from compas_timber.design import JointRule
from compas_timber.elements import Beam
from compas_timber.elements import Plate
from compas_timber.model import TimberModel

from compas_rhino import unload_modules
unload_modules('compas_timber')

JOINT_DEFAULTS = {
    JointTopology.TOPO_X: XLapJoint,
    JointTopology.TOPO_T: TButtJoint,
    JointTopology.TOPO_L: LMiterJoint,
}

# workaround for https://github.com/gramaziokohler/compas_timber/issues/280
TOL.absolute = 1e-6


class ModelComponent(component):
    def RunScript(self, Elements, JointRules, Features, MaxDistance, CreateGeometry):
        if not Elements:
            self.AddRuntimeMessage(Warning, "Input parameter Beams failed to collect data")
        if not JointRules:
            self.AddRuntimeMessage(Warning, "Input parameter JointRules failed to collect data")
        if not (Elements):  # shows beams even if no joints are found
            return
        if MaxDistance is None:
            MaxDistance = TOL.ABSOLUTE  # compared to calculted distance, so shouldn't be just 0.0

        Model = TimberModel()
        debug_info = DebugInfomation()
        for element in Elements:
            # prepare elements for downstream processing
            element.reset()
            Model.add_element(element)

        joints, unmatched_pairs = JointRule.joints_from_beams_and_rules(Model.beams, JointRules, MaxDistance)

        if unmatched_pairs:
            for pair in unmatched_pairs:
                self.AddRuntimeMessage(Warning, "No joint rule found for beams {} and {}".format(list(pair)[0].key, list(pair)[1].key))  # TODO: add to debug_info

        if joints:
            # apply reversed. later joints in orginal list override ealier ones
            for joint in joints[::-1]:
                joint.joint_type.create(Model, *joint.elements, **joint.kwargs)

        # checks elements compatibility and applies extensions and features resulting from joints
        bje = Model.process_joinery()
        if bje:
            debug_info.add_joint_error(bje)

        if Features:
            features = [f for f in Features if f is not None]
            for f_def in features:
                if not f_def.elements:
                    self.AddRuntimeMessage(Warning, "Features defined in model must have elements defined. Features without elements will be ignored")
                else:
                    for element in f_def.elements:
                        element.add_features(f_def.feature_from_element(element))

        Geometry = None
        scene = Scene()
        for element in Model.elements():
            if CreateGeometry:
                scene.add(element.geometry)
                if element.debug_info:
                    debug_info.add_feature_error(element.debug_info)
            else:
                if isinstance(element, Beam) or isinstance(element, Plate):
                    scene.add(element.blank)
                else:
                    scene.add(element.geometry)

        if debug_info.has_errors:
            self.AddRuntimeMessage(Warning, "Error found during joint creation. See DebugInfo output for details.")

        Geometry = scene.draw()
        return Model, Geometry, debug_info
# ---------- end model_2 ----------
writebtlx = CTWriteBTLx(Model=model.Model, Path="C:\Users\kapso\OneDrive\Desktop\BTLx\pocket", Write=Button())  # -> BTLx; inputs Write: Boolean
#   port Model: Model object.
# ---------- writebtlx: Python ----------
import Rhino
from ghpythonlib.componentbase import executingcomponent as component
from Grasshopper.Kernel.GH_RuntimeMessageLevel import Warning

from compas_timber.fabrication import BTLxWriter


class WriteBTLx(component):
    def RunScript(self, model, path, write):
        if not model:
            self.AddRuntimeMessage(Warning, "Input parameter Model failed to collect data")
            return

        btlx = BTLxWriter(file_name=str(Rhino.RhinoDoc.ActiveDoc.Name))

        if write:
            if not path:
                self.AddRuntimeMessage(Warning, "Input parameter Path failed to collect data")
                return
            XML = btlx.write(model, path)
        else:
            XML = btlx.model_to_xml(model)

        return XML
# ---------- end writebtlx ----------
number_slider_9 = Slider(5, range=0..100)  # disabled
featureerrors = CTShowFeatureErrors(DebugInfo=model_2.DebugInfo, i=number_slider_9)  # -> Info, Geometry; disabled
#   port DebugInfo: DebugInformation object containing feature errors.
# ---------- featureerrors: Python ----------
# flake8: noqa
from compas.scene import SceneObject
from ghpythonlib.componentbase import executingcomponent as component
from Grasshopper.Kernel.GH_RuntimeMessageLevel import Warning


class ShowFeatureErrors(component):
    def RunScript(self, debug_info, index):
        if index is None:
            self.AddRuntimeMessage(Warning, "Input parameter 'i' failed to collect data")
            index = 0
        if not debug_info:
            self.AddRuntimeMessage(Warning, "Input parameter 'DebugInfo' failed to collect data")
            return
        if not debug_info.feature_errors:
            self.AddRuntimeMessage(Warning, "No feature errors found in input parameter 'DebugInfo'")
            return
        feature_errors = debug_info.feature_errors
        index = int(index) % len(feature_errors)
        error = feature_errors[index]

        geometries = [error.feature_geometry, error.element_geometry]
        geo_objs = [SceneObject(item=geo) for geo in geometries]
        output = []
        for obj in geo_objs:
            output.extend(obj.draw())

        return error.message, output
# ---------- end featureerrors ----------
panel_4 = Panel(featureerrors.Info)  # disabled
writebtlx_2 = CTWriteBTLx(Model=model_2.Model, Path="C:\Users\kapso\OneDrive\Desktop\BTLx\pocket", Write=Button())  # -> BTLx; inputs Write: Boolean; same code as writebtlx
dispatch_5 = Dispatch(List=featureerrors.Geometry, DispatchPattern=[True, False])  # -> ListA, ListB; disabled
brep = Brep(dispatch_5.ListA)  # disabled
python_3 = GhPythonScript(cross_beam=beam_5.Beam, main_beam=item_6)  # -> out, neg_vols, pocket_volume, pocket_volume_cross
# ---------- python_3: Python ----------
from compas_rhino import unload_modules
from compas_rhino.conversions import plane_to_rhino, frame_to_rhino
from compas_timber.connections import XLapJoint, LapJoint
from compas_timber.fabrication import Lap, Pocket
from compas.geometry import Frame, Brep, Plane, angle_vectors, intersection_plane_plane_plane, Line, Polyhedron, convex_hull

unload_modules('compas_timber')

lap = LapJoint(cross_beam, main_beam)
neg_vols = lap._create_negative_volumes()

mesh_main = neg_vols[1].to_mesh()
mesh_cross = neg_vols[0].to_mesh()

pocket = Pocket.from_volume_and_beam(mesh_main, main_beam, lap.main_ref_side_index)
#main_geo = pocket.apply(main_beam.geometry,main_beam)
#pocket_volume = pocket.volume_from_params_and_beam(main_beam)

pocket_cross = Pocket.from_volume_and_beam(mesh_cross, cross_beam, lap.cross_ref_side_index)
#pocket_volume_cross = pocket_cross.volume_from_params_and_beam(cross_beam)
# ---------- end python_3 ----------
number_slider_10 = Slider(0, range=0..10)  # disabled
pln_2 = Plane()  # disabled
draw_9 = Draw(cg=python_3.pocket_volume_cross)  # -> rg; disabled; same code as draw
draw_10 = Draw(cg=python_3.pocket_volume)  # -> rg; disabled; same code as draw
draw_11 = Draw(cg=python_3.neg_vols)  # -> rg; disabled; same code as draw
pln_3 = Plane()  # disabled
item_7 = ListItem(List=pln_3, Index=number_slider_10, Wrap=True)  # disabled
number_slider_11 = Slider(40, range=0..100)  # disabled
toggle_2 = BooleanToggle(True)  # disabled
toggle_3 = BooleanToggle(True)  # disabled
number_slider_12 = Slider(142.56, range=0..1000)  # disabled
number_slider_13 = Slider(0, range=0..1000)  # disabled
number_slider_14 = Slider(60.44, range=0..1000)  # disabled
number_slider_15 = Slider(88.61, range=0..1000)  # disabled
number_slider_16 = Slider(0, range=0..10)  # disabled
number_slider_17 = Slider(40, range=0..100)  # disabled
number_slider_18 = Slider(20, range=0..100)  # disabled
number_slider_19 = Slider(90, range=0..100)  # disabled
number_slider_20 = Slider(90, range=0..100)  # disabled
number_slider_21 = Slider(0, range=0..10)  # disabled
item_8 = ListItem(List=beam_2.Beam, Index=0, Wrap=True)  # disabled
neg = Negative(Value=number_slider_16)  # disabled
python_4 = GhPythonScript(
    Beam=item_8,
    start_x=number_slider_12,
    start_y=number_slider_13,
    angle=number_slider_14,
    inclination=number_slider_15,
    slope=neg,
    length=number_slider_11,
    width=number_slider_17,
    depth=number_slider_18,
    lead_angle_parallel=toggle_2,
    lead_angle=number_slider_19,
    lead_inclination_parallel=toggle_3,
    lead_inclination=number_slider_20,
    ref_side_index=number_slider_21)  # -> out, a, planes, volume; inputs ref_side_index: Int32; disabled
# ---------- python_4: Python ----------
from compas_timber.fabrication import Lap, OrientationType, MachiningLimits
from compas_rhino import unload_modules
from compas_rhino.conversions import plane_to_rhino, frame_to_rhino

unload_modules('compas_timber')

machining_limits = MachiningLimits()
machining_limits.face_limited_top = False
machining_limits.face_limited_back = False
machining_limits.face_limited_front = False
ml = machining_limits.limits

lap = Lap(orientation=OrientationType.START, 
        start_x=start_x, 
        start_y=start_y, 
        angle=angle, 
        inclination=inclination, 
        slope=slope, 
        length=length, 
        width=width,
        depth=depth,
        lead_angle_parallel=lead_angle_parallel,
        lead_angle=lead_angle,
        lead_inclination_parallel=lead_inclination_parallel,
        lead_inclination=lead_inclination,
        machining_limits=ml,
        ref_side_index=ref_side_index)

planes = [frame_to_rhino(p) for p in lap.planes_from_params_and_beam(Beam)]
volume = lap.volume_from_params_and_beam(Beam)
a=lap.apply(Beam.geometry, Beam)
# ---------- end python_4 ----------
number_slider_22 = Slider(3, range=0..5)  # disabled
number_slider_23 = Slider(0, range=0..5)  # disabled
draw_12 = Draw(cg=python_4.a)  # -> rg; disabled; same code as draw
draw_13 = Draw(cg=python_4.volume)  # -> rg; disabled; same code as draw
item_9 = ListItem(List=python_4.planes, Index=[number_slider_22, number_slider_23], Wrap=True)  # disabled
