# Grasshopper definition test_step_joint.ghx (Grasshopper 1.0.7)
# plug-ins: Human

# ---- group: MainBeam
crv = Curve([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])
item = ListItem(List=crv, Index=Slider(5, range=0..6), Wrap=True)

# ---- group: CrossBeam
crv_2 = Curve(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)

# ----
number_slider = Slider(100, range=0..100)

# ---- group: StepShape
tapered_heel = BooleanToggle(False)
number_slider_2 = Slider(20, range=0..200)
number_slider_3 = Slider(0, range=0..200)

# ---- group: Tenon/Mortise
tenon_mortise_height = Slider(20, range=0..100)

# ---- group: Ref_Side
number_slider_4 = Slider(1, range=0..15)
number_slider_5 = Slider(0, range=0..5)

# ----
beam = CTBeam(Centerline=crv_2, Width=Slider(60, range=0..100), Height=Slider(80, range=0..120))  # -> Beam, Blank; inputs Centerline: list, ZVector: list of Vector3d, Width: list, Height: list, Category: list, updateRefObj: Boolean
#   port Centerline: Referenced curve or line, Guid of curve or line in the active Rhino document.
#   port ZVector: Vector defining the orientation of the cross-section (corresponds to the height dimension). If None, a default will be taken.
#   port Width: Width of the cross-section (usually the smaller dimension).
#   port Height: Height of the cross-section (usually the larger dimension).
#   port Category: Category of a beam.
#   port updateRefObj: (optional) If True, the attributes in the referenced object will be updated/overwritten with the new values given here.
#   port Beam: Beam object(s).
#   port Blank: Shape of the beam's blank.
# ---------- beam: Python ----------
"""Creates a Beam from a LineCurve."""

import rhinoscriptsyntax as rs
from compas.scene import Scene
from compas_rhino.conversions import line_to_compas
from compas_rhino.conversions import vector_to_compas
from ghpythonlib.componentbase import executingcomponent as component
from Grasshopper.Kernel.GH_RuntimeMessageLevel import Error
from Grasshopper.Kernel.GH_RuntimeMessageLevel import Warning
from Rhino.RhinoDoc import ActiveDoc

from compas_timber.elements import Beam as CTBeam
from compas_timber.ghpython.rhino_object_name_attributes import update_rhobj_attributes_name


class Beam_fromCurve(component):
    def RunScript(self, centerline, z_vector, width, height, category, updateRefObj):
        # minimum inputs required
        if not centerline:
            self.AddRuntimeMessage(Warning, "Input parameter 'Centerline' failed to collect data")
        if not width:
            length = self._get_centerline_length(centerline)
            width = [length / 20]
        if not height:
            length = self._get_centerline_length(centerline)
            height = [length / 10]

        # reformat unset parameters for consistency
        if not z_vector:
            z_vector = [None]
        if not category:
            category = [None]

        beams = []
        blanks = []
        scene = Scene()

        if centerline and height and width:
            # check list lengths for consistency
            N = len(centerline)
            if len(z_vector) not in (0, 1, N):
                self.AddRuntimeMessage(
                    Error, " In 'ZVector' I need either none, one or the same number of inputs as the Crv parameter."
                )
            if len(width) not in (1, N):
                self.AddRuntimeMessage(
                    Error, " In 'W' I need either one or the same number of inputs as the Crv parameter."
                )
            if len(height) not in (1, N):
                self.AddRuntimeMessage(
                    Error, " In 'H' I need either one or the same number of inputs as the Crv parameter."
                )
            if len(category) not in (0, 1, N):
                self.AddRuntimeMessage(
                    Error, " In 'Category' I need either none, one or the same number of inputs as the Crv parameter."
                )

            # duplicate data if None or single value
            if len(z_vector) != N:
                z_vector = [z_vector[0] for _ in range(N)]
            if len(width) != N:
                width = [width[0] for _ in range(N)]
            if len(height) != N:
                height = [height[0] for _ in range(N)]
            if len(category) != N:
                category = [category[0] for _ in range(N)]

            for line, z, w, h, c in zip(centerline, z_vector, width, height, category):
                guid, geometry = self._get_guid_and_geometry(line)
                rhino_line = rs.coerceline(geometry)
                line = line_to_compas(rhino_line)

                z = vector_to_compas(z) if z else None
                beam = CTBeam.from_centerline(centerline=line, width=w, height=h, z_vector=z)
                beam.attributes["rhino_guid"] = str(guid) if guid else None
                beam.attributes["category"] = c
                print(guid)
                if updateRefObj and guid:
                    update_rhobj_attributes_name(guid, "width", str(w))
                    update_rhobj_attributes_name(guid, "height", str(h))
                    update_rhobj_attributes_name(guid, "zvector", str(list(beam.frame.zaxis)))
                    update_rhobj_attributes_name(guid, "category", c)

                beams.append(beam)
                scene.add(beam.blank)

        blanks = scene.draw()

        return beams, blanks

    def _get_guid_and_geometry(self, line):
        # internalized curves and GH geometry will not have persistent GUIDs, referenced Rhino objects will
        # type hint on the input has to be 'ghdoc' for this to work
        guid = None
        geometry = line
        rhino_obj = ActiveDoc.Objects.FindId(line)
        if rhino_obj:
            guid = line
            geometry = rhino_obj.Geometry
        return guid, geometry

    def _get_centerline_length(self, centerline):
        centerline_length = []
        for i in centerline:
            centerline_length.append(rs.CurveLength(i))
        if centerline_length:
            length_average = sum(centerline_length) / len(centerline_length)
        else:
            length_average = 1
        return length_average
# ---------- end beam ----------
beam_2 = CTBeam(Centerline=item, Width=Slider(100, range=0..100), Height=Slider(120, range=0..1000))  # -> Beam, Blank; inputs Centerline: list, ZVector: list of Vector3d, Width: list, Height: list, Category: list, updateRefObj: Boolean; same code as beam

list = ValueList({"step": 0, "heel": 1, "double": 2}, selected="step")

# ----
# StepJointNotch
python = GhPythonScript(
    cross_beam=beam.Beam,
    main_beam=beam_2.Beam,
    index=number_slider_5,
    ref_side_index=number_slider_4,
    step=number_slider_2,
    heel=number_slider_3,
    tapered=tapered_heel,
    mortise_height=tenon_mortise_height)  # -> out, step_joint_notch, rg_cutting_plane, rg_planes, rg_ref_side, rg_geometry, btlx_params, mortise_brep; inputs index: Int32, ref_side_index: Int32; disabled
# ---------- python: Python ----------
from compas_rhino.conversions import surface_to_rhino
from compas_timber._fabrication import StepJointNotch
from compas_timber._fabrication import StepJointNotchParams
from compas_timber.connections.utilities import beam_ref_side_incidence, beam_ref_side_incidence_with_vector


from compas_timber.model import TimberModel
from compas_timber.fabrication import BTLx

from compas_rhino import unload_modules
from compas.scene import SceneObject

from compas_rhino.conversions import frame_to_rhino, plane_to_rhino, surface_to_rhino, polyline_to_rhino, brep_to_rhino, box_to_rhino

import Rhino.Geometry as rg
unload_modules("compas_timber")

def cross_beam_ref_side_index(main_beam, cross_beam):
    ref_side_dict = beam_ref_side_incidence(main_beam, cross_beam, ignore_ends=True)
    ref_side_index = min(ref_side_dict, key=ref_side_dict.get)
    return ref_side_index

def main_beam_ref_side_index(main_beam, cross_beam, cross_beam_ref_side_index):
    cross_beam_ref_side = cross_beam.ref_sides[cross_beam_ref_side_index]
    ref_side_dict = beam_ref_side_incidence_with_vector(
        main_beam, cross_beam_ref_side.normal, ignore_ends=True
    )
    ref_side_index = max(ref_side_dict, key=ref_side_dict.get)
    return ref_side_index

cross_beam_ref_side_index = cross_beam_ref_side_index(main_beam, cross_beam)
main_beam_ref_side_index = main_beam_ref_side_index(main_beam, cross_beam, cross_beam_ref_side_index)


#define beam and cutting plane
beam = cross_beam
plane = main_beam.ref_sides[main_beam_ref_side_index]

#create step_joint_notch
step_joint_notch = StepJointNotch.from_plane_and_beam(plane, beam, start_y=beam.height/2, notch_limited=False, step_depth=step, heel_depth=heel, notch_width=beam.height, strut_height=80.0, tapered_heel=tapered, ref_side_index=cross_beam_ref_side_index)
cutting_planes = step_joint_notch.planes_from_params_and_beam(beam)

print("Orientation: ", step_joint_notch.orientation)
print("StrutInclination: ", step_joint_notch.strut_inclination)

#add mortise
if mortise_height > 0:
    step_joint_notch.add_mortise(beam.width/4, mortise_height, beam)
    mortise_brep = step_joint_notch.mortise_volume_from_params_and_beam(beam)
    mortise_brep = box_to_rhino(mortise_brep)

#apply geometric features
#geo = beam.compute_geometry(False)
#geometry = step_joint_notch.apply(geo, beam)
#rg_geometry = brep_to_rhino(geometry)

#get btlx params
step_joint_notch_params = StepJointNotchParams(step_joint_notch).as_dict()
btlx_params = []
for key, value in step_joint_notch_params.items():
    btlx_params.append("{0}: {1}".format(key, value))


#vizualize in rhino
rg_ref_side = frame_to_rhino(beam.ref_sides[ref_side_index])
rg_cutting_plane = frame_to_rhino(plane)
rg_planes = (plane_to_rhino(plane) for plane in cutting_planes)
# ---------- end python ----------
panel = Panel(python.out)  # disabled
btlx_params = Panel(python.btlx_params)  # disabled

# ----
# StepJoint
python_2 = GhPythonScript(
    cross_beam=beam.Beam,
    main_beam=beam_2.Beam,
    step=number_slider_2,
    heel=number_slider_3,
    tapered=tapered_heel,
    tenon_height=tenon_mortise_height)  # -> out, step_joint, rg_cutting_plane, rg_planes, rg_ref_side, rg_geometry, btlx_params, rg_tenon_volume; disabled
# ---------- python_2: Python ----------
import compas
from compas_rhino.conversions import surface_to_rhino
from compas_timber._fabrication import StepJointNotch
from compas_timber._fabrication import StepJointNotchParams
from compas_timber._fabrication import StepJoint
from compas_timber._fabrication import StepJointParams

from compas_timber.model import TimberModel
from compas_timber.fabrication import BTLx
from compas_timber.connections.utilities import beam_ref_side_incidence, beam_ref_side_incidence_with_vector

from compas_rhino import unload_modules
from compas.scene import SceneObject

from compas_rhino.conversions import frame_to_rhino, plane_to_rhino, surface_to_rhino, polyline_to_rhino, brep_to_rhino, mesh_to_rhino

import Rhino.Geometry as rg
unload_modules("compas_timber")

def cross_beam_ref_side_index(main_beam, cross_beam):
    ref_side_dict = beam_ref_side_incidence(main_beam, cross_beam, ignore_ends=True)
    ref_side_index = min(ref_side_dict, key=ref_side_dict.get)
    return ref_side_index

def main_beam_ref_side_index(main_beam, cross_beam, cross_beam_ref_side_index):
    cross_beam_ref_side = cross_beam.ref_sides[cross_beam_ref_side_index]
    ref_side_dict = beam_ref_side_incidence_with_vector(
        main_beam, cross_beam_ref_side.normal, ignore_ends=True
    )
    ref_side_index = max(ref_side_dict, key=ref_side_dict.get)
    return ref_side_index

cross_beam_ref_side_index = cross_beam_ref_side_index(main_beam, cross_beam)
main_beam_ref_side_index = main_beam_ref_side_index(main_beam, cross_beam, cross_beam_ref_side_index)

#define beam and cutting plane
beam = main_beam
geo = beam.compute_geometry(False)
plane = cross_beam.ref_sides[cross_beam_ref_side_index]

#create step_joint
step_joint = StepJoint.from_plane_and_beam(plane, beam, step, heel, tapered, main_beam_ref_side_index)
cutting_planes = step_joint.planes_from_params_and_beam(beam)
print("Orientation: ", step_joint.orientation)
print("StrutInclination: ", step_joint.strut_inclination)

#add tenon
if tenon_height > 0:
    step_joint.add_tenon(cross_beam.width/4, tenon_height)
    tenon_volume = step_joint.tenon_volume_from_params_and_beam(beam)
    rg_tenon_volume = brep_to_rhino(tenon_volume)

#apply geometric features
#geometry = beam.compute_geometry()
#geometry -= tenon_volume
#geometry = step_joint.apply(geo, beam)
#rg_geometry = brep_to_rhino(geometry)
#rg_geometry.MergeCoplanarFaces(0.01)

#get btlx params
step_joint_params = StepJointParams(step_joint).as_dict()
btlx_params = []
for key, value in step_joint_params.items():
    btlx_params.append("{0}: {1}".format(key, value))

#vizualize in rhino
rg_ref_side = frame_to_rhino(beam.ref_sides[main_beam_ref_side_index])
rg_cutting_plane = frame_to_rhino(plane)
rg_planes = (plane_to_rhino(plane) for plane in cutting_planes)
# ---------- end python_2 ----------
panel_2 = Panel(python_2.out)  # disabled
btlx_params_2 = Panel(python_2.btlx_params)  # disabled

# ----
# TStepJoint
t_topo_joint = CTTTopologicalJointRules(
    step_shape=list,
    step_depth=Slider(59, range=0..100),
    heel_depth=Slider(59, range=0..100),
    tapered_heel=Toggle(True),
    tenon_mortise_height=Slider(60, range=0..100))  # -> TStepJoint
# ---------- t_topo_joint: Python ----------
import inspect

from ghpythonlib.componentbase import executingcomponent as component
from Grasshopper.Kernel.GH_RuntimeMessageLevel import Warning

from compas_timber.connections import Joint
from compas_timber.connections import JointTopology
from compas_timber.connections import TButtJoint
from compas_timber.design import TopologyRule
from compas_timber.ghpython.ghcomponent_helpers import get_leaf_subclasses
from compas_timber.ghpython.ghcomponent_helpers import manage_dynamic_params
from compas_timber.ghpython.ghcomponent_helpers import rename_gh_output


class T_TopologyJointRule(component):
    def __init__(self):
        super(T_TopologyJointRule, self).__init__()
        self.classes = {}
        for cls in get_leaf_subclasses(Joint):
            if cls.SUPPORTED_TOPOLOGY == JointTopology.TOPO_T:
                self.classes[cls.__name__] = cls
        if ghenv.Component.Params.Output[0].NickName == "Rule":
            self.joint_type = TButtJoint
            self.clicked = False
        else:
            self.joint_type = self.classes.get(ghenv.Component.Params.Output[0].NickName, None)
            self.clicked = True

    def RunScript(self, *args):
        if not self.clicked:
            ghenv.Component.Message = "Default: TButtJoint"
            self.AddRuntimeMessage(Warning, "TButtJoint is default, change in context menu (right click)")
            return TopologyRule(JointTopology.TOPO_T, TButtJoint)
        else:
            ghenv.Component.Message = self.joint_type.__name__
            kwargs = {}
            for i, val in enumerate(args):
                if val is not None:
                    kwargs[self.arg_names()[i]] = val
            if self.joint_type.SUPPORTED_TOPOLOGY != JointTopology.TOPO_T:
                self.AddRuntimeMessage(Warning, "Joint type does not match topology. Joint may not be generated.")
            return TopologyRule(JointTopology.TOPO_T, self.joint_type, **kwargs)

    def arg_names(self):
        names = inspect.getargspec(self.joint_type.__init__)[0][3:]
        return [name for name in names if (name != "key") and (name != "frame")]

    def AppendAdditionalMenuItems(self, menu):
        for name in self.classes.keys():
            item = menu.Items.Add(name, None, self.on_item_click)
            if self.joint_type and name == self.joint_type.__name__:
                item.Checked = True

    def on_item_click(self, sender, event_info):
        self.clicked = True
        self.joint_type = self.classes[str(sender)]
        rename_gh_output(self.joint_type.__name__, 0, ghenv)
        manage_dynamic_params(self.arg_names(), ghenv, rename_count=0, permanent_param_count=0)
        ghenv.Component.ExpireSolution(True)
# ---------- end t_topo_joint ----------
model = CTModel(Elements=flatten([beam.Beam, beam_2.Beam]), JointRules=flatten(t_topo_joint), CreateGeometry=Toggle(True))  # -> Model, Geometry, DebugInfo; inputs Elements: list, JointRules: list, Features: list, CreateGeometry: Boolean
#   port Elements: Collection of Beams
# ---------- model: Python ----------
from compas.scene import Scene
from compas.tolerance import TOL
from ghpythonlib.componentbase import executingcomponent as component
from Grasshopper.Kernel.GH_RuntimeMessageLevel import Warning

from compas_timber.connections import BeamJoinningError
from compas_timber.connections import ConnectionSolver
from compas_timber.connections import JointTopology
from compas_timber.connections import LMiterJoint
from compas_timber.connections import TButtJoint
from compas_timber.connections import XHalfLapJoint
from compas_timber.design import CategoryRule
from compas_timber.design import DebugInfomation
from compas_timber.design import DirectRule
from compas_timber.design import JointDefinition
from compas_timber.design import TopologyRule
from compas_timber.model import TimberModel

JOINT_DEFAULTS = {
    JointTopology.TOPO_X: XHalfLapJoint,
    JointTopology.TOPO_T: TButtJoint,
    JointTopology.TOPO_L: LMiterJoint,
}


# workaround for https://github.com/gramaziokohler/compas_timber/issues/280
TOL.absolute = 1e-6


class ModelComponent(component):
    def get_joints_from_rules(self, beams, rules, topologies):
        if not isinstance(rules, list):
            rules = [rules]
        rules = [r for r in rules if r is not None]

        joints = []
        # rules have to be resolved into joint definitions
        topo_rules = {}
        cat_rules = []
        direct_rules = []

        # TODO: refactor this into some kind of a rule reloving class/function
        for r in rules:  # separate category and topo and direct joint rules
            if isinstance(r, TopologyRule):
                if topo_rules.get(r.topology_type, None):  # if rule for this Topo exists
                    if (r.joint_type != JOINT_DEFAULTS[r.topology_type]) or (
                        len(r.kwargs) != 0
                    ):  # if this rule is NOT default
                        topo_rules[r.topology_type] = r
                else:
                    topo_rules[r.topology_type] = r
            elif isinstance(r, CategoryRule):
                cat_rules.append(r)
            if isinstance(r, DirectRule):
                direct_rules.append(r)

        for topo in topologies:
            beam_a = topo["beam_a"]
            beam_b = topo["beam_b"]
            detected_topo = topo["detected_topo"]
            pair = beam_a, beam_b
            pair_joined = False

            if detected_topo == JointTopology.TOPO_UNKNOWN:
                continue

            for rule in direct_rules:  # apply direct rules first
                if rule.comply(pair):
                    joints.append(JointDefinition(rule.joint_type, rule.beams, **rule.kwargs))
                    pair_joined = True
                    break

            if not pair_joined:  # if no direct rule applies, apply category rules next
                for rule in cat_rules:
                    if not rule.comply(pair):
                        continue
                    if rule.joint_type.SUPPORTED_TOPOLOGY != detected_topo:
                        msg = "Conflict detected! Beams: {}, {} meet with topology: {} but rule assigns: {}"
                        self.AddRuntimeMessage(
                            Warning,
                            msg.format(
                                beam_a.guid,
                                beam_b.guid,
                                JointTopology.get_name(detected_topo),
                                rule.joint_type.__name__,
                            ),
                        )
                        continue
                    if rule.topos and detected_topo not in rule.topos:
                        msg = "Conflict detected! Beams: {}, {} meet with topology: {} but rule allows: {}"
                        self.AddRuntimeMessage(
                            Warning,
                            msg.format(
                                beam_a.guid,
                                beam_b.guid,
                                JointTopology.get_name(detected_topo),
                                [JointTopology.get_name(topo) for topo in rule.topos],
                            ),
                        )
                        continue
                    # sort by category to allow beam role by order (main beam first, cross beam second)
                    beam_a, beam_b = rule.reorder([beam_a, beam_b])
                    joints.append(JointDefinition(rule.joint_type, [beam_a, beam_b], **rule.kwargs))
                    break  # first matching rule

                else:  # no category rule applies, apply topology rules
                    if detected_topo not in topo_rules:
                        continue
                    else:
                        joints.append(
                            JointDefinition(
                                topo_rules[detected_topo].joint_type,
                                [beam_a, beam_b],
                                **topo_rules[detected_topo].kwargs
                            )
                        )
        return joints

    def RunScript(self, Elements, JointRules, Features, MaxDistance, CreateGeometry):
        if not Elements:
            self.AddRuntimeMessage(Warning, "Input parameter Beams failed to collect data")
        if not JointRules:
            self.AddRuntimeMessage(Warning, "Input parameter JointRules failed to collect data")
        if not (Elements):  # shows beams even if no joints are found
            return
        if MaxDistance is None:
            MaxDistance = TOL.ABSOLUTE  # compared to calculted distance, so shouldn't be just 0.0

        Model = TimberModel()
        debug_info = DebugInfomation()
        for element in Elements:
            # prepare elements for downstream processing
            if element is None:
                continue
            element.remove_features()
            if hasattr(element, "remove_blank_extension"):
                element.remove_blank_extension()
            element.debug_info = []
            Model.add_element(element)

        topologies = []
        solver = ConnectionSolver()
        found_pairs = solver.find_intersecting_pairs(list(Model.beams), rtree=True, max_distance=MaxDistance)
        for pair in found_pairs:
            beam_a, beam_b = pair
            detected_topo, beam_a, beam_b = solver.find_topology(beam_a, beam_b, max_distance=MaxDistance)
            if not detected_topo == JointTopology.TOPO_UNKNOWN:
                topologies.append({"detected_topo": detected_topo, "beam_a": beam_a, "beam_b": beam_b})
        Model.set_topologies(topologies)

        joints = self.get_joints_from_rules(Model.beams, JointRules, topologies)

        if joints:
            handled_beams = []
            joints = [j for j in joints if j is not None]
            # apply reversed. later joints in orginal list override ealier ones
            for joint in joints[::-1]:
                beams_to_pair = joint.beams
                beam_pair_ids = set([id(beam) for beam in beams_to_pair])
                if beam_pair_ids in handled_beams:
                    continue
                try:
                    joint.joint_type.create(Model, *beams_to_pair, **joint.kwargs)
                except BeamJoinningError as bje:
                    debug_info.add_joint_error(bje)
                else:
                    handled_beams.append(beam_pair_ids)

        # applies extensions and features resulting from joints
        Model.process_joinery()

        if Features:
            features = [f for f in Features if f is not None]
            for f_def in features:
                for element in f_def.elements:
                    element.add_features(f_def.feature)

        Geometry = None
        scene = Scene()
        for element in Model.elements():
            if CreateGeometry:
                scene.add(element.geometry)
                if element.debug_info:
                    debug_info.add_feature_error(element.debug_info)
            else:
                scene.add(element.blank)

        if debug_info.has_errors:
            self.AddRuntimeMessage(Warning, "Error found during joint creation. See DebugInfo output for details.")

        Geometry = scene.draw()
        return Model, Geometry, debug_info
# ---------- end model ----------

brep = Brep(python_2.rg_tenon_volume)  # disabled
brep_2 = Brep(python_2.rg_geometry)  # disabled
brep_3 = Brep(python.mortise_brep)  # disabled

# ---- group: GEOMETRY
brep_4 = Brep(python_2.rg_geometry)  # disabled
swatch = ColourSwatch(SwatchColor=RGBA(0, 102, 255, 29))  # disabled
edges = BrepEdges(Brep=brep_4)  # -> Naked, Interior, NonManifold; disabled
previewlw = CustomPreviewLineweights(Geometry=edges.Interior, Shader=swatch, Absolute=False)  # disabled
preview = CustomPreview(Geometry=brep_4, Material=swatch)  # disabled

brep_5 = Brep(python.rg_geometry)  # disabled
swatch_2 = ColourSwatch(SwatchColor=RGBA(240, 180, 137, 34))  # disabled
edges_2 = BrepEdges(Brep=brep_5)  # -> Naked, Interior, NonManifold; disabled
preview_2 = CustomPreview(Geometry=brep_5, Material=swatch_2)  # disabled
previewlw_2 = CustomPreviewLineweights(Geometry=edges_2.Interior, Shader=swatch_2, Absolute=False)  # disabled

# ---- group: CUTTING PLANE
pln = Plane(python_2.rg_cutting_plane)  # disabled

# ---- group: REF_SIDE
pln_2 = Plane(python_2.rg_ref_side)  # disabled

# ---- group: notch_planes
pln_3 = Plane(python_2.rg_planes)  # disabled

# ---- group: CUTTING PLANE
pln_4 = Plane(python.rg_cutting_plane)  # disabled

# ---- group: REF_SIDE
pln_5 = Plane(python.rg_ref_side)

# ---- group: notch_planes
pln_6 = Plane(python.rg_planes)  # disabled

# ----
number_slider_6 = Slider(136.019, range=0..1000)  # disabled
deplane = DeconstructPlane(Plane=pln_2)  # -> Origin, XAxis, YAxis, ZAxis; disabled
pl = PlaneNormal(Origin=deplane.Origin, ZAxis=deplane.YAxis)  # disabled
writebtlx = CTWriteBTLx(Model=model.Model, Path="C:\Users\kapso\OneDrive\Desktop\BTLx\TStepJoint.btlx", Write=Button())  # -> BTLx; inputs Write: Boolean
#   port Model: Model object.
# ---------- writebtlx: Python ----------
import Rhino
from ghpythonlib.componentbase import executingcomponent as component
from Grasshopper.Kernel.GH_RuntimeMessageLevel import Warning

from compas_timber.fabrication import BTLx


class WriteBTLx(component):
    def RunScript(self, model, path, write):
        if not model:
            self.AddRuntimeMessage(Warning, "Input parameter Model failed to collect data")
            return

        btlx = BTLx(model)
        btlx.history["FileName"] = Rhino.RhinoDoc.ActiveDoc.Name

        if write:
            if not path:
                self.AddRuntimeMessage(Warning, "Input parameter Path failed to collect data")
                return
            if path[-5:] != ".btlx":
                path += ".btlx"
            with open(path, "w") as f:
                f.write(btlx.btlx_string())
        return btlx.btlx_string()
# ---------- end writebtlx ----------
rotate = Rotate(Geometry=pln_2, Angle=degrees(number_slider_6), Plane=pl)  # -> Geometry, Transform; disabled
panel_3 = Panel(writebtlx)
