# Grasshopper definition LLX.gh (Grasshopper 1.0.7)

toggle = BooleanToggle(False)
line = Line(Line((0, 0, 0), (5, 0, 0)))
line_2 = Line(Line((0, 5, 1), (3, 1, 1)))
rhinosdk = GhPythonScript(L1=line, L2=line_2, limit_to_segments=toggle)  # -> out, PX1, PX2, t1, t2; inputs L1: Line, L2: Line, limit_to_segments: Boolean
# ---------- rhinosdk: Python ----------
__author__ = "aapolina"
__version__ = "2022.04.07"

import rhinoscriptsyntax as rs

import Rhino.Geometry as rg


boo, t1,t2 = rg.Intersect.Intersection.LineLine(L1,L2, 1e-6, limit_to_segments)
PX1 = L1.PointAt(t1)
PX2 = L2.PointAt(t2)
# ---------- end rhinosdk ----------
compas = GhPythonScript(L1=line, L2=line_2, limit_to_segments=toggle, max_distance=Slider(1.2, range=0..10))  # -> out, PX1, PX2, t1, t2; inputs L1: Line, L2: Line, limit_to_segments: Boolean
# ---------- compas: Python ----------
__author__ = "aapolina"
__version__ = "2022.04.07"

import compas_ghpython
from compas_ghpython import unload_modules
unload_modules('compas_timber')


from compas_timber.utils.rhino_compas import rLine2cLine, cPt2rPt
from compas_timber.utils.compas_extra import intersection_line_line_3D


Lc1 = rLine2cLine(L1)
Lc2 = rLine2cLine(L2)

PX1,PX2 = [cPt2rPt(p) for p in intersection_line_line_3D(Lc1,Lc2, max_distance, limit_to_segments,False)]
t1,t2 =   intersection_line_line_3D(Lc1,Lc2, max_distance, limit_to_segments,True)
# ---------- end compas ----------
panel = Panel([compas.PX1, compas.PX2])
panel_2 = Panel([compas.t1, compas.t2])
panel_3 = Panel([rhinosdk.PX1, rhinosdk.PX2])
panel_4 = Panel([rhinosdk.t1, rhinosdk.t2])
