# Grasshopper definition assembly_demo.gh (Grasshopper 1.0.7)

python_module_to_reload = Panel("""compas
compas_timber""")
reload = Button()
py = PythonScript(reload_module_button=reload, module_names=python_module_to_reload)  # inputs module_names: list
# ---------- py: Python ----------
import compas_ghpython
from compas_ghpython import unload_modules
if reload_module_button:
    for module in module_names:
        unload_modules(module)
# ---------- end py ----------
id = Guid([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])
id_2 = Guid([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])
vec = Vector(Vector(1, 0, 3))  # disabled
id_3 = Guid([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])
vec_2 = Vector(Vector(1, 0, 3))  # disabled
vec_3 = Vector(Vector(1, 0, 3))  # disabled
id_4 = Guid(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)
vec_4 = Vector(Vector(1, 0, 3))  # disabled
beam_from_line_vec = GhPythonScript(guid=id, vec=vec, W="0.1", H="0.2", update=Button())  # -> out, beam, shape; inputs guid: Guid, vec: Vector3d
# ---------- beam_from_line_vec: Python ----------
__author__ = "aapolina"
__version__ = "2021.12.10"


import Rhino.Geometry as rg
import rhinoscriptsyntax as rs
from compas_rhino.geometry import RhinoCurve

import Rhino

from compas_ghpython.utilities import unload_modules
from compas_timber.parts.beam import Beam
from compas_timber.utils.rhino_compas import rVec2cVec, cBox2rBox, rLine2cLine

import Rhino

crv = Rhino.RhinoDoc.ActiveDoc.Objects.FindId(guid).Geometry
line = rg.Line(crv.PointAtStart,crv.PointAtEnd)

v = rVec2cVec(vec) 
beam = Beam.from_centreline(rLine2cLine(line),rVec2cVec(vec),W,H)
beam.attributes['rhino_guid']=guid.ToString()
shape = cBox2rBox(beam.shape)
# ---------- end beam_from_line_vec ----------
beam_from_line_vec_2 = GhPythonScript(guid=id_3, vec=vec_2, W="0.1", H="0.3", update=Button())  # -> out, beam, shape; inputs guid: Guid, vec: Vector3d; same code as beam_from_line_vec
beam_from_line_vec_3 = GhPythonScript(guid=id_2, vec=vec_3, W="0.1", H="0.2", update=Button())  # -> out, beam, shape; inputs guid: Guid, vec: Vector3d; same code as beam_from_line_vec
beam_from_line_vec_4 = GhPythonScript(guid=id_4, vec=vec_4, W="0.1", H="0.3", update=Button())  # -> out, beam, shape; inputs guid: Guid, vec: Vector3d; same code as beam_from_line_vec
category = ValueList({"A", "B", "C"}, selected="B")
category_2 = ValueList({"A", "B", "C"}, selected="C")
category_3 = ValueList({"A", "B", "C"}, selected="A")
python = GhPythonScript(beams=beam_from_line_vec_2.beam, category=category)  # -> out, beams; inputs beams: list
# ---------- python: Python ----------
__author__ = "aapolina"
__version__ = "2022.06.20"

import rhinoscriptsyntax as rs

for b in beams:
    b.attributes['category']=category
# ---------- end python ----------
python_2 = GhPythonScript(beams=beam_from_line_vec_4.beam, category=category_2)  # -> out, beams; inputs beams: list; same code as python
python_3 = GhPythonScript(beams=beam_from_line_vec.beam, category=category_3)  # -> out, beams; inputs beams: list; same code as python
category_4 = ValueList({"A", "B", "C"}, selected="C")
category_5 = ValueList({"A", "B", "C"}, selected="B")
category_6 = ValueList({"A", "B", "C"}, selected="A")
list = ValueList({"T-Butt", "L-Butt", "L-Miter", "X-Lap": "T-Lap"}, selected="L-Miter")
category_7 = ValueList({"A", "B", "C"}, selected="B")
list_2 = ValueList({"T-Butt", "L-Butt", "L-Miter", "X-Lap": "T-Lap"}, selected="X-Lap")
category_8 = ValueList({"A", "B", "C"}, selected="A")
category_9 = ValueList({"A", "B", "C"}, selected="B")
category_10 = ValueList({"A", "B", "C"}, selected="C")
list_3 = ValueList({"T-Butt", "L-Butt", "L-Miter", "X-Lap": "T-Lap"}, selected="L-Miter")
category_11 = ValueList({"A", "B", "C"}, selected="A")
list_4 = ValueList({"T-Butt", "L-Butt", "L-Miter", "X-Lap": "T-Lap"}, selected="T-Butt")
create_assembly = GhPythonScript(beams=[python.beams, python_3.beams, python_2.beams])  # -> out, model; inputs beams: list
# ---------- create_assembly: Python ----------
__author__ = "aapolina"
__version__ = "2022.04.27"

import rhinoscriptsyntax as rs
import scriptcontext as sc

from compas_timber.assembly.assembly import TimberAssembly
from compas_timber.connections.t_butt import TButtJoint 
from compas_timber.connections.t_lap import TLapJoint

model = TimberAssembly()

for i,beam in enumerate(beams): 
    beam.attributes['id']=i
    model.add_beam(beam)
# ---------- end create_assembly ----------

# ----
# read joints set in rhino doc
# set/override individual joints
list_5 = ValueList({"T-Butt", "T-Lap", "T-Mortise-Tenon": "T-MortiseTenon"}, selected="T-Butt")  # disabled
list_6 = ValueList({"T-Butt", "T-Lap", "T-Mortise-Tenon": "T-MortiseTenon"}, selected="T-Lap")  # disabled
# set joint types
id_of_two_curves = Guid([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])  # disabled
id_of_two_curves_2 = Guid([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])  # disabled
crv = Curve(id_of_two_curves_2)  # disabled
crv_2 = Curve(id_of_two_curves)  # disabled
set_joint = GhPythonScript(IDs=id_of_two_curves_2, joint_type=list_5)  # -> out, set_joint; inputs IDs: list; disabled
# ---------- set_joint: Python ----------
__author__ = "aapolina"
__version__ = "2022.05.04"

import rhinoscriptsyntax as rs
from compas_ghpython.utilities import unload_modules
import compas_timber
unload_modules('compas_timber')
from ghpythonlib.treehelpers import list_to_tree


set_joint = [IDs + [joint_type]]
#set_joint = list_to_tree(set_joint)
# ---------- end set_joint ----------
set_joint_2 = GhPythonScript(IDs=id_of_two_curves, joint_type=list_6)  # -> out, set_joint; inputs IDs: list; disabled; same code as set_joint
joints_from_rhdoc = GhPythonScript(model=create_assembly.model)  # -> out, model; disabled
# ---------- joints_from_rhdoc: Python ----------
__author__ = "aapolina"
__version__ = "2022.04.27"

import rhinoscriptsyntax as rs
import scriptcontext as sc

from compas_timber.assembly.assembly import TimberAssembly
from compas_timber.connections.t_butt import TButtJoint 
from compas_timber.connections.t_lap import TLapJoint
import copy
#model = copy.deepcopy(model)

if 'manual_joints' in sc.sticky.keys():

    manual_joints = sc.sticky['manual_joints']
    print manual_joints

    for mj in manual_joints:
        #find Beam objects for the guids
        guid1, guid2, joint_type = mj
        guid1 = guid1.ToString()
        guid2 = guid2.ToString()
        B1 = None
        B2 = None
        for b in model.beams:
            if b.attributes['rhino_guid']==guid1: 
                B1=b
                #break
            if b.attributes['rhino_guid']==guid2: 
                B2=b
                #break
        if B1 and B2:
            print B1,B2
            if joint_type =='T-Butt': 
                joint = TButtJoint(model, B1, B2)
            if joint_type =='T-Lap':
                joint = TLapJoint(model, B1, B2)
                #TODO: somehow the B1 and B2 are not passed on to the Joint class
                pass
    print model.joints

else:
    print "no manual joints found"

print "%s joints found"%len(model.joints)
# ---------- end joints_from_rhdoc ----------
joints_from_gh = GhPythonScript(model=joints_from_rhdoc.model, joint_type_overrides=[set_joint_2.set_joint, set_joint.set_joint])  # -> out, model; inputs joint_type_overrides: list; disabled
# ---------- joints_from_gh: Python ----------
__author__ = "aapolina"
__version__ = "2022.05.04"


import rhinoscriptsyntax as rs
import scriptcontext as sc

from compas_timber.connections.t_butt import TButtJoint 
from compas_timber.connections.t_lap import TLapJoint

import copy
#model = copy.deepcopy(model)

for mj in joint_type_overrides:
    #find Beam objects for the guids
    guid1, guid2, joint_type = mj
    B1 = None
    B2 = None
    for b in model.beams:
        if b.attributes['rhino_guid']==guid1: 
            B1=b
        if b.attributes['rhino_guid']==guid2: 
            B2=b

    if B1 and B2:
        if joint_type =='T-Butt': 
            joint = TButtJoint(B1, B2, model)
            print"joint beams:", joint.beams
        if joint_type =='T-Lap':
            joint = TLapJoint(B1, B2, model)
            #TODO: somehow the B1 and B2 are not passed on to the Joint class
            pass


for joint in model.joints: 
    print "joint beams:", joint.beams
print "%s joints found"%len(model.joints)
# ---------- end joints_from_gh ----------

ghpython_script = GhPythonScript(category_beam1=category_4, category_beam2=category_6, default_joint_type=list)  # -> out, joint_rule
# ---------- ghpython_script: Python ----------
__author__ = "aapolina"
__version__ = "2022.06.20"

from compas_timber.connections.t_butt import TButtJoint
from compas_timber.connections.l_butt import LButtJoint
from compas_timber.connections.l_miter import LMiterJoint
from compas_timber.connections.x_lap import XLapJoint

import rhinoscriptsyntax as rs

joint_rule = [(category_beam1, category_beam2, default_joint_type)]
print joint_rule
# ---------- end ghpython_script ----------
ghpython_script_2 = GhPythonScript(category_beam1=category_5, category_beam2=category_7, default_joint_type=list_2)  # -> out, joint_rule; same code as ghpython_script
ghpython_script_3 = GhPythonScript(category_beam1=category_8, category_beam2=category_10, default_joint_type=list_3)  # -> out, joint_rule; same code as ghpython_script
ghpython_script_4 = GhPythonScript(category_beam1=category_9, category_beam2=category_11, default_joint_type=list_4)  # -> out, joint_rule; same code as ghpython_script
panel = Panel(joints_from_gh.out)  # disabled
data = Data([ghpython_script_2.joint_rule, ghpython_script_4.joint_rule, ghpython_script_3.joint_rule, ghpython_script.joint_rule])
auto_find_joints = GhPythonScript(model=flatten(create_assembly.model), max_distance=flatten(Slider(0.2, range=0..1)), joint_rules=flatten(data))  # -> out, topo_txt, model; inputs joint_rules: list
# ---------- auto_find_joints: Python ----------
__author__ = "aapolina"
__version__ = "2022.04.07"

import rhinoscriptsyntax as rs

from compas_timber.utils.compas_extra import intersection_line_line_3D
from compas_timber.connections.t_butt import TButtJoint
from compas_timber.connections.l_miter import LMiterJoint
from compas_timber.connections.x_lap import XLapJoint
from compas_timber.utils.workflow import guess_joint_topology_2beams
import copy
#model = copy.deepcopy(model)

beams = model.beams

n = len(beams)

connections_txt = []
connectivity = {
'L':[],
'T':[],
'X':[]
}


# find what kind of joint topology it looks like based on centerlines
for i in range(n-1):
    for j in range(i+1,n):
        jointtype, beams_pair = guess_joint_topology_2beams(beams[i], beams[j], tol=1e-3)
        if jointtype:
            connectivity[jointtype].append(beams_pair)

topo_txt=""
for key in connectivity.keys():
    topo_txt+="%s: %s\n"%(key,[(bA.attributes['id'],bB.attributes['id']) for bA,bB in connectivity[key]])


#Rephrase joint rules:
rules_dict = {}
for jr in joint_rules: 
    key = "%s+%s"%(jr[0],jr[1])
    rules_dict[key]=jr[2]

#Apply default joint types depending on the auto-found connectivity type:

log = []

for beamA, beamB in connectivity['T']:
    key = "%s+%s"%(beamA.attributes['category'],beamB.attributes['category'])
    try: 
        joint_type = rules_dict[key]
        if joint_type[0]!='T': pass
        else:
            if joint_type == "T-Butt": TButtJoint(beamA, beamB, model)
    except: log.append(('T',beamA.attributes['category'],beamB.attributes['category']))

for beamA, beamB in connectivity['L']:
    key = "%s+%s"%(beamA.attributes['category'],beamB.attributes['category'])
    try: 
        joint_type = rules_dict[key]
        if joint_type[0]!='L': pass
        else:
            if joint_type == "L-Butt": LButtJoint(beamA, beamB, model)
            if joint_type == "L-Miter": LMiterJoint(beamA, beamB, model)
    except: log.append(('L',beamA.attributes['category'],beamB.attributes['category']))


for beamA, beamB in connectivity['X']:
    key = "%s+%s"%(beamA.attributes['category'],beamB.attributes['category'])
    try: 
        joint_type = rules_dict[key]
        if joint_type[0]!='X': pass
        else:
            if joint_type == "X-Lap": XLapJoint(beamA, beamB, model)
    except: log.append(('X',beamA.attributes['category'],beamB.attributes['category']))


log = set(log)
txt = "Connections found for following topologies and categories, for which no matching rules were found:\n"
for t,b1,b2 in log:
    txt+="%s: %s+%s\n"%(t,b1,b2)
print txt
# ---------- end auto_find_joints ----------
joint_type_preview = GhPythonScript(model=auto_find_joints.model)  # -> out, joint_tag_pt, joint_tag_txt
# ---------- joint_type_preview: Python ----------
__author__ = "aapolina"
__version__ = "2022.04.27"

import rhinoscriptsyntax as rs
from compas_timber.utils.compas_extra import intersection_line_line_3D
from compas_timber.utils.rhino_compas import cPt2rPt
from compas_timber.parts.beam import Beam

joint_tag_pt = []
joint_tag_txt = []


print "%s joints found"%len(model.joints)

for joint in model.joints:
    #print joint.parts, type(joint.parts[0]), [part for part in joint.parts if type(part).__name__ == Beam.__name__]

    L1,L2 = [b.centreline for b in joint.beams]
    p1,p2 = intersection_line_line_3D(L1,L2, 0.2, False, False, 1e-3)
    print p1,p2, joint.joint_type
    p1 = cPt2rPt(p1)
    p2 = cPt2rPt(p2)
    
    joint_tag_pt.append((p2+p1)/2)
    joint_tag_txt.append(joint.joint_type)
# ---------- end joint_type_preview ----------
beam_id = GhPythonScript(model=auto_find_joints.model, t=Slider(0.47, range=0..1))  # -> out, pt, id; inputs beams: list
# ---------- beam_id: Python ----------
__author__ = "aapolina"
__version__ = "2022.03.15"

import rhinoscriptsyntax as rs
from compas_timber.utils.rhino_compas import cPt2rPt
from compas.geometry import Point
from compas.geometry import add_vectors

id = []
pt = []


def pt_on_centreline(beam,t):
    return Point(*add_vectors(beam.frame.point, beam.frame.xaxis*beam.length*t))

if not t: t=0.5

if model:
    beams = model.beams
    pt = [pt_on_centreline(beam,t) for beam in beams]
    id = [beam.key for beam in beams]
elif beams:
    pt = [pt_on_centreline(beam,t) for beam in beams]
    id = range(len(beams))
else:
    pass


pt = [cPt2rPt(p) for p in pt]
# ---------- end beam_id ----------
panel_2 = Panel(auto_find_joints.topo_txt)
panel_3 = Panel(auto_find_joints.out)
make_t_joints = GhPythonScript(model=auto_find_joints.model)  # -> out, model, trimmed_breps, box_breps, cutting_planes
# ---------- make_t_joints: Python ----------
__author__ = "aapolina"
__version__ = "2022.03.08"

import rhinoscriptsyntax as rs
from ghpythonlib.treehelpers import list_to_tree
import Rhino.Geometry as rg 

from compas.geometry import Point
from compas_timber.utils.rhino_compas import cPln2rPln, cBox2rBox


for beam in model.beams: beam.clear_features() 


for joint in model.joints:
    joint.add_feature()

box_breps = []
cutting_planes = []

boolsets = []

for beam in model.beams:
    box_brep= cBox2rBox(beam.shape).ToBrep()
    cplns = [cPln2rPln(feat[0]) for feat in beam.features if feat[1]=='trim']
    boolsets.append([box_brep, cplns])
    
    box_breps.append(box_brep)
    cutting_planes.extend(cplns)

x = []
for b,p in boolsets:
    if p:
        bi = b
        for pi in p:
            pi.Flip()
            bx = rg.Brep.Trim(bi,pi,1e-6)
            if len(bx)==0:
                print("trim failed - nothing trimmed?")
            elif len(bx)==1:
                bi=bx[0]
            else:
                print("%s parts after trimming - adding none"%len(bx))
        bi = bi.CapPlanarHoles(1e-6)
        x.append(bi)
    else:
        x.append(b)
        

trimmed_breps = x
# ---------- end make_t_joints ----------
tag = TextTag(Location=beam_id.pt, Text=beam_id.id, Colour=RGB(255, 255, 255))
tag_2 = TextTag(Location=joint_type_preview.joint_tag_pt, Text=joint_type_preview.joint_tag_txt)
geo = Geometry(make_t_joints.trimmed_breps)
brep = Brep(geo)

# ----
# bake with texture mapping
python_4 = GhPythonScript(model=make_t_joints.model)  # -> out, brep, beam_frame; disabled
# ---------- python_4: Python ----------
__author__ = "aapolina"
__version__ = "2022.03.11"

import rhinoscriptsyntax as rs
from compas_timber.utils.rhino_compas import cFrame2rPln, cBox2rBox



beam_frame = [cFrame2rPln(beam.frame) for beam in model.beams]


brep=[cBox2rBox(beam.shape) for beam in model.beams]
# ---------- end python_4 ----------
button = Button()  # disabled
new = _new(brep=flatten(brep), beam_frame=flatten(python_4.beam_frame), bake=button)  # -> out, map_pln, Model; inputs brep: Brep, bake: Boolean; disabled
# ---------- new: Python ----------
# -*- coding: utf-8 -*-
import Rhino.Geometry as rg
import scriptcontext as sc
import math
import copy
import Rhino.Render as rr
import rhinoscriptsyntax as rs
import Rhino
import random

def create_box_map(pln,sx,sy,sz):
    """
    pln: frame of beam box, where x=main axis, y=width, z=height
    sx,sy,sz: box map size in x,y,z direction
    """

    v = pln.YAxis
    w = pln.ZAxis
    pt = pln.Origin

    #random deviation 
    a = math.pi*0.5
    randangle = (random.random()-0.5)*a
    v.Rotate(randangle,pln.XAxis)
    
    b = math.pi*0.01
    randangle = (random.random()-0.5)*b
    w.Rotate(randangle,pln.XAxis)
    
    randpos = dimx*random.random()
    pt += pln.XAxis*randpos
    
    #create box mapping
    mappingPln = rg.Plane(pt, w, v)
    dx = rg.Interval(-sx*0.5,sx*0.5)
    dy = rg.Interval(-sy*0.5,sy*0.5)
    dz = rg.Interval(-sz*0.5,sz*0.5)

    BoxMap = Rhino.Render.TextureMapping.CreateBoxMapping(mappingPln, dx, dy, dz, False)

    return BoxMap, mappingPln


if not map_size:
    #for the pine 251 material bitmap, rotated
    dimx = 0.2
    dimy = 0.2
    dimz = 1.0
else:
    dimx,dimy,dimz = map_size

if bake:
    rs.EnableRedraw(False)
    sc.doc = Rhino.RhinoDoc.ActiveDoc

    attributes = None
    guid = sc.doc.Objects.Add(brep, attributes)

    boxmap,map_pln = create_box_map(beam_frame,dimx,dimy,dimz)
    sc.doc.Objects.ModifyTextureMapping(guid, 1, boxmap)


    sc.doc = ghdoc
    rs.EnableRedraw(True)
    rs.Redraw()
# ---------- end new ----------

preview = CustomPreview(Geometry=brep, Material=ColourSwatch(SwatchColor=RGB(196, 196, 196)))
crv_3 = Curve([<curve referenced from the Rhino model> x11])
vec_5 = Vector(Vector(1, 0, 3))  # disabled
crv_4 = Curve([<curve referenced from the Rhino model> x11])
vec_6 = Vector(Vector(1, 0, 3))  # disabled
beam_from_line_vec_5 = GhPythonScript(line=crv_3, vec=vec_5, W="0.1", H="0.2")  # -> out, beam, shape; inputs line: Line, vec: Vector3d
# ---------- beam_from_line_vec_5: Python ----------
__author__ = "aapolina"
__version__ = "2021.12.10"

from compas_ghpython.utilities import unload_modules
import Rhino.Geometry as rg

import compas_timber
reload(compas_timber)
unload_modules('compas_timber')
from compas_timber.parts.beam import Beam
from compas_timber.utils.rhino_compas import rVec2cVec, cBox2rBox, rLine2cLine

v = rVec2cVec(vec) 

beam = Beam.from_centreline(rLine2cLine(line),rVec2cVec(vec),W,H)
shape = cBox2rBox(beam.shape)
# ---------- end beam_from_line_vec_5 ----------
beam_from_line_vec_6 = GhPythonScript(line=crv_4, vec=vec_6, W="0.1", H="0.2")  # -> out, beam, shape; inputs line: Line, vec: Vector3d; same code as beam_from_line_vec_5

# ----
# auto-find joint topologies
number_slider = Slider(0.15, range=0..1)
auto_find_joints_2 = GhPythonScript(beams=beam_from_line_vec_5.beam, max_distance=number_slider)  # -> out, connectivity, connections_txt; inputs beams: list
# ---------- auto_find_joints_2: Python ----------
__author__ = "aapolina"
__version__ = "2022.04.07"

import rhinoscriptsyntax as rs
from compas_timber.utils.compas_extra import intersection_line_line_3D

tol = 1e-3
if max_distance<tol: max_distance=tol

centrelines = [b.centreline for b in beams]

n = len(centrelines)

def is_near_end(t, tol=tol):
    if abs(t)<tol: return True #almost zero
    if abs(1.0-t)<tol: return True #almost 1
    return False
    
connections_txt = []
connectivity = {
'L':[],
'T':[],
'X':[]
}

for i in range(n-1):
    for j in range(i+1,n):
        ti,tj = intersection_line_line_3D(centrelines[i], centrelines[j], max_distance, True, True, tol)
        
        if ti==None or tj==None: continue
        xi=is_near_end(ti)
        xj=is_near_end(tj)
        if all([xi,xj]):
            #L-joint (meeting at ends)
            connections_txt.append("%s & %s --> %s"%(i,j,'L'))
            connectivity['L'].append([i,j])
        elif not any([xi,xj]):
            #X-joint (meeting somewhere along the line)
            connections_txt.append("%s & %s --> %s"%(i,j,'X'))
            connectivity['X'].append([i,j])
        else:
            #T-joint (one meeting with the end along the other)
            if xi:
                #i:main, j:cross
                connections_txt.append("%s & %s --> %s"%(i,j,'T'))
                connectivity['T'].append([i,j])
            if xj:
                #j:main, i:cross
                connections_txt.append("%s & %s --> %s"%(j,i,'T'))
                connectivity['T'].append([j,i])

connectivity = [connectivity]
# ---------- end auto_find_joints_2 ----------
assembly = GhPythonScript(beams=beam_from_line_vec_5.beam, connectivity=auto_find_joints_2.connectivity)  # -> out, model; inputs beams: list, connectivity: list
# ---------- assembly: Python ----------
__author__ = "aapolina"
__version__ = "2021.11.30"

import compas_ghpython 
import compas_timber
compas_ghpython.utilities.unload_modules("compas_timber")

from compas_timber.assembly.assembly import TimberAssembly
from compas_timber.connections.t_butt import TButtJoint

connectivity = connectivity[0]

model = TimberAssembly()



for beam in beams: model.add_beam(beam)

for ci,cj in connectivity['L']:
    pass
for ci,cj in connectivity['X']:
    pass
for ci,cj in connectivity['T']:
    joint = TButtJoint(model,beams[ci], beams[cj]) 


print model
geometry = [b.geometry for b in model.beams]
# ---------- end assembly ----------
# TODO:
# connection types --> joints
# 
# T-joint:
#    - butt
#    - mortise-tenon
#    - dove-tail
# 
# L-joint:
#    - miter
#    - fake T-joint
#    - corner lap joint
#    - miter half lap
# 
# X-joint:
#    - lap joint
#    - side-to-side (no lap)
# 
# I-joint (co-linear):
#    - butt
#    - splice
# TODO:
# how to detect / create a splice connection?
# (LLX will ignore it, because lines are parallel)
panel_4 = Panel(auto_find_joints_2.connections_txt)

to_from = Panel("""{0,2}
{1,2}
{0,3}
{1,3}
{0,4}
{1,4}
{0,5}
{1,5}
{3,6}
{4,6}""")  # disabled
list_7 = ValueList({"T-butt", "Lap"}, selected="T-butt")  # disabled
manual_connect = GhPythonScript(beams=beam_from_line_vec_6.beam, connectivity=to_from, joint_type=list_7)  # -> out, beams, model, geometry; inputs beams: list, connectivity: list; disabled
# ---------- manual_connect: Python ----------
__author__ = "aapolina"
__version__ = "2021.11.30"

import compas_ghpython 
import compas_timber
compas_ghpython.utilities.unload_modules("compas_timber")
#import compas_timber
#reload(compas_timber)

from compas_timber.assembly.assembly import TimberAssembly
from compas_timber.connections.t_butt import TButtJoint

model = TimberAssembly()

for beam in beams: model.add_beam(beam)
con_list = [[int(c.Real),int(c.Imaginary)] for c in connectivity]

for ci,cj in con_list:
    joint = None
    if joint_type == "T-butt": joint = TButtJoint(model,beams[cj],beams[ci]) #TODO
    if joint_type == "Lap":    joint = Lap() #TODO


geometry = [b.geometry for b in model.beams]
# ---------- end manual_connect ----------
python_5 = GhPythonScript(model=manual_connect.model)  # -> out, brep, beam_frame; disabled; same code as python_4
butt_jointed_geo = GhPythonScript(model=manual_connect.model)  # -> out, trimmed_breps; disabled
# ---------- butt_jointed_geo: Python ----------
__author__ = "aapolina"
__version__ = "2022.03.08"

import rhinoscriptsyntax as rs
from compas_timber.utils.rhino_compas import cPln2rPln, cBox2rBox
from ghpythonlib.treehelpers import list_to_tree
import Rhino.Geometry as rg 


joints = model.joints
print(joints)


#TODO: temporary, assuming no other features than those from butt joints, to prevent accumulation (gh)
for beam in model.beams: beam.clear_features() 

for joint in joints: joint.apply_feature()

box_breps = []
cutting_planes = []
for beam in model.beams:
    box_breps.append(cBox2rBox(beam.shape))
    cplns = [cPln2rPln(feat[0]) for feat in beam.features if feat[1]=='trim']
    cutting_planes.append(cplns)

x = []
for b,p in zip(box_breps, cutting_planes):
    b = b.ToBrep()
    if p:
        bi = b
        for pi in p:
            pi.Flip()
            bx = rg.Brep.Trim(bi,pi,1e-6)
            if len(bx)==0:
                print("trim failed - nothing trimmed?")
            elif len(bx)==1:
                bi=bx[0]
            else:
                print("%s parts after trimming - adding none"%len(bx))
        bi = bi.CapPlanarHoles(1e-6)
        x.append(bi)
    else:
        x.append(b)
        

trimmed_breps = x
# ---------- end butt_jointed_geo ----------
button_2 = Button()  # disabled
make_t_joints_2 = GhPythonScript(model=assembly.model)  # -> out, model, trimmed_breps
# ---------- make_t_joints_2: Python ----------
__author__ = "aapolina"
__version__ = "2022.03.08"

import rhinoscriptsyntax as rs
from compas_timber.utils.rhino_compas import cPln2rPln, cBox2rBox
from ghpythonlib.treehelpers import list_to_tree
import Rhino.Geometry as rg 


#TODO: temporary, assuming no other features than those from butt joints, to prevent accumulation (gh)
for beam in model.beams: beam.clear_features() 

for joint in model.joints:
    joint.apply_feature()

box_breps = []
cutting_planes = []
for beam in model.beams:
    box_breps.append(cBox2rBox(beam.shape))
    cplns = [cPln2rPln(feat[0]) for feat in beam.features if feat[1]=='trim']
    cutting_planes.append(cplns)

x = []
for b,p in zip(box_breps, cutting_planes):
    b = b.ToBrep()
    if p:
        bi = b
        for pi in p:
            pi.Flip()
            bx = rg.Brep.Trim(bi,pi,1e-6)
            if len(bx)==0:
                print("trim failed - nothing trimmed?")
            elif len(bx)==1:
                bi=bx[0]
            else:
                print("%s parts after trimming - adding none"%len(bx))
        bi = bi.CapPlanarHoles(1e-6)
        x.append(bi)
    else:
        x.append(b)
        

trimmed_breps = x
# ---------- end make_t_joints_2 ----------
new_2 = _new(brep=flatten(butt_jointed_geo.trimmed_breps), beam_frame=flatten(python_5.beam_frame), bake=button_2)  # -> out, map_pln, Model; inputs brep: Brep, bake: Boolean; disabled; same code as new
python_6 = GhPythonScript()  # -> out, a
# ---------- python_6: Python ----------
__author__ = "aapolina"
__version__ = "2022.04.29"

import rhinoscriptsyntax as rs

print ghdoc
# ---------- end python_6 ----------
brep_2 = Brep(make_t_joints_2.trimmed_breps)
preview_2 = CustomPreview(Geometry=brep_2, Material=ColourSwatch(SwatchColor=RGB(196, 196, 196)))
show = GhPythonScript()  # -> out, geometry; inputs whatever: list; disabled
# ---------- show: Python ----------
__author__ = "aapolina"
__version__ = "2021.11.26"

import compas_timber
reload(compas_timber)

from compas_timber.parts.beam import Beam
from compas_timber.utils.rhino_compas import brep_from8points, list2rPt

geometry = []

for smth in whatever:
    if isinstance(smth,Beam):
        B = brep_from8points([list2rPt(p) for p in smth.corners])
        geometry.append(B)
# ---------- end show ----------
number_slider_2 = Slider(0.12, range=0..1)  # disabled
number_slider_3 = Slider(0.19, range=0..1)  # disabled
number_slider_4 = Slider(2.68, range=0..10)  # disabled
pt = Point(Point(0, 0, 0))  # disabled
pt_2 = Point(Point(5, 0, 0))  # disabled
vec_7 = Vector(Vector(-1, 1, 0))  # disabled
vdis = VectorDisplay(Anchor=pt, Vector=vec_7)  # disabled
pln = Plane(Plane(origin=(-2, 0, 0), x=(0.8320502943, -0.5547001962, 0), y=(0.3922322703, 0.5883484054, 0.7071067812)))  # disabled
ln = Line(StartPoint=pt, EndPoint=pt_2)  # disabled
beam_from_points_vec = GhPythonScript(ps=pt, pe=pt_2, vec=vec_7, W=number_slider_2, H=number_slider_3)  # -> out, beam, shape; inputs ps: Point3d, pe: Point3d, vec: Vector3d; disabled
# ---------- beam_from_points_vec: Python ----------
__author__ = "aapolina"
__version__ = "2021.12.10"

import Rhino.Geometry as rg
from compas_ghpython.utilities import unload_modules


import compas_timber
reload(compas_timber)
unload_modules('compas_timber')
from compas_timber.parts.beam import Beam
from compas_timber.utils.rhino_compas import rVec2cVec, rPt2cPt, cBox2rBox

beam = Beam.from_endpoints(rPt2cPt(ps), rPt2cPt(pe), rVec2cVec(vec),W,H)
shape = cBox2rBox(beam.shape)
# ---------- end beam_from_points_vec ----------
beam_from_line_vec_7 = GhPythonScript(line=ln, vec=vec_7, W=number_slider_2, H=number_slider_3)  # -> out, beam, shape; inputs line: Line, vec: Vector3d; disabled; same code as beam_from_line_vec_5
beam_from_frame = GhPythonScript(pln=pln, W=number_slider_2, H=number_slider_3, L=number_slider_4)  # -> out, beam, shape; inputs pln: Plane; disabled
# ---------- beam_from_frame: Python ----------
__author__ = "aapolina"
__version__ = "2021.12.10"

import Rhino.Geometry as rg
import compas_timber
from compas_timber.parts.beam import Beam
from compas_timber.utils.rhino_compas import rPln2cFrame, cBox2rBox
from compas_ghpython import unload_modules
unload_modules('compas_timber')
reload(compas_timber)

beam = Beam(rPln2cFrame(pln),L,W,H)

beam = Beam.from_frame(rPln2cFrame(pln),W,H,L)


shape = cBox2rBox(beam.shape)
# ---------- end beam_from_frame ----------
number_slider_5 = Slider(5, range=-1..5)  # disabled
vec_8 = Vector(Vector(5, 2, 0))  # disabled
vec_9 = Vector(Vector(1, 0, 2))  # disabled
move = GhPythonScript(beam=beam_from_line_vec_7.beam, vec_start=vec_8)  # -> out, beam, shape; inputs vec_start: Vector3d, vec_end: Vector3d; disabled
# ---------- move: Python ----------
__author__ = "aapolina"
__version__ = "2021.12.17"



import rhinoscriptsyntax as rs
from compas_timber.utils.rhino_compas import rVec2cVec, cBox2rBox

beam = beam.copy()

if vec_start: 
    vec_start = rVec2cVec(vec_start)
    beam.move_endpoint(vec_start,'start')

if vec_end:
    vec_end = rVec2cVec(vec_end)
    beam.move_endpoint(vec_end,'end')

shape = cBox2rBox(beam.shape)
# ---------- end move ----------
python_7 = GhPythonScript(beam=beam_from_frame.beam, frame_index=number_slider_5)  # -> out, pln; disabled
# ---------- python_7: Python ----------
__author__ = "aapolina"
__version__ = "2022.01.25"

import rhinoscriptsyntax as rs
from compas_timber.utils.rhino_compas import cFrame2rPln

if frame_index==-1: 
    cframe = beam.frame
else:
    cframe = beam.side_frame(frame_index)
    
    
pln = cFrame2rPln(cframe)
# ---------- end python_7 ----------
orient = GhPythonScript(beam=beam_from_frame.beam, vec=vec_9)  # -> out, beam, shape; inputs vec: Vector3d; disabled
# ---------- orient: Python ----------
__author__ = "aapolina"
__version__ = "2021.12.17"

beam = beam.copy()

import rhinoscriptsyntax as rs
from compas_timber.utils.rhino_compas import rVec2cVec, cBox2rBox
vec = rVec2cVec(vec)

beam.align_z(vec)
shape = cBox2rBox(beam.shape)
# ---------- end orient ----------

number_slider_6 = Slider(0.68, range=0.01..1)  # disabled
deplane = DeconstructPlane(Plane=python_7.pln)  # -> Origin, XAxis, YAxis, ZAxis; disabled
amp = Amplitude(Vector=deplane.YAxis, Amplitude=number_slider_6)  # disabled
amp_2 = Amplitude(Vector=deplane.XAxis, Amplitude=number_slider_6)  # disabled
amp_3 = Amplitude(Vector=deplane.ZAxis, Amplitude=number_slider_6)  # disabled
swatch = ColourSwatch(SwatchColor=RGB(255, 143, 143))  # disabled
swatch_2 = ColourSwatch(SwatchColor=RGB(185, 255, 110))  # disabled
swatch_3 = ColourSwatch(SwatchColor=RGB(110, 243, 255))  # disabled
vdisex = VectorDisplayEx(Point=deplane.Origin, Vector=amp_2, Colour=swatch, Width=2)  # disabled
vdisex_2 = VectorDisplayEx(Point=deplane.Origin, Vector=amp, Colour=swatch_2, Width=2)  # disabled
vdisex_3 = VectorDisplayEx(Point=deplane.Origin, Vector=amp_3, Colour=swatch_3, Width=2)  # disabled
