# Grasshopper definition beam.gh (Grasshopper 1.0.7)

crv = Curve([<curve referenced from the Rhino model> x7])
vec = Vector(Vector(1, 0, 3))  # disabled
crv_2 = Curve([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])
vec_2 = Vector(Vector(1, 0, 3))
beam_from_line_vec = GhPythonScript(line=crv, vec=vec, W="0.1", H="0.2")  # -> out, beam, shape; inputs line: Line, vec: Vector3d
# ---------- beam_from_line_vec: Python ----------
__author__ = "aapolina"
__version__ = "2021.12.10"

from compas_ghpython.utilities import unload_modules
import Rhino.Geometry as rg

import compas_timber
reload(compas_timber)
unload_modules('compas_timber')
from compas_timber.parts.beam import Beam
from compas_timber.utils.rhino_compas import rVec2cVec, cBox2rBox, rLine2cLine

v = rVec2cVec(vec) 

beam = Beam.from_centreline(rLine2cLine(line),rVec2cVec(vec),W,H)
shape = cBox2rBox(beam.shape)
# ---------- end beam_from_line_vec ----------
to_from = Panel("""{0,2}
{1,2}
{0,3}
{1,3}
{0,4}
{1,4}
{0,5}
{1,5}
{3,6}
{4,6}""")
beam_from_line_vec_2 = GhPythonScript(line=crv_2, vec=vec_2, W="0.1", H="0.2")  # -> out, beam, shape; inputs line: Line, vec: Vector3d; same code as beam_from_line_vec
list = ValueList({"T-butt", "Lap"}, selected="T-butt")
panel = Panel("""{0,1}
{1,2}
{0,2}""")
list_2 = ValueList({"T-butt", "Lap"}, selected="T-butt")
list_3 = ValueList({"T-butt", "Lap"}, selected="T-butt")
beam_id = GhPythonScript(beams=beam_from_line_vec.beam, t=Slider(0.36, range=0..1))  # -> out, pt, id; inputs beams: list
# ---------- beam_id: Python ----------
__author__ = "aapolina"
__version__ = "2022.03.15"

import rhinoscriptsyntax as rs
from compas_timber.utils.rhino_compas import cPt2rPt
from compas.geometry import Point
from compas.geometry import add_vectors

id = []
pt = []


def pt_on_centreline(beam,t):
    return Point(*add_vectors(beam.frame.point, beam.frame.xaxis*beam.length*t))

if not t: t=0.5

if model:
    beams = model.beams
    pt = [pt_on_centreline(beam,t) for beam in beams]
    id = [beam.key for beam in beams]
elif beams:
    pt = [pt_on_centreline(beam,t) for beam in beams]
    id = range(len(beams))
else:
    pass


pt = [cPt2rPt(p) for p in pt]
# ---------- end beam_id ----------
manual_connect = GhPythonScript(beams=beam_from_line_vec.beam, connectivity=to_from, joint_type=list)  # -> out, beams, model, geometry; inputs beams: list, connectivity: list
# ---------- manual_connect: Python ----------
__author__ = "aapolina"
__version__ = "2021.11.30"

import compas_ghpython 
import compas_timber
compas_ghpython.utilities.unload_modules("compas_timber")
#import compas_timber
#reload(compas_timber)

from compas_timber.assembly.assembly import TimberAssembly
from compas_timber.connections.t_butt import TButtJoint

model = TimberAssembly()

for beam in beams: model.add_beam(beam)
con_list = [[int(c.Real),int(c.Imaginary)] for c in connectivity]

for ci,cj in con_list:
    joint = None
    if joint_type == "T-butt": joint = TButtJoint(beams[cj],beams[ci]) #TODO
    if joint_type == "Lap":    joint = Lap() #TODO
    model.add_joint(joint)
    model.connect([beams[ci], beams[cj]], joint)


geometry = [b.geometry for b in model.beams]
# ---------- end manual_connect ----------
auto_connect = GhPythonScript(beams=beam_from_line_vec.beam, joint_type=list_2)  # -> out, beams, assembly_model; inputs beams: list; disabled
# ---------- auto_connect: Python ----------
__author__ = "aapolina"
__version__ = "2021.11.30"

import compas_ghpython 
import compas_timber
compas_ghpython.utilities.unload_modules("compas_timber")
#import compas_timber
#reload(compas_timber)

from compas_timber.assembly.assembly import TimberAssembly
from compas_timber.connections.t_butt import TButtJoint

model = Assembly()

for beam in beams: 
    model.add_beam(beam)

tol = 1e-3
for crossbeam in model.beams:
    
    for mainbeam in model.beams:
        if crossbeam==mainbeam: continue
        if mainbeam.end1.pt.distance_to_line(crossbeam.centreline) <tol:
            print "connecting!"
            tjoint = TButtJoint(crossbeam, mainbeam.end1, gap)
            model.connect(crossbeam, mainbeam, tjoint)
        if mainbeam.end2.pt.distance_to_line(crossbeam.centreline) <tol:
            print "connecting!"
            tjoint = TButtJoint(crossbeam, mainbeam.end2, gap)
            model.connect(crossbeam, mainbeam, tjoint)
# ---------- end auto_connect ----------
list_4 = ValueList({"T-butt", "Lap"}, selected="T-butt")
show = GhPythonScript()  # -> out, geometry; inputs whatever: list; disabled
# ---------- show: Python ----------
__author__ = "aapolina"
__version__ = "2021.11.26"

import compas_timber
reload(compas_timber)

from compas_timber.parts.beam import Beam
from compas_timber.utils.rhino_compas import brep_from8points, list2rPt

geometry = []

for smth in whatever:
    if isinstance(smth,Beam):
        B = brep_from8points([list2rPt(p) for p in smth.corners])
        geometry.append(B)
# ---------- end show ----------
beam_id_2 = GhPythonScript(beams=beam_from_line_vec_2.beam, t=Slider(0.36, range=0..1))  # -> out, pt, id; inputs beams: list; same code as beam_id
tag = TextTag(Location=beam_id.pt, Text=beam_id.id, Colour=RGB(255, 255, 255))
manual_connect_2 = GhPythonScript(beams=beam_from_line_vec_2.beam, connectivity=panel, joint_type=list_3)  # -> out, beams, model, geometry; inputs beams: list, connectivity: list; same code as manual_connect
auto_connect_2 = GhPythonScript(beams=beam_from_line_vec_2.beam, joint_type=list_4)  # -> out, beams, assembly_model; inputs beams: list; disabled; same code as auto_connect
number_slider = Slider(0.12, range=0..1)  # disabled
number_slider_2 = Slider(2.68, range=0..10)  # disabled
number_slider_3 = Slider(0.19, range=0..1)  # disabled
butt_jointed_geo = GhPythonScript(model=manual_connect.model)  # -> out, trimmed_breps
# ---------- butt_jointed_geo: Python ----------
__author__ = "aapolina"
__version__ = "2022.03.08"

import rhinoscriptsyntax as rs
from compas_timber.utils.rhino_compas import cPln2rPln, cBox2rBox
from ghpythonlib.treehelpers import list_to_tree
import Rhino.Geometry as rg 


joints = model.joints
print(joints)


#TODO: temporary, assuming no other features than those from butt joints, to prevent accumulation (gh)
for beam in model.beams: beam.clear_features() 

for joint in joints: joint.apply_feature()

box_breps = []
cutting_planes = []
for beam in model.beams:
    box_breps.append(cBox2rBox(beam.shape))
    cplns = [cPln2rPln(feat[0]) for feat in beam.features if feat[1]=='trim']
    cutting_planes.append(cplns)

x = []
for b,p in zip(box_breps, cutting_planes):
    b = b.ToBrep()
    if p:
        bi = b
        for pi in p:
            pi.Flip()
            bx = rg.Brep.Trim(bi,pi,1e-6)
            if len(bx)==0:
                print("trim failed - nothing trimmed?")
            elif len(bx)==1:
                bi=bx[0]
            else:
                print("%s parts after trimming - adding none"%len(bx))
        bi = bi.CapPlanarHoles(1e-6)
        x.append(bi)
    else:
        x.append(b)
        

trimmed_breps = x
# ---------- end butt_jointed_geo ----------
tag_2 = TextTag(Location=beam_id_2.pt, Text=beam_id_2.id, Colour=RGB(255, 255, 255))
pt = Point(Point(0, 0, 0))  # disabled
vec_3 = Vector(Vector(-1, 1, 0))  # disabled
pt_2 = Point(Point(5, 0, 0))  # disabled
vdis = VectorDisplay(Anchor=pt, Vector=vec_3)  # disabled
butt_jointed_geo_2 = GhPythonScript(model=manual_connect_2.model)  # -> out, trimmed_breps; same code as butt_jointed_geo
pln = Plane(Plane(origin=(-2, 0, 0), x=(0.8320502943, -0.5547001962, 0), y=(0.3922322703, 0.5883484054, 0.7071067812)))  # disabled
ln = Line(StartPoint=pt, EndPoint=pt_2)  # disabled
beam_from_points_vec = GhPythonScript(ps=pt, pe=pt_2, vec=vec_3, W=number_slider, H=number_slider_3)  # -> out, beam, shape; inputs ps: Point3d, pe: Point3d, vec: Vector3d; disabled
# ---------- beam_from_points_vec: Python ----------
__author__ = "aapolina"
__version__ = "2021.12.10"

import Rhino.Geometry as rg
from compas_ghpython.utilities import unload_modules


import compas_timber
reload(compas_timber)
unload_modules('compas_timber')
from compas_timber.parts.beam import Beam
from compas_timber.utils.rhino_compas import rVec2cVec, rPt2cPt, cBox2rBox

beam = Beam.from_endpoints(rPt2cPt(ps), rPt2cPt(pe), rVec2cVec(vec),W,H)
shape = cBox2rBox(beam.shape)
# ---------- end beam_from_points_vec ----------
beam_from_line_vec_3 = GhPythonScript(line=ln, vec=vec_3, W=number_slider, H=number_slider_3)  # -> out, beam, shape; inputs line: Line, vec: Vector3d; disabled; same code as beam_from_line_vec
beam_from_frame = GhPythonScript(pln=pln, W=number_slider, H=number_slider_3, L=number_slider_2)  # -> out, beam, shape; inputs pln: Plane; disabled
# ---------- beam_from_frame: Python ----------
__author__ = "aapolina"
__version__ = "2021.12.10"

import Rhino.Geometry as rg
import compas_timber
from compas_timber.parts.beam import Beam
from compas_timber.utils.rhino_compas import rPln2cFrame, cBox2rBox
from compas_ghpython import unload_modules
unload_modules('compas_timber')
reload(compas_timber)

beam = Beam(rPln2cFrame(pln),L,W,H)

beam = Beam.from_frame(rPln2cFrame(pln),W,H,L)


shape = cBox2rBox(beam.shape)
# ---------- end beam_from_frame ----------
number_slider_4 = Slider(5, range=-1..5)  # disabled
python = GhPythonScript(model=manual_connect.model)  # -> out, brep, beam_frame
# ---------- python: Python ----------
__author__ = "aapolina"
__version__ = "2022.03.11"

import rhinoscriptsyntax as rs
from compas_timber.utils.rhino_compas import cFrame2rPln, cBox2rBox



beam_frame = [cFrame2rPln(beam.frame) for beam in model.beams]


brep=[cBox2rBox(beam.shape) for beam in model.beams]
# ---------- end python ----------
vec_4 = Vector(Vector(5, 2, 0))  # disabled
vec_5 = Vector(Vector(1, 0, 2))  # disabled
python_2 = GhPythonScript(model=manual_connect_2.model)  # -> out, brep, beam_frame; same code as python
move = GhPythonScript(beam=beam_from_line_vec_3.beam, vec_start=vec_4)  # -> out, beam, shape; inputs vec_start: Vector3d, vec_end: Vector3d; disabled
# ---------- move: Python ----------
__author__ = "aapolina"
__version__ = "2021.12.17"



import rhinoscriptsyntax as rs
from compas_timber.utils.rhino_compas import rVec2cVec, cBox2rBox

beam = beam.copy()

if vec_start: 
    vec_start = rVec2cVec(vec_start)
    beam.move_endpoint(vec_start,'start')

if vec_end:
    vec_end = rVec2cVec(vec_end)
    beam.move_endpoint(vec_end,'end')

shape = cBox2rBox(beam.shape)
# ---------- end move ----------
python_3 = GhPythonScript(beam=beam_from_frame.beam, frame_index=number_slider_4)  # -> out, pln; disabled
# ---------- python_3: Python ----------
__author__ = "aapolina"
__version__ = "2022.01.25"

import rhinoscriptsyntax as rs
from compas_timber.utils.rhino_compas import cFrame2rPln

if frame_index==-1: 
    cframe = beam.frame
else:
    cframe = beam.side_frame(frame_index)
    
    
pln = cFrame2rPln(cframe)
# ---------- end python_3 ----------
orient = GhPythonScript(beam=beam_from_frame.beam, vec=vec_5)  # -> out, beam, shape; inputs vec: Vector3d; disabled
# ---------- orient: Python ----------
__author__ = "aapolina"
__version__ = "2021.12.17"

beam = beam.copy()

import rhinoscriptsyntax as rs
from compas_timber.utils.rhino_compas import rVec2cVec, cBox2rBox
vec = rVec2cVec(vec)

beam.align_z(vec)
shape = cBox2rBox(beam.shape)
# ---------- end orient ----------
new = _new(brep=flatten(butt_jointed_geo.trimmed_breps), beam_frame=flatten(python.beam_frame), bake=Button())  # -> out, map_pln, Model; inputs brep: Brep, bake: Boolean
# ---------- new: Python ----------
# -*- coding: utf-8 -*-
import Rhino.Geometry as rg
import scriptcontext as sc
import math
import copy
import Rhino.Render as rr
import rhinoscriptsyntax as rs
import Rhino
import random

def create_box_map(pln,sx,sy,sz):
    """
    pln: frame of beam box, where x=main axis, y=width, z=height
    sx,sy,sz: box map size in x,y,z direction
    """

    v = pln.YAxis
    w = pln.ZAxis
    pt = pln.Origin

    #random deviation 
    a = math.pi*0.5
    randangle = (random.random()-0.5)*a
    v.Rotate(randangle,pln.XAxis)
    
    b = math.pi*0.01
    randangle = (random.random()-0.5)*b
    w.Rotate(randangle,pln.XAxis)
    
    randpos = dimx*random.random()
    pt += pln.XAxis*randpos
    
    #create box mapping
    mappingPln = rg.Plane(pt, w, v)
    dx = rg.Interval(-sx*0.5,sx*0.5)
    dy = rg.Interval(-sy*0.5,sy*0.5)
    dz = rg.Interval(-sz*0.5,sz*0.5)

    BoxMap = Rhino.Render.TextureMapping.CreateBoxMapping(mappingPln, dx, dy, dz, False)

    return BoxMap, mappingPln


if not map_size:
    #for the pine 251 material bitmap, rotated
    dimx = 0.2
    dimy = 0.2
    dimz = 1.0
else:
    dimx,dimy,dimz = map_size

if bake:
    rs.EnableRedraw(False)
    sc.doc = Rhino.RhinoDoc.ActiveDoc

    attributes = None
    guid = sc.doc.Objects.Add(brep, attributes)

    boxmap,map_pln = create_box_map(beam_frame,dimx,dimy,dimz)
    sc.doc.Objects.ModifyTextureMapping(guid, 1, boxmap)


    sc.doc = ghdoc
    rs.EnableRedraw(True)
    rs.Redraw()
# ---------- end new ----------
new_2 = _new(brep=flatten(butt_jointed_geo_2.trimmed_breps), beam_frame=flatten(python_2.beam_frame), bake=Button())  # -> out, map_pln, Model; inputs brep: Brep, bake: Boolean; same code as new

number_slider_5 = Slider(0.68, range=0.01..1)  # disabled
deplane = DeconstructPlane(Plane=python_3.pln)  # -> Origin, XAxis, YAxis, ZAxis; disabled
amp = Amplitude(Vector=deplane.YAxis, Amplitude=number_slider_5)  # disabled
amp_2 = Amplitude(Vector=deplane.XAxis, Amplitude=number_slider_5)  # disabled
amp_3 = Amplitude(Vector=deplane.ZAxis, Amplitude=number_slider_5)  # disabled
swatch = ColourSwatch(SwatchColor=RGB(255, 143, 143))  # disabled
swatch_2 = ColourSwatch(SwatchColor=RGB(185, 255, 110))  # disabled
swatch_3 = ColourSwatch(SwatchColor=RGB(110, 243, 255))  # disabled
vdisex = VectorDisplayEx(Point=deplane.Origin, Vector=amp_2, Colour=swatch, Width=2)  # disabled
vdisex_2 = VectorDisplayEx(Point=deplane.Origin, Vector=amp, Colour=swatch_2, Width=2)  # disabled
vdisex_3 = VectorDisplayEx(Point=deplane.Origin, Vector=amp_3, Colour=swatch_3, Width=2)  # disabled
