# Grasshopper definition beam.gh (Grasshopper 1.0.7)

number_slider = Slider(0.12, range=0..1)
number_slider_2 = Slider(0.19, range=0..1)
pt = Point(Point(0, 0, 0))
vec = Vector(Vector(-1, 1, 0))  # disabled
pt_2 = Point(Point(5, 0, 0))
vdis = VectorDisplay(Anchor=pt, Vector=vec)
pln = Plane(Plane(origin=(-2, 0, 0), x=(0.8320502943, -0.5547001962, 0), y=(0.3922322703, 0.5883484054, 0.7071067812)))
ln = Line(StartPoint=pt, EndPoint=pt_2)
crv = Curve([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])
vec_2 = Vector(Vector(1, 0, 3))
crv_2 = Curve(<curve referenced from the Rhino model>)
vec_3 = Vector(Vector(1, 0, 3))
panel = Panel("""{0,1}
{1,2}
{0,2}""")
beam_from_points_vec = GhPythonScript(ps=pt, pe=pt_2, vec=vec, W=number_slider, H=number_slider_2)  # -> out, beam, shape; inputs ps: Point3d, pe: Point3d, vec: Vector3d
# ---------- beam_from_points_vec: Python ----------
__author__ = "aapolina"
__version__ = "2021.12.10"

import Rhino.Geometry as rg
from compas_ghpython.utilities import unload_modules


import compas_timber
reload(compas_timber)
unload_modules('compas_timber')
from compas_timber.parts.beam import Beam
from compas_timber.utils.rhino_compas import rVec2cVec, rPt2cPt, cBox2rBox

beam = Beam.from_endpoints(rPt2cPt(ps), rPt2cPt(pe), rVec2cVec(vec),W,H)
shape = cBox2rBox(beam.shape)
# ---------- end beam_from_points_vec ----------
beam_from_line_vec = GhPythonScript(line=ln, vec=vec, W=number_slider, H=number_slider_2)  # -> out, beam, shape; inputs line: Line, vec: Vector3d
# ---------- beam_from_line_vec: Python ----------
__author__ = "aapolina"
__version__ = "2021.12.10"

from compas_ghpython.utilities import unload_modules
import Rhino.Geometry as rg

import compas_timber
reload(compas_timber)
unload_modules('compas_timber')
from compas_timber.parts.beam import Beam
from compas_timber.utils.rhino_compas import rVec2cVec, cBox2rBox, rLine2cLine

v = rVec2cVec(vec) 

beam = Beam.from_centreline(rLine2cLine(line),rVec2cVec(vec),W,H)
shape = cBox2rBox(beam.shape)
# ---------- end beam_from_line_vec ----------
beam_from_frame = GhPythonScript(pln=pln, W=number_slider, H=number_slider_2, L=Slider(2.68, range=0..10))  # -> out, beam, shape; inputs pln: Plane
# ---------- beam_from_frame: Python ----------
__author__ = "aapolina"
__version__ = "2021.12.10"

import Rhino.Geometry as rg
import compas_timber
from compas_timber.parts.beam import Beam
from compas_timber.utils.rhino_compas import rPln2cFrame, cBox2rBox
from compas_ghpython import unload_modules
unload_modules('compas_timber')
reload(compas_timber)

beam = Beam(rPln2cFrame(pln),L,W,H)

beam = Beam.from_frame(rPln2cFrame(pln),W,H,L)


shape = cBox2rBox(beam.shape)
# ---------- end beam_from_frame ----------
list = ValueList({"T-butt", "Lap"}, selected="T-butt")
beam_from_line_vec_2 = GhPythonScript(line=crv, vec=vec_2, W="0.1", H="0.2")  # -> out, beam, shape; inputs line: Line, vec: Vector3d; same code as beam_from_line_vec
beam_from_line_vec_3 = GhPythonScript(line=crv_2, vec=vec_3, W="0.1", H="0.2")  # -> out, beam, shape; inputs line: Line, vec: Vector3d; same code as beam_from_line_vec
list_2 = ValueList({"T-butt", "Lap"}, selected="T-butt")
manual_connect = GhPythonScript(beams=beam_from_line_vec_2.beam, connectivity=panel, joint_type=list)  # -> out, beams, assembly_model, geometry; inputs beams: list, connectivity: list
# ---------- manual_connect: Python ----------
__author__ = "aapolina"
__version__ = "2021.11.30"

import compas_ghpython 
import compas_timber
compas_ghpython.utilities.unload_modules("compas_timber")
#import compas_timber
#reload(compas_timber)

from compas_timber.assembly.assembly import TimberAssembly
from compas_timber.connections.t_butt import TButtJoint

model = TimberAssembly()

for beam in beams: model.add_beam(beam)
con_list = [[int(c.Real),int(c.Imaginary)] for c in connectivity]

for ci,cj in con_list:
    joint = None
    if joint_type == "T-butt": joint = TButtJoint(beams[cj],beams[ci]) #TODO
    if joint_type == "Lap":    joint = Lap() #TODO
    model.add_joint(joint)
    model.connect([beams[ci], beams[cj]], joint)



assembly_model = model
geometry = [b.geometry for b in model.beams]
# ---------- end manual_connect ----------
auto_connect = GhPythonScript(beams=beam_from_line_vec_2.beam, joint_type=list_2)  # -> out, beams, assembly_model; inputs beams: list; disabled
# ---------- auto_connect: Python ----------
__author__ = "aapolina"
__version__ = "2021.11.30"

import compas_ghpython 
import compas_timber
compas_ghpython.utilities.unload_modules("compas_timber")
#import compas_timber
#reload(compas_timber)

from compas_timber.assembly.assembly import TimberAssembly
from compas_timber.connections.t_butt import TButtJoint

model = Assembly()

for beam in beams: 
    model.add_beam(beam)

tol = 1e-3
for crossbeam in model.beams:
    
    for mainbeam in model.beams:
        if crossbeam==mainbeam: continue
        if mainbeam.end1.pt.distance_to_line(crossbeam.centreline) <tol:
            print "connecting!"
            tjoint = TButtJoint(crossbeam, mainbeam.end1, gap)
            model.connect(crossbeam, mainbeam, tjoint)
        if mainbeam.end2.pt.distance_to_line(crossbeam.centreline) <tol:
            print "connecting!"
            tjoint = TButtJoint(crossbeam, mainbeam.end2, gap)
            model.connect(crossbeam, mainbeam, tjoint)
# ---------- end auto_connect ----------
python = GhPythonScript(beam=beam_from_line_vec_3.beam)  # -> out, brep, beam_frame
# ---------- python: Python ----------
__author__ = "aapolina"
__version__ = "2022.03.11"

import rhinoscriptsyntax as rs
from compas_timber.utils.rhino_compas import cFrame2rPln, cBox2rBox

beam_frame = cFrame2rPln(beam.frame)


brep=cBox2rBox(beam.shape)
# ---------- end python ----------
vec_4 = Vector(Vector(5, 2, 0))
vec_5 = Vector(Vector(1, 0, 2))
move = GhPythonScript(beam=beam_from_line_vec.beam, vec_start=vec_4)  # -> out, beam, shape; inputs vec_start: Vector3d, vec_end: Vector3d
# ---------- move: Python ----------
__author__ = "aapolina"
__version__ = "2021.12.17"



import rhinoscriptsyntax as rs
from compas_timber.utils.rhino_compas import rVec2cVec, cBox2rBox

beam = beam.copy()

if vec_start: 
    vec_start = rVec2cVec(vec_start)
    beam.move_endpoint(vec_start,'start')

if vec_end:
    vec_end = rVec2cVec(vec_end)
    beam.move_endpoint(vec_end,'end')

shape = cBox2rBox(beam.shape)
# ---------- end move ----------
python_2 = GhPythonScript(beam=beam_from_frame.beam, frame_index=Slider(5, range=-1..5))  # -> out, pln
# ---------- python_2: Python ----------
__author__ = "aapolina"
__version__ = "2022.01.25"

import rhinoscriptsyntax as rs
from compas_timber.utils.rhino_compas import cFrame2rPln

if frame_index==-1: 
    cframe = beam.frame
else:
    cframe = beam.side_frame(frame_index)
    
    
pln = cFrame2rPln(cframe)
# ---------- end python_2 ----------
orient = GhPythonScript(beam=beam_from_frame.beam, vec=vec_5)  # -> out, beam, shape; inputs vec: Vector3d
# ---------- orient: Python ----------
__author__ = "aapolina"
__version__ = "2021.12.17"

beam = beam.copy()

import rhinoscriptsyntax as rs
from compas_timber.utils.rhino_compas import rVec2cVec, cBox2rBox
vec = rVec2cVec(vec)

beam.align_z(vec)
shape = cBox2rBox(beam.shape)
# ---------- end orient ----------
show = GhPythonScript()  # -> out, geometry; inputs whatever: list
# ---------- show: Python ----------
__author__ = "aapolina"
__version__ = "2021.11.26"

import compas_timber
reload(compas_timber)

from compas_timber.parts.beam import Beam
from compas_timber.utils.rhino_compas import brep_from8points, list2rPt

geometry = []

for smth in whatever:
    if isinstance(smth,Beam):
        B = brep_from8points([list2rPt(p) for p in smth.corners])
        geometry.append(B)
# ---------- end show ----------
python_3 = GhPythonScript(model=manual_connect.assembly_model)  # -> out, box_breps, cutting_planes
# ---------- python_3: Python ----------
__author__ = "aapolina"
__version__ = "2022.03.08"

import rhinoscriptsyntax as rs
from compas_timber.utils.rhino_compas import cPln2rPln, cBox2rBox
from ghpythonlib.treehelpers import list_to_tree

joints = model.joints
print(joints)

for joint in joints: joint.apply_feature()

box_breps = []
cutting_planes = []
for beam in model.beams:
    box_breps.append(cBox2rBox(beam.shape))
    cplns = [cPln2rPln(feat[0]) for feat in beam.features if feat[1]=='trim']
    cutting_planes.append(cplns)


cutting_planes = list_to_tree(cutting_planes)



"""
beams_to_cut = [j.main_beam for j in model.joints]
box_breps = [cBox2rBox(b.shape) for b in beams_to_cut]
cutting_planes = [cPln2rPln(j.cutting_plane) for j in joints]


connections = model.connections
print(connections)
"""
# ---------- end python_3 ----------

number_slider_3 = Slider(0.68, range=0.01..1)
deplane = DeconstructPlane(Plane=python_2.pln)  # -> Origin, XAxis, YAxis, ZAxis
amp = Amplitude(Vector=deplane.YAxis, Amplitude=number_slider_3)
amp_2 = Amplitude(Vector=deplane.XAxis, Amplitude=number_slider_3)
amp_3 = Amplitude(Vector=deplane.ZAxis, Amplitude=number_slider_3)
vdisex = VectorDisplayEx(Point=deplane.Origin, Vector=amp_2, Colour=ColourSwatch(SwatchColor=RGB(255, 143, 143)), Width=2)
vdisex_2 = VectorDisplayEx(Point=deplane.Origin, Vector=amp, Colour=ColourSwatch(SwatchColor=RGB(185, 255, 110)), Width=2)
vdisex_3 = VectorDisplayEx(Point=deplane.Origin, Vector=amp_3, Colour=ColourSwatch(SwatchColor=RGB(110, 243, 255)), Width=2)

pflip = FlipPlane(Plane=python_3.cutting_planes, ReverseX=False, ReverseY=False, SwapAxes=True)
python_4 = GhPythonScript(brep=simplify(graft(python_3.box_breps)), pln=simplify(pflip))  # -> out, x; inputs brep: tree of Brep, pln: tree of Plane
# ---------- python_4: Python ----------
__author__ = "aapolina"
__version__ = "2022.03.08"

import rhinoscriptsyntax as rs

import Rhino.Geometry as rg
brep = [list(b)[0] for b in brep.Branches]
pln = [list(p) for p in pln.Branches]


assert len(brep)==len(pln)

x = []
for b,p in zip(brep,pln):
    if p:
        bi = b
        for pi in p:
            bx = rg.Brep.Trim(bi,pi,1e-6)
            if len(bx)==0:
                print("trim failed - nothing trimmed?")
            elif len(bx)==1:
                bi=bx[0]
            else:
                print("%s parts after trimming - adding none"%len(bx))
        x.append(bi)
    else:
        x.append(b)
# ---------- end python_4 ----------
box_map_size = GhPythonScript(x="0.25", y="0.25", z="1.0")  # -> out, map_size
# ---------- box_map_size: Python ----------
__author__ = "aapolina"
__version__ = "2022.03.11"

import Rhino.Geometry as rg
#dx = rg.Interval(-x*0.5,x*0.5)
#dy = rg.Interval(-y*0.5,y*0.5)
#dz = rg.Interval(-z*0.5,z*0.5)
map_size = [[x,y,z]]
# ---------- end box_map_size ----------
new = _new(brep=flatten(python.brep), beam_frame=flatten(python.beam_frame), map_size=box_map_size.map_size, bake=Button())  # -> out, map_pln, Model; inputs brep: Brep, bake: Boolean
# ---------- new: Python ----------
# -*- coding: utf-8 -*-
import Rhino.Geometry as rg
import scriptcontext as sc
import math
import copy
import Rhino.Render as rr
import rhinoscriptsyntax as rs
import Rhino
import random

def create_box_map(pln,sx,sy,sz):
    """
    pln: frame of beam box, where x=main axis, y=width, z=height
    sx,sy,sz: box map size in x,y,z direction
    """

    v = pln.YAxis
    w = pln.ZAxis
    pt = pln.Origin

    #random deviation 
    amin = math.pi*0.1
    randangle = random.random()*(math.pi-2*amin)+amin
    v.Rotate(randangle,pln.XAxis)
    
    bmin = math.pi*0.01
    randangleb = (random.random()-0.5)*bmin
    w.Rotate(randangleb,pln.XAxis)
    
    randpos = dimx*random.random()
    pt += pln.XAxis*randpos
    
    #create box mapping
    mappingPln = rg.Plane(pt, w, v)
    dx = rg.Interval(-sx*0.5,sx*0.5)
    dy = rg.Interval(-sy*0.5,sy*0.5)
    dz = rg.Interval(-sz*0.5,sz*0.5)

    BoxMap = Rhino.Render.TextureMapping.CreateBoxMapping(mappingPln, dx, dy, dz, False)

    return BoxMap, mappingPln


if not map_size:
    #for the pine 251 material bitmap, rotated
    dimx = 0.2
    dimy = 0.2
    dimz = 1.0

if bake:
    rs.EnableRedraw(False)
    sc.doc = Rhino.RhinoDoc.ActiveDoc

    attributes = None
    guid = sc.doc.Objects.Add(brep, attributes)
    
    dimx,dimy,dimz = map_size
    
    boxmap,map_pln = create_box_map(beam_frame,dimx,dimy,dimz)
    sc.doc.Objects.ModifyTextureMapping(guid, 1, boxmap)


    sc.doc = ghdoc
    rs.EnableRedraw(True)
    rs.Redraw()
# ---------- end new ----------
python_5 = GhPythonScript(model=manual_connect.assembly_model)  # -> out, brep, beam_frame
# ---------- python_5: Python ----------
__author__ = "aapolina"
__version__ = "2022.03.11"

import rhinoscriptsyntax as rs
from compas_timber.utils.rhino_compas import cFrame2rPln, cBox2rBox



beam_frame = [cFrame2rPln(beam.frame) for beam in model.beams]


brep=[cBox2rBox(beam.shape) for beam in model.beams]
# ---------- end python_5 ----------
bars_brep = Brep(python_4.x)
rec = DataRecorder(new.map_pln, DataLimit=-10, RecordData=True)
new_2 = _new(brep=flatten(bars_brep), beam_frame=flatten(python_5.beam_frame), bake=Button())  # -> out, map_pln, Model; inputs brep: Brep, bake: Boolean
# ---------- new_2: Python ----------
# -*- coding: utf-8 -*-
import Rhino.Geometry as rg
import scriptcontext as sc
import math
import copy
import Rhino.Render as rr
import rhinoscriptsyntax as rs
import Rhino
import random

def create_box_map(pln,sx,sy,sz):
    """
    pln: frame of beam box, where x=main axis, y=width, z=height
    sx,sy,sz: box map size in x,y,z direction
    """

    v = pln.YAxis
    w = pln.ZAxis
    pt = pln.Origin

    #random deviation 
    amin = math.pi*0.1
    randangle = random.random()*(math.pi-2*amin)+amin
    v.Rotate(randangle,pln.XAxis)
    
    bmin = math.pi*0.01
    randangleb = (random.random()-0.5)*bmin
    w.Rotate(randangleb,pln.XAxis)
    
    randpos = dimx*random.random()
    pt += pln.XAxis*randpos
    
    #create box mapping
    mappingPln = rg.Plane(pt, w, v)
    dx = rg.Interval(-sx*0.5,sx*0.5)
    dy = rg.Interval(-sy*0.5,sy*0.5)
    dz = rg.Interval(-sz*0.5,sz*0.5)

    BoxMap = Rhino.Render.TextureMapping.CreateBoxMapping(mappingPln, dx, dy, dz, False)

    return BoxMap, mappingPln


if not map_size:
    #for the pine 251 material bitmap, rotated
    dimx = 0.2
    dimy = 0.2
    dimz = 1.0
else:
    dimx,dimy,dimz = map_size

if bake:
    rs.EnableRedraw(False)
    sc.doc = Rhino.RhinoDoc.ActiveDoc

    attributes = None
    guid = sc.doc.Objects.Add(brep, attributes)
    
    
    
    boxmap,map_pln = create_box_map(beam_frame,dimx,dimy,dimz)
    sc.doc.Objects.ModifyTextureMapping(guid, 1, boxmap)


    sc.doc = ghdoc
    rs.EnableRedraw(True)
    rs.Redraw()
# ---------- end new_2 ----------
id = Guid(bars_brep)  # disabled
toggle = BooleanToggle(False)  # disabled
new_3 = _new(BarBrepIDs=id, bake=toggle)  # -> out, Model; inputs BarBrepIDs: list, bake: Boolean; disabled
# ---------- new_3: Python ----------
# -*- coding: utf-8 -*-
import Rhino.Geometry as rg
import scriptcontext as sc
import math
import copy
import Rhino.Render as rr
import rhinoscriptsyntax as rs
import Rhino
import random


def add_material_to_brep(guid):
    #http://developer.rhino3d.com/samples/rhinocommon/add-texture/
    #https://discourse.mcneel.com/t/modifytexturemapping-question/14456/3
    
    #guid = sc.doc.Objects.AddBrep(bar.brep)
    
    brep = rs.coercebrep(guid)
    pts = [vert.Location for vert in brep.Vertices]
    print pts
    
    x_dir = pts[4]-pts[0]
    y_dir = pts[1]-pts[0]
    z_dir = rg.Vector3d.CrossProduct(x_dir,y_dir)
    y_dir = rg.Vector3d.CrossProduct(x_dir,z_dir)
    xlen = x_dir.Length
    x_dir.Unitize()
    y_dir.Unitize()
    z_dir.Unitize()

    v = copy.deepcopy(z_dir)
    amin = math.pi/18
    randangle = random.random()*(math.pi-2*amin)+amin
    v.Rotate(randangle,x_dir)
    
    bmin = math.radians(1)
    randangleb = (random.random()-0.5)*bmin
    w = copy.deepcopy(x_dir)
    w.Rotate(randangleb,z_dir)
    
    randpos = xlen*random.random()
    pt = (pts[0]+pts[2])/2 + x_dir*randpos
    
    mappingPln = rg.Plane(pt, w, v)
    kx=xlen
    ky=pts[1].DistanceTo(pts[2])
    kz=pts[0].DistanceTo(pts[1])
    dx = rg.Interval(-kx,kx)
    dy = rg.Interval(-kx,kx)
    dz = rg.Interval(-kz,kz)
    BoxMap = Rhino.Render.TextureMapping.CreateBoxMapping(mappingPln, dx, dy, dz, False)
    sc.doc.Objects.ModifyTextureMapping(guid, 1, BoxMap)

    pass


if bake:
    rs.EnableRedraw(False)
    sc.doc = Rhino.RhinoDoc.ActiveDoc



    for guid in BarBrepIDs:
        add_material_to_brep(guid)
        


    sc.doc = ghdoc
    rs.EnableRedraw(True)
    rs.Redraw()
# ---------- end new_3 ----------
