# Grasshopper definition GH.ghx (Grasshopper 1.0.8)

geo = Geometry(<curve referenced from the Rhino model>)
geo_2 = Geometry(<curve referenced from the Rhino model>)
geo_3 = Geometry(<curve referenced from the Rhino model>)
py3 = Python3Script(line1=geo, line2=geo_2, line3=geo_3)  # -> out, a; inputs line1: Line, line2: Line, line3: Line
# ---------- py3: Python ----------
#venv: compas_timber_dev2



from compas_rhino.devtools import DevTools
DevTools.enable_reloader()
DevTools.ensure_path()
# ---------- end py3 ----------
