# Grasshopper definition slot_feature.ghx (Grasshopper 1.0.8)

inclination = Slider(88.8, range=0.1..179.9)
angle = Slider(15.8, range=-90..90)
angle_ref_point = Slider(83, range=0.1..179.9)
angle_opp_point = Slider(88.2, range=0.1..179.9)
add_angle_opp_point = Slider(7.4, range=-179.9..179.9)
geo = Geometry(<curve referenced from the Rhino model>)
geo_2 = Geometry(<curve referenced from the Rhino model>)
pln = Plane(Plane(origin=(54.5756175, 137.6667516, 0.6323572888), x=(-0.9941467319, -0.1080257302, 0.001648365546), y=(0.02552997031, -0.220069169, 0.9751501328)))
py3 = Python3Script(
    centerline=geo,
    start_x=Slider(108.3, range=0..1000),
    start_y=Slider(9.2, range=0..10),
    start_depth=Slider(24, range=0..100),
    inclination=inclination,
    angle=angle,
    length=Slider(13.3, range=0..100),
    depth=Slider(19, range=0..100),
    thickness=Slider(3.5, range=0..10),
    angle_ref_point=angle_ref_point,
    angle_opp_point=angle_opp_point,
    add_angle_opp_point=add_angle_opp_point)  # -> out, a, b, c, d, e; inputs centerline: Line, start_x: Double, start_y: Double, angle: Double
# ---------- py3: Python ----------
#venv: ct_dev
#r: compas


from compas_rhino.devtools import DevTools
DevTools.ensure_path()

from compas_rhino.conversions import line_to_compas
from compas_rhino.conversions import plane_to_compas
from compas_rhino.conversions import frame_to_rhino_plane

import compas_timber

import importlib
importlib.reload(compas_timber.fabrication.slot)


from compas_timber.elements import Beam
from compas_timber.model import TimberModel
from compas_timber.fabrication import JackRafterCutProxy
from compas_timber.fabrication.slot import Slot
from compas_timber.fabrication import OrientationType






centerline = line_to_compas(centerline)


tmodel = TimberModel()


beam = Beam.from_centerline(centerline, 24, 40)


slot_feature = Slot(
        orientation=OrientationType.START,
        start_x=start_x,
        start_y=start_y,
        start_depth=start_depth,
        angle=angle,
        inclination=inclination,
        length=length,
        depth=depth,
        thickness=thickness,
        angle_ref_point=angle_ref_point,
        angle_opp_point=angle_opp_point,
        add_angle_opp_point=add_angle_opp_point,
        machining_limits=None,
        ref_side_index = 0
)




beam.add_feature(slot_feature)

b = beam.geometry

c = frame_to_rhino_plane(beam.ref_sides[0])
# ---------- end py3 ----------
py3_2 = Python3Script(active=Toggle(True))  # -> out, a; inputs active: Boolean
# ---------- py3_2: Python ----------
#venv: ct_dev

from compas_rhino.devtools import DevTools
if active:
    DevTools.enable_reloader()
else:
    DevTools.disable_reloader()
# ---------- end py3_2 ----------
py3_3 = Python3Script(centerline=geo_2, plane=pln)  # -> out, a; inputs centerline: Line
# ---------- py3_3: Python ----------
#venv: ct_dev
#r: compas

from compas_rhino.devtools import DevTools
DevTools.ensure_path()

from compas_rhino.conversions import *

import compas_timber

import importlib
importlib.reload(compas_timber.fabrication.slot)

from compas_timber.fabrication.slot import Slot
from compas_timber.elements import Beam


centerline = line_to_compas(centerline)
plane = plane_to_compas(plane)


beam = Beam.from_centerline(centerline, 40, 40)


slot = Slot.from_plane_and_beam(plane, beam, 10, 4)

print(slot.__data__)


beam.add_feature(slot)

a = beam.geometry
print(type(a))
# ---------- end py3_3 ----------
panel = Panel(py3.e)
draw = COMPASDraw(cg=py3.b)  # -> rg
#   port cg: The COMPAS geometry or datastructure to be drawn.
#   port rg: The Rhino geometry object.
# ---------- draw: Python ----------
# r: compas>=2.8.1
"""
Draws COMPAS geometry in Grasshopper.
"""

from typing import Any

import Grasshopper

from compas.scene import SceneObject


class CompasToRhinoGeometry(Grasshopper.Kernel.GH_ScriptInstance):
    def RunScript(self, cg):
        if not cg:
            return None

        return SceneObject(item=cg).draw()
# ---------- end draw ----------
draw_2 = COMPASDraw(cg=py3.d)  # -> rg; same code as draw
draw_3 = COMPASDraw(cg=py3.e)  # -> rg; same code as draw
pln_2 = Plane(py3.a)
pln_3 = Plane(py3.c)
draw_4 = COMPASDraw(cg=py3_3.a)  # -> rg; same code as draw
