# Grasshopper definition test.gh (Grasshopper 1.0.8)

geo = Geometry(<curve referenced from the Rhino model>)
geo_2 = Geometry(<curve referenced from the Rhino model>)
geo_3 = Geometry(<curve referenced from the Rhino model>)
geo_4 = Geometry([<curve referenced from the Rhino model> x3])
geo_5 = Geometry(<curve referenced from the Rhino model>)
py3 = Python3Script(cross_line=geo, main_line_a=geo_2, main_line_b=geo_3)  # -> out, a, b, c, d; inputs cross_line: Line, main_line_a: Line, main_line_b: Line
# ---------- py3: Python ----------
#venv: new_env_ct_dev2
#r: compas==2.14.1
#r: compas_model

import importlib

from compas_rhino.devtools import DevTools
DevTools.ensure_path()

from compas_rhino.conversions import *

from compas_timber.connections.k_butt import KButtJoint
from compas_timber.elements import Beam
from compas_timber.model import TimberModel

import compas_timber
importlib.reload(compas_timber.connections.k_butt)




cross_line = line_to_compas(cross_line)
main_line_a = line_to_compas(main_line_a)
main_line_b = line_to_compas(main_line_b)

cross_beam = Beam.from_centerline(cross_line, 30, 30)
beam_a = Beam.from_centerline(main_line_a, 30, 20)
beam_b = Beam.from_centerline(main_line_b, 30, 20)


joint = KButtJoint(cross_beam, beam_a, beam_b, 10)

joint.add_extensions()
joint.add_features()






a = joint.cross_beam.geometry
b = joint.main_beam_a.geometry
c = beam_b.geometry
# ---------- end py3 ----------
py3_2 = Python3Script()  # -> out, a
# ---------- py3_2: Python ----------
#venv: new_env_ct_dev2

from compas_rhino.devtools import DevTools

active = True

if active:
    DevTools.enable_reloader()
else:
    DevTools.disable_reloader()
# ---------- end py3_2 ----------
py3_3 = Python3Script(lines=geo_4)  # -> out, a; inputs lines: list of Line
# ---------- py3_3: Python ----------
#venv: new_env_ct_dev2
#r: compas==2.14.1
#r: compas_model


import compas
print(compas.__version__)

from compas_rhino.devtools import DevTools
DevTools.ensure_path()

from compas_timber.elements import Beam
from compas_timber.connections import YButtJoint
from compas_timber.model import TimberModel
from compas_rhino.conversions import line_to_compas

c_lines = []
for line in lines:
    compas_line = line_to_compas(line)
    c_lines.append(compas_line)

width = 80
height = 120
z_vector = (0, 1, 0)

a = []
model = TimberModel()

for line in c_lines:
    beam = Beam.from_centerline(line, width, height, z_vector)
    model.add_element(beam)

beams = list(model.beams)

YButtJoint.create(model, beams[2], beams[1], beams[0])
model.process_joinery()
print(model)

for beam in model.beams:
    a.append(beam.geometry)
# ---------- end py3_3 ----------
py3_4 = Python3Script(
    line=geo_5,
    start_x=Slider(49, range=0..100),
    start_y=Slider(0, range=0..100),
    start_depth=Slider(16, range=0..100),
    angle=Slider(0, range=-90..90),
    inclination=Slider(0, range=-90..90),
    length=Slider(10, range=0..100),
    width=Slider(43, range=0..100),
    tilt_ref_side=Slider(90, range=0.1..179.9),
    tilt_end_side=Slider(132.8, range=0.1..179.9),
    tilt_opp_side=Slider(90, range=0.1..179.9),
    tilt_start_side=Slider(131.5, range=0.1..179.9))  # -> out, a; inputs line: Line
# ---------- py3_4: Python ----------
#venv: new_env_ct_dev2
#r: compas==2.14.1
#r: compas_model

import importlib

from compas_rhino.devtools import DevTools
DevTools.ensure_path()

from compas_rhino.conversions import *

from compas_timber.fabrication import Pocket
from compas_timber.fabrication import MachiningLimits
from compas_timber.elements import Beam


line = line_to_compas(line)

beam = Beam.from_centerline(line, 40, 40)

ml =  MachiningLimits()

pocket = Pocket(
    start_x=start_x,
    start_y=start_y,
    start_depth=start_depth,
    angle=angle,
    inclination=inclination,
    slope=0.0,
    length=length,
    width=width,
    internal_angle=90.0,
    tilt_ref_side=tilt_ref_side,
    tilt_end_side=tilt_end_side,
    tilt_opp_side=tilt_opp_side,
    tilt_start_side=tilt_start_side,
    machining_limits=ml.limits,
    ref_side_index=2


)



beam.add_feature(pocket)

a = beam.geometry
# ---------- end py3_4 ----------
draw = COMPASDraw(cg=py3_3.a)  # -> rg
#   port cg: The COMPAS geometry or datastructure to be drawn.
#   port rg: The Rhino geometry object.
# ---------- draw: Python ----------
# r: compas>=2.14.1
"""
Draws COMPAS geometry in Grasshopper.
"""

from typing import Any

import Grasshopper

from compas.scene import SceneObject


class CompasToRhinoGeometry(Grasshopper.Kernel.GH_ScriptInstance):
    def RunScript(self, cg):
        if not cg:
            return None

        return SceneObject(item=cg).draw()
# ---------- end draw ----------
draw_2 = COMPASDraw(cg=py3.a)  # -> rg; same code as draw
draw_3 = COMPASDraw(cg=py3.b)  # -> rg; same code as draw
draw_4 = COMPASDraw(cg=py3.c)  # -> rg; same code as draw
draw_5 = COMPASDraw(cg=py3.d)  # -> rg; same code as draw
draw_6 = COMPASDraw(cg=py3_4.a)  # -> rg; same code as draw
